# Grasshopper definition Final.gh (Grasshopper 1.0.7)
# plug-ins: SpacePartition, Human, PTComponentLibrary, MetaHopper, RhinoInside.Revit

# ---- group: InputData / Labels
txt = Text(Tree({0;0}: ["Unidades sanitarias mujeres / privadas"], {0;1}: ["Unidades sanitarias hombres / privadas"], {0;2}: ["Cuarto de aseo "], {0;3}: ["Área de aseo de residuos"], {0;4}: ["Almacen General Insumos de Aseo "], {0;5}: ["Área de UPC-Rack"]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))

# ---- group: InputData / Topology
int = Integer(Tree({0}: [7], {1}: [7], {2}: [3], {3}: [2, 11], {4}: [16, 21, 19], {5}: [19]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))

# ---- group: InputData / ID
txt_2 = Text(Tree({0;0}: ["5"], {0;1}: ["5"], {0;2}: ["5"], {0;3}: ["5"], {0;4}: ["5"], {0;5}: ["5"]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))

# ---- group: InputData / Areas
txt_3 = Text(Tree({0;0}: ["3"], {0;1}: ["3"], {0;2}: ["6"], {0;3}: ["1"], {0;4}: ["5"], {0;5}: ["4"]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))

# ---- group: InputData
number_slider = Slider(1, range=0..10)
path_mapper = PathMapper(txt, source="{A;B}", target="{A}")
path_mapper_2 = PathMapper(txt_3, source="{A;B}", target="{A}")
path_mapper_3 = PathMapper(int, source="{A;B}", target="{A}")
path_mapper_4 = PathMapper(txt_2, source="{A;B}", target="{A}")
prunebranches = CSharpScript(branches=path_mapper, howMany=number_slider)  # -> prunedTree, branchCounter; inputs branches: tree of String, howMany: Int32
# ---------- prunebranches: C# ----------
    var treeOut = new DataTree<string>();

    for( int i = 0; i < branches.BranchCount - howMany; ++i )
      treeOut.AddRange(branches.Branch(i), new GH_Path(i));

    prunedTree = treeOut;
    branchCounter = treeOut.BranchCount;
# ---------- end prunebranches ----------
prunebranches_2 = CSharpScript(branches=path_mapper_2, howMany=number_slider)  # -> prunedTree, branchCounter; inputs branches: tree of String, howMany: Int32; same code as prunebranches
ma = MassAddition(Input=prunebranches_2.prunedTree)  # -> Result, PartialResults
flatten = FlattenTree(Tree=prunebranches_2.prunedTree, Path="{0}")
lng = ListLength(List=flatten)
int_2 = Integer(Slider(4, range=0..10))

# ----
panel = Panel(prunebranches_2.prunedTree)

# ---- group: Grid / Controllers
number_slider_2 = Slider(20.818, range=0..21)
number_slider_3 = Slider(4.392, range=0..5)

# ---- group: Voronoi
number_slider_4 = Slider(0, range=0..0.1)
subtraction = Subtraction(A=Slider(1, range=0..1), B=number_slider_4)
dom = ConstructDomain(DomainStart=number_slider_4, DomainEnd=subtraction)

# ---- group: Grid
dom_2 = ConstructDomain(DomainStart=expr("-x", number_slider_2), DomainEnd=number_slider_2)
dom_3 = ConstructDomain(DomainStart=expr("-x", number_slider_3), DomainEnd=number_slider_3)
pt = Point(Point(-27.55069635, 0.2364199029, 0))
dedomain = DeconstructDomain(Domain=dom_2)  # -> Start, End
rectangle = Rectangle(Plane=pt, XSize=dom_3, YSize=dom_2, Radius=0)  # -> Rectangle, Length

# ----
genemodifier = GenePoolModifier(GeneList="SeedsX", Count=lng, Domain=dom, Randomize=Button(), PercentageOfRandomization=Slider(1, range=0..1))
genemodifier_2 = GenePoolModifier(GeneList="SeedsY", Count=lng, Domain=dom, Randomize=Button(), PercentageOfRandomization=Slider(1, range=0..1))

# ---- group: Labels
bang = ExplodeTree(Data=prunebranches.prunedTree)  # -> Branch0, Branch1, Branch2, Branch3

# ---- group: Areas
bang_2 = ExplodeTree(Data=prunebranches_2.prunedTree)  # -> Branch0, Branch1, Branch2, Branch3

# ----
crv = Curve(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)

# ---- group: SpacePartition / OriginalSilhouette
crv_2 = Curve(crv)

# ---- group: SpacePartition / RandomColourSeed
number_slider_5 = Slider(40, range=0..100)
number_slider_6 = Slider(238, range=0..1000)
number_slider_7 = Slider(326, range=0..1000)

# ---- group: Spine / PREVENTS INFINITE LOOPS (ALSO ALLOWS STEPPING THROUGH PROCESS)
threshold = Slider(14, range=0..40)

# ---- group: Spine / ARBITRARY VERY HIGH NUMBER
threshold_2 = Integer(1000)

# ---- group: SpacePartition / RandomColourSeed
number_slider_8 = Slider(40, range=0..100)
number_slider_9 = Slider(274, range=0..1000)
number_slider_10 = Slider(326, range=0..1000)

number_slider_11 = Slider(40, range=0..100)
number_slider_12 = Slider(238, range=0..1000)
number_slider_13 = Slider(326, range=0..1000)

number_slider_14 = Slider(40, range=0..100)
number_slider_15 = Slider(238, range=0..1000)
number_slider_16 = Slider(326, range=0..1000)

number_slider_17 = Slider(274, range=0..1000)
number_slider_18 = Slider(40, range=0..100)
number_slider_19 = Slider(326, range=0..1000)

# ----
relay = Relay()
number_slider_20 = Slider(0.2, range=0..1)
number_slider_21 = Slider(0.3, range=0..1)
srf = Surface(crv_2)
area = Area(Geometry=srf)  # -> Area, Centroid
scale = Scale(Geometry=srf, Center=area.Centroid, Factor=Slider(2, range=0..10))  # -> Geometry, Transform
crv_3 = Curve(<curve referenced from the Rhino model>)
srf_2 = Surface(crv_3)

# ---- group: SpacePartition
toggle = GroupToggle(ToggleActive=True, ToggleVisible=False)  # disabled
number_slider_22 = Slider(0.9, range=0..1)
subtraction_2 = Subtraction(A=Slider(1, range=0..1), B=number_slider_22)
lng_2 = ListLength(List=flatten(ma.Result))
dom_4 = ConstructDomain(DomainStart=subtraction_2, DomainEnd=number_slider_22)
bbox = BoundingBox(Content=crv_2, Plane=PlaneXY(0, 0, 0))  # -> Box, Box_2
lng_3 = ListLength(List=flatten(ma.Result))
dom_5 = ConstructDomain(DomainStart=0, DomainEnd=1)
genemodifier_3 = GenePoolModifier(GeneList="X", Count=lng_2, Domain=dom_4, Randomize=Button(), PercentageOfRandomization=Slider(1, range=0..1))
ptsrfdomnum = SurfaceDomainNumber(Surface=bbox.Box, UNumber=Slider(2, range=0..100), VNumber=Slider(23, range=0..100))
X = GenePool(Decimals=3, Maximum=0.9, Minimum=0.1, Value=[0.1690914665, 0.1832183417, 0.6271986092, 0.4137094749])
genemodifier_4 = GenePoolModifier(GeneList="Y", Count=lng_3, Domain=dom_4, Randomize=Button(), PercentageOfRandomization=Slider(1, range=0..1))
Y = GenePool(Decimals=3, Maximum=0.9, Minimum=0.1, Value=[0.4979438854, 0.1693476808, 0.2246621129, 0.2206801735])
ptborders = GenerateBorders(Grid=ptsrfdomnum, PanelShape=0)  # -> simplify(Border)
pt_2 = ConstructPoint(XCoordinate=X, YCoordinate=Y, ZCoordinate=0)
crv_4 = Curve(flatten(ptborders))
evalsrf = EvaluateSurface(Surface=reparameterize(crv_2), Point=pt_2)  # -> Point, Normal, UDirection, VDirection, Frame
item = ListItem(List=crv_4, Index=0, Wrap=True)
area_2 = Area(Geometry=item)  # -> Area, Centroid
multiplication = Multiplication(A=area_2.Area, B=Slider(0.6, range=0..1))
srf_cp = SurfaceClosestPoint(Point=evalsrf.Point, Surface=crv_2)  # -> Point, UVPoint, Distance
voronoi = Voronoi(Points=srf_cp.Point, Boundary=rectangle.Rectangle, BruteForceOverride=False)
number_slider_23 = Slider(0.001, range=0..0.001)
multiplication_2 = Multiplication(A=multiplication, B=Slider(2.8, range=0..10))
dom_6 = ConstructDomain(DomainStart=Slider(0, range=0..100), DomainEnd=Slider(255, range=0..1000))
number_slider_24 = Slider(241, range=0..255)

# ----
spacepartition = SpacePartition(VoronoiIn=voronoi, GridIn=crv_4, AreaIn=multiplication, Distance=multiplication_2, Tolerance=number_slider_23)

# ---- group: SpacePartition (continued)
sortxy = SortPointsXY(Grid=flatten(spacepartition))
pararunion = ParallelRegionUnion(Curves=spacepartition)
missing = MissingGridCells(CulledGrid=flatten(sortxy), OriginalGrid=crv_4)
mgtree = MergeTreeMissing(CulledGrid=pararunion, MissingGridCells=missing)
pararunion_2 = ParallelRegionUnion(Curves=mgtree)
parallelregionintersection = ParallelRegionIntersection(CurvesA=crv_2, CurvesB=pararunion_2)
lng_4 = ListLength(List=flatten(parallelregionintersection))
random = Random(Range=dom_6, Number=lng_4, Seed=[number_slider_5, number_slider_6, number_slider_7], Integers=True)
bang_3 = ExplodeTree(Data=random)  # -> Branch0, Branch1, Branch2
srf_3 = Surface(parallelregionintersection)
rgb = ColourRGB(
    Alpha=number_slider_24,
    Red=bang_3.Branch0,
    Green=[55, 209, 59, 216, 1, 112, 142, 1, 76, 111, 92, 58, 62, 60, 197, 158, 67, 19, 183, 163, 50, 202, 112, 182, 111],
    Blue=[9, 120, 163, 36, 100, 115, 248, 253, 79, 124, 119, 250, 189, 19, 44, 159, 229, 29, 128, 139, 34, 211, 22, 234, 166])

# ----
rgb_2 = ColourRGB(Alpha=number_slider_24, Red=expr("x*2", bang_3.Branch1), Green=expr("x*0.5", bang_3.Branch1), Blue=0)

# ---- group: SpacePartition (continued)
preview = CustomPreview(Geometry=srf_3, Material=graft(rgb_2))

# ----
sortxy_2 = SortPointsXY(Grid=flatten(parallelregionintersection))
area_3 = Area(Geometry=sortxy_2, UseTasks=False)  # -> Area, Centroid
ma_2 = MassAddition(Input=area_3.Area)  # -> Result, PartialResults
item_2 = ListItem(List=flatten(ma.Result), Index=0, Wrap=True)  # -> Item, Item1, Item2, Item3
merge = Merge(Data1=item_2.Item2, Data2=item_2.Item3, Data3=item_2.Item1, Data4=item_2.Item)
ma_3 = MassAddition(Input=merge)  # -> Result, PartialResults
division = Division(A=ma_3.Result, B=ma_2.Result)
multiplication_3 = Multiplication(A=area_3.Area, B=division)
fitness = CSharpScript(ExpectedAreas=merge, ActualAreas=multiplication_3)  # -> Fitness; inputs ExpectedAreas: list, ActualAreas: list
# ---------- fitness: C# ----------
    double fitness = 0;

    int size = ActualAreas.Count;
    int expected = ExpectedAreas.Count;

    if( size != expected )
    {

      fitness += Math.Abs(size - expected) * 100;

    }

    else
    {

      for( int i = 0; i < ExpectedAreas.Count; ++i )
      {

        fitness += Math.Abs(Convert.ToDouble(ExpectedAreas[i]) - ( double ) ActualAreas[i]);

      }

    }

    Fitness = fitness;
# ---------- end fitness ----------
labels = Panel(fitness)
galapagos = Galapagos(fitness=fitness, gene=[X, Y])

# ---- group: Geometry
bang_4 = ExplodeTree(Data=simplify(parallelregionintersection))  # -> Branch0, Branch1, Branch2, Branch3
item_3 = ListItem(List=sortxy_2, Index=0, Wrap=True)  # -> Item, Item1, Item2, Item3

# ---- group: SpaceSyntaxis
toggle_2 = GroupToggle(ToggleActive=True, ToggleVisible=False)  # disabled
toggle_3 = BooleanToggle(False)  # disabled
spctopo = SpaceTopology(Curves=flatten(parallelregionintersection), ParallelComputing=toggle_3)  # disabled
linetopo = LineTopology(PointTree=graft(area_3.Centroid), Topology=spctopo)  # disabled
ma_4 = MassAddition(Input=multiplication_3)  # -> Result, PartialResults; disabled

# ----
toggle_4 = GroupToggle(ToggleActive=True, ToggleVisible=False)  # disabled
labels_2 = Panel("""Publico
SemiPrivado
PrivadoUno
PrivadoDos""")
graft = GraftTree(Tree=labels_2, IncludeEmptyLists=True, IncludeNullItems=True)  # -> simplify(Tree)
addindextolabels = CSharpScript(labels=graft, areas=flatten(area_3.Area))  # -> indexedLabels; inputs labels: tree, areas: list
# ---------- addindextolabels: C# ----------
    var newLabels = new DataTree<string>();

    for( int i = 0; i < labels.BranchCount; ++i )
      for( int j = 0; j < labels.Branch(i).Count; ++j )
      {

        newLabels.Add((string)labels.Branch(i)[j] + ' ' + Math.Round(( double ) areas[i], 3), new GH_Path(i));

      }

    indexedLabels = newLabels;
# ---------- end addindextolabels ----------
number_slider_25 = Slider(17.167, range=0..100)
panel_2 = Panel("Interstate")
tag = TextTag(Location=area_3.Centroid, Text=addindextolabels)
addindextolabels_2 = CSharpScript(labels=labels_2, areas=area_3.Area)  # -> indexedLabels; inputs labels: list, areas: list
# ---------- addindextolabels_2: C# ----------
    var newLabels = new List<string>();

    for( int i = 0; i < labels.Count; ++i )
    {

      newLabels.Add((string) labels[i] + ' ' + Math.Round(( double ) areas[i], 3));

    }

    indexedLabels = newLabels;
# ---------- end addindextolabels_2 ----------
division_2 = Division(A=multiplication_3, B=merge)
c_script = CSharpScript(x=division_2)  # -> out, A; inputs x: list
# ---------- c_script: C# ----------
    int size = x.Count;
    
    double[] errors = new double[size];
    
    for( int i = 0; i < size; ++i )
    {
    
      double temp = ( double ) x[i];
      
      errors[i] = temp > 1 ? temp - 1 : 1 - temp;
      
    }
    
    A = errors;
# ---------- end c_script ----------
frgb = ColourRGBF(Alpha=1, Red=0, Green=0, Blue=0)
ma_5 = MassAddition(Input=c_script.A)  # -> Result, PartialResults
lng_5 = ListLength(List=division_2)
errorpercentage = Panel(c_script.A)
screentext = ScreenOrientedText(
    Text=addindextolabels_2,
    Font="Interstate",
    Justification=8,
    Location=area_3.Centroid,
    SizeFactor=Slider(14.504, range=0..100),
    Color=frgb,
    Depth=0,
    Absolute=False)
division_3 = Division(A=ma_5.Result, B=lng_5)
results = Panel(multiplication_3)
errorpercentagemean = Panel(division_3)
expectedresults = Panel(merge)

tag_2 = TextTag(Location=area_3.Centroid, Text=addindextolabels_2)
tag_3 = TextTag3D(Location=area_3.Centroid, Text=addindextolabels_2, Size=Slider(1, range=0..1), Justification=5)

# ---- group: Spine
toggle_5 = GroupToggle(ToggleActive=True, ToggleVisible=False)  # disabled
explode = Explode(Curve=crv_2, Recursive=True)  # -> Segments, Vertices
number_slider_26 = Slider(38, range=0..100)
threshold_3 = Slider(15, range=0..200)
frgb_2 = ColourRGBF(Alpha=Slider(0, range=0..1), Red=Slider(0, range=0..1), Green=Slider(0, range=0..1), Blue=Slider(0, range=0..1))

# ATTENTION: Be sure there are no duplicate segments!
crv_5 = Curve(flatten(explode.Segments))
y_bounds = Domain(Domain(-180, 180))
grid_divisions = Integer(number_slider_26)
x_bounds = Domain(Domain(-200, 200))

# ---- group: SpacePartition
toggle_6 = GroupToggle(ToggleActive=True, ToggleVisible=False)  # disabled
bbox_2 = BoundingBox(Content=item_3.Item1, Plane=PlaneXY(0, 0, 0))  # -> Box, Box_2
debrep = DeconstructBrep(Brep=bbox_2.Box)  # -> Faces, Edges, Vertices
join = JoinCurves(Curves=debrep.Edges, Preserve=False)
number_slider_27 = Slider(0.9, range=0..1)
subtraction_3 = Subtraction(A=Slider(1, range=0..1), B=number_slider_27)
lng_6 = ListLength(List=flatten(bang_2.Branch3))
dom_7 = ConstructDomain(DomainStart=subtraction_3, DomainEnd=number_slider_27)
lng_7 = ListLength(List=flatten(bang_2.Branch3))
dom_8 = ConstructDomain(DomainStart=0, DomainEnd=1)
genemodifier_5 = GenePoolModifier(GeneList="XF", Count=lng_6, Domain=dom_7, Randomize=Button(), PercentageOfRandomization=Slider(1, range=0..1))
yf = GenePool(Decimals=2, Maximum=0.9, Minimum=0.1, Value=[0.11, 0.84, 0.77, 0.4, 0.81, 0.69])
xf = GenePool(Decimals=2, Maximum=0.9, Minimum=0.1, Value=[0.11, 0.46, 0.21, 0.33, 0.19, 0.79])
genemodifier_6 = GenePoolModifier(GeneList="YF", Count=lng_7, Domain=dom_7, Randomize=Button(), PercentageOfRandomization=Slider(1, range=0..1))
pt_3 = ConstructPoint(XCoordinate=xf, YCoordinate=yf, ZCoordinate=0)
evalsrf_2 = EvaluateSurface(Surface=reparameterize(item_3.Item1), Point=pt_3)  # -> Point, Normal, UDirection, VDirection, Frame
srf_cp_2 = SurfaceClosestPoint(Point=evalsrf_2.Point, Surface=item_3.Item1)  # -> Point, UVPoint, Distance
number_slider_28 = Slider(0.001, range=0..0.001)
dom_9 = ConstructDomain(DomainStart=Slider(0, range=0..100), DomainEnd=Slider(255, range=0..1000))
number_slider_29 = Slider(241, range=0..255)

# ---- group: SpacePartition / OriginalSilhouette
crv_6 = Curve(join)

# ---- group: SpacePartition (continued)
bbox_3 = BoundingBox(Content=crv_6, Plane=PlaneXY(0, 0, 0))  # -> Box, Box_2
ptsrfdomnum_2 = SurfaceDomainNumber(Surface=bbox_3.Box, UNumber=Slider(2, range=0..100), VNumber=Slider(15, range=0..100))
ptborders_2 = GenerateBorders(Grid=ptsrfdomnum_2, PanelShape=0)  # -> simplify(Border)
crv_7 = Curve(flatten(ptborders_2))
item_4 = ListItem(List=crv_7, Index=0, Wrap=True)
area_4 = Area(Geometry=item_4)  # -> Area, Centroid
voronoi_2 = Voronoi(Points=srf_cp_2.Point, Boundary=crv_6, BruteForceOverride=False)
multiplication_4 = Multiplication(A=area_4.Area, B=Slider(0.6, range=0..1))
crv_8 = Curve(voronoi_2)
multiplication_5 = Multiplication(A=multiplication_4, B=Slider(1.8, range=0..10))
spacepartition_2 = SpacePartition(VoronoiIn=crv_8, GridIn=crv_7, AreaIn=multiplication_4, Distance=multiplication_5)
sortxy_3 = SortPointsXY(Grid=flatten(spacepartition_2))
pararunion_3 = ParallelRegionUnion(Curves=spacepartition_2)
missing_2 = MissingGridCells(CulledGrid=flatten(sortxy_3), OriginalGrid=crv_7)
mgtree_2 = MergeTreeMissing(CulledGrid=pararunion_3, MissingGridCells=missing_2)
pararunion_4 = ParallelRegionUnion(Curves=mgtree_2)
parallelregionintersection_2 = ParallelRegionIntersection(CurvesA=item_3.Item1, CurvesB=pararunion_4)
lng_8 = ListLength(List=flatten(parallelregionintersection_2))
random_2 = Random(Range=dom_9, Number=lng_8, Seed=[number_slider_8, number_slider_9, number_slider_10], Integers=True)
bang_5 = ExplodeTree(Data=random_2)  # -> Branch0, Branch1, Branch2
srf_4 = Surface(parallelregionintersection_2)
rgb_3 = ColourRGB(Alpha=Slider(10, range=0..10), Red=bang_5.Branch0, Green=bang_5.Branch1, Blue=bang_5.Branch2)
rgb_4 = ColourRGB(
    Alpha=number_slider_29,
    Red=bang_5.Branch0,
    Green=[55, 209, 59, 216, 1, 112, 142, 1, 76, 111, 92, 58, 62, 60, 197, 158, 67, 19, 183, 163, 50, 202, 112, 182, 111],
    Blue=[9, 120, 163, 36, 100, 115, 248, 253, 79, 124, 119, 250, 189, 19, 44, 159, 229, 29, 128, 139, 34, 211, 22, 234, 166])
rgb_5 = ColourRGB(Alpha=number_slider_29, Red=expr("x*2", bang_5.Branch1), Green=expr("x*0.5", bang_5.Branch1), Blue=0)
preview_2 = CustomPreview(Geometry=srf_4, Material=graft(rgb_5))
preview_3 = CustomPreview(Geometry=graft(crv_8), Material=graft(rgb_3))

# ----
toggle_7 = GroupToggle(ToggleActive=True, ToggleVisible=False)  # disabled
item_5 = ListItem(List=bang.Branch3, Index=0, Wrap=True)  # -> Item, Item1, Item2, Item3, Item4, Item5
item_6 = ListItem(List=bang_2.Branch3, Index=0, Wrap=True)  # -> Item, Item1, Item2, Item3, Item4, Item5
merge_2 = Merge(Data1=item_5.Item2, Data2=item_5.Item, Data3=item_5.Item1, Data4=item_5.Item4, Data5=item_5.Item5, Data6=item_5.Item3)
merge_3 = Merge(Data1=item_6.Item2, Data2=item_6.Item, Data3=item_6.Item1, Data4=item_6.Item4, Data5=item_6.Item5, Data6=item_6.Item3)
sortxy_4 = SortPointsXY(Grid=flatten(parallelregionintersection_2))
area_5 = Area(Geometry=sortxy_4, UseTasks=False)  # -> Area, Centroid
ma_6 = MassAddition(Input=area_5.Area)  # -> Result, PartialResults
ma_7 = MassAddition(Input=merge_3)  # -> Result, PartialResults
division_4 = Division(A=ma_7.Result, B=ma_6.Result)
multiplication_6 = Multiplication(A=area_5.Area, B=division_4)
galapagos_2 = Galapagos(fitness=fitness_2, gene=[xf, yf])
fitness_2 = CSharpScript(ExpectedAreas=merge_3, ActualAreas=multiplication_6)  # -> Fitness; inputs ExpectedAreas: list, ActualAreas: list; same code as fitness
panel_3 = Panel(fitness_2)

# ---- group: SpaceSyntaxis
toggle_8 = GroupToggle(ToggleActive=True, ToggleVisible=False)  # disabled
spctopo_2 = SpaceTopology(Curves=flatten(sortxy_4), ParallelComputing=Toggle(False))
ma_8 = MassAddition(Input=merge_3)  # -> Result, PartialResults
linetopo_2 = LineTopology(PointTree=graft(area_5.Centroid), Topology=spctopo_2)
relay_2 = Relay()

# ----
toggle_9 = GroupToggle(ToggleActive=True, ToggleVisible=False)  # disabled
division_5 = Division(A=multiplication_6, B=merge_3)
c_script_2 = CSharpScript(x=division_5)  # -> out, A; inputs x: list; same code as c_script
ma_9 = MassAddition(Input=c_script_2.A)  # -> Result, PartialResults
lng_9 = ListLength(List=division_5)
errorpercentage_2 = Panel(c_script_2.A)
division_6 = Division(A=ma_9.Result, B=lng_9)
addindextolabels_3 = CSharpScript(labels=merge_2, areas=multiplication_6)  # -> indexedLabels; inputs labels: list, areas: list; same code as addindextolabels_2
results_2 = Panel(multiplication_6)
errorpercentagemean_2 = Panel(division_6)
expectedresults_2 = Panel(merge_3)
results_3 = Panel(merge_2)
screentext_2 = ScreenOrientedText(
    Text=addindextolabels_3,
    Font="Interstate",
    Justification=8,
    Location=area_5.Centroid,
    SizeFactor=Slider(6.961, range=0..100),
    Color=RGB(255, 255, 255),
    Depth=0,
    Absolute=False)

tag_4 = TextTag(Location=area_5.Centroid, Text=addindextolabels_3)
tag_5 = TextTag3D(Location=area_5.Centroid, Text=addindextolabels_3, Size=Slider(0.1, range=0..0.1), Justification=5)

# ---- group: SpacePartition
toggle_10 = GroupToggle(ToggleActive=True, ToggleVisible=False)  # disabled
bbox_4 = BoundingBox(Content=item_3.Item2, Plane=PlaneXY(0, 0, 0))  # -> Box, Box_2
debrep_2 = DeconstructBrep(Brep=bbox_4.Box)  # -> Faces, Edges, Vertices
join_2 = JoinCurves(Curves=debrep_2.Edges, Preserve=False)
number_slider_30 = Slider(0.9, range=0..1)
subtraction_4 = Subtraction(A=Slider(1, range=0..1), B=number_slider_30)
lng_10 = ListLength(List=flatten(bang_2.Branch1))
dom_10 = ConstructDomain(DomainStart=subtraction_4, DomainEnd=number_slider_30)
lng_11 = ListLength(List=flatten(bang_2.Branch1))
dom_11 = ConstructDomain(DomainStart=0, DomainEnd=1)
genemodifier_7 = GenePoolModifier(GeneList="XT", Count=lng_10, Domain=dom_10, Randomize=Button(), PercentageOfRandomization=Slider(1, range=0..1))
yt = GenePool(Decimals=2, Maximum=0.9, Minimum=0.1, Value=[0.77, 0.58])
xt = GenePool(Decimals=2, Maximum=0.9, Minimum=0.1, Value=[0.12, 0.1])
genemodifier_8 = GenePoolModifier(GeneList="YT", Count=lng_11, Domain=dom_10, Randomize=Button(), PercentageOfRandomization=Slider(1, range=0..1))
pt_4 = ConstructPoint(XCoordinate=xt, YCoordinate=yt, ZCoordinate=0)
evalsrf_3 = EvaluateSurface(Surface=reparameterize(item_3.Item2), Point=pt_4)  # -> Point, Normal, UDirection, VDirection, Frame
srf_cp_3 = SurfaceClosestPoint(Point=evalsrf_3.Point, Surface=item_3.Item2)  # -> Point, UVPoint, Distance
number_slider_31 = Slider(0.001, range=0..0.001)
dom_12 = ConstructDomain(DomainStart=Slider(0, range=0..100), DomainEnd=Slider(255, range=0..1000))
number_slider_32 = Slider(241, range=0..255)

# ---- group: SpacePartition / OriginalSilhouette
crv_9 = Curve(join_2)

# ---- group: SpacePartition (continued)
bbox_5 = BoundingBox(Content=crv_9, Plane=PlaneXY(0, 0, 0))  # -> Box, Box_2
ptsrfdomnum_3 = SurfaceDomainNumber(Surface=bbox_5.Box, UNumber=Slider(1, range=0..100), VNumber=Slider(30, range=0..100))
ptborders_3 = GenerateBorders(Grid=ptsrfdomnum_3, PanelShape=0)  # -> simplify(Border)
crv_10 = Curve(flatten(ptborders_3))
item_7 = ListItem(List=crv_10, Index=0, Wrap=True)
area_6 = Area(Geometry=item_7)  # -> Area, Centroid
voronoi_3 = Voronoi(Points=srf_cp_3.Point, Boundary=crv_9, BruteForceOverride=False)
multiplication_7 = Multiplication(A=area_6.Area, B=Slider(0.6, range=0..1))
crv_11 = Curve(voronoi_3)
multiplication_8 = Multiplication(A=multiplication_7, B=Slider(1.8, range=0..10))
spacepartition_3 = SpacePartition(VoronoiIn=crv_11, GridIn=crv_10, AreaIn=multiplication_7, Distance=multiplication_8)
sortxy_5 = SortPointsXY(Grid=flatten(spacepartition_3))
pararunion_5 = ParallelRegionUnion(Curves=spacepartition_3)
missing_3 = MissingGridCells(CulledGrid=flatten(sortxy_5), OriginalGrid=crv_10)
mgtree_3 = MergeTreeMissing(CulledGrid=pararunion_5, MissingGridCells=missing_3)
pararunion_6 = ParallelRegionUnion(Curves=mgtree_3)
parallelregionintersection_3 = ParallelRegionIntersection(CurvesA=item_3.Item2, CurvesB=pararunion_6)
lng_12 = ListLength(List=flatten(parallelregionintersection_3))
random_3 = Random(Range=dom_12, Number=lng_12, Seed=[number_slider_14, number_slider_15, number_slider_16], Integers=True)
bang_6 = ExplodeTree(Data=random_3)  # -> Branch0, Branch1, Branch2
srf_5 = Surface(parallelregionintersection_3)
rgb_6 = ColourRGB(Alpha=Slider(10, range=0..10), Red=bang_6.Branch0, Green=bang_6.Branch1, Blue=bang_6.Branch2)
rgb_7 = ColourRGB(
    Alpha=number_slider_32,
    Red=bang_6.Branch0,
    Green=[55, 209, 59, 216, 1, 112, 142, 1, 76, 111, 92, 58, 62, 60, 197, 158, 67, 19, 183, 163, 50, 202, 112, 182, 111],
    Blue=[9, 120, 163, 36, 100, 115, 248, 253, 79, 124, 119, 250, 189, 19, 44, 159, 229, 29, 128, 139, 34, 211, 22, 234, 166])
rgb_8 = ColourRGB(Alpha=number_slider_32, Red=expr("x*2", bang_6.Branch1), Green=expr("x*0.5", bang_6.Branch1), Blue=0)
preview_4 = CustomPreview(Geometry=srf_5, Material=graft(rgb_8))
preview_5 = CustomPreview(Geometry=graft(crv_11), Material=graft(rgb_6))

# ----
toggle_11 = GroupToggle(ToggleActive=True, ToggleVisible=False)  # disabled
item_8 = ListItem(List=bang_2.Branch1, Index=0, Wrap=True)  # -> Item, Item1
item_9 = ListItem(List=bang.Branch1, Index=0, Wrap=True)  # -> Item, Item1
merge_4 = Merge(Data1=item_8.Item1, Data2=item_8.Item)
merge_5 = Merge(Data1=item_9.Item1, Data2=item_9.Item)
sortxy_6 = SortPointsXY(Grid=flatten(parallelregionintersection_3))
area_7 = Area(Geometry=sortxy_6, UseTasks=False)  # -> Area, Centroid
ma_10 = MassAddition(Input=area_7.Area)  # -> Result, PartialResults
ma_11 = MassAddition(Input=merge_4)  # -> Result, PartialResults
division_7 = Division(A=ma_11.Result, B=ma_10.Result)
multiplication_9 = Multiplication(A=area_7.Area, B=division_7)
fitness_3 = CSharpScript(ExpectedAreas=merge_4, ActualAreas=multiplication_9)  # -> Fitness; inputs ExpectedAreas: list, ActualAreas: list; same code as fitness
galapagos_3 = Galapagos(fitness=fitness_3, gene=[xt, yt])
panel_4 = Panel(fitness_3)

toggle_12 = GroupToggle(ToggleActive=True, ToggleVisible=False)  # disabled
division_8 = Division(A=multiplication_9, B=merge_4)
c_script_3 = CSharpScript(x=division_8)  # -> out, A; inputs x: list; same code as c_script
ma_12 = MassAddition(Input=c_script_3.A)  # -> Result, PartialResults
lng_13 = ListLength(List=division_8)
errorpercentage_3 = Panel(c_script_3.A)
division_9 = Division(A=ma_12.Result, B=lng_13)
addindextolabels_4 = CSharpScript(labels=merge_5, areas=multiplication_9)  # -> indexedLabels; inputs labels: list, areas: list; same code as addindextolabels_2
results_4 = Panel(multiplication_9)
errorpercentagemean_3 = Panel(division_9)
expectedresults_3 = Panel(merge_4)
results_5 = Panel(merge_5)
screentext_3 = ScreenOrientedText(
    Text=addindextolabels_4,
    Font="Interstate",
    Justification=8,
    Location=area_7.Centroid,
    SizeFactor=Slider(6.961, range=0..100),
    Color=RGB(255, 255, 255),
    Depth=0,
    Absolute=False)

# ---- group: SpaceSyntaxis
toggle_13 = GroupToggle(ToggleActive=True, ToggleVisible=False)  # disabled
spctopo_3 = SpaceTopology(Curves=flatten(sortxy_6), ParallelComputing=Toggle(False))
linetopo_3 = LineTopology(PointTree=graft(area_7.Centroid), Topology=spctopo_3)
ma_13 = MassAddition(Input=merge_4)  # -> Result, PartialResults

# ----
tag_6 = TextTag(Location=area_7.Centroid, Text=addindextolabels_4)
tag_7 = TextTag3D(Location=area_7.Centroid, Text=addindextolabels_4, Size=number_slider_21, Justification=5)

# ---- group: SpacePartition
toggle_14 = GroupToggle(ToggleActive=True, ToggleVisible=False)  # disabled
bbox_6 = BoundingBox(Content=item_3.Item3, Plane=PlaneXY(0, 0, 0))  # -> Box, Box_2
debrep_3 = DeconstructBrep(Brep=bbox_6.Box)  # -> Faces, Edges, Vertices
join_3 = JoinCurves(Curves=debrep_3.Edges, Preserve=False)
number_slider_33 = Slider(0.9, range=0..1)
subtraction_5 = Subtraction(A=Slider(1, range=0..1), B=number_slider_33)
lng_14 = ListLength(List=flatten(bang_2.Branch0))
dom_13 = ConstructDomain(DomainStart=subtraction_5, DomainEnd=number_slider_33)
lng_15 = ListLength(List=flatten(bang_2.Branch0))
dom_14 = ConstructDomain(DomainStart=0, DomainEnd=1)
genemodifier_9 = GenePoolModifier(GeneList="XO", Count=lng_14, Domain=dom_13, Randomize=Button(), PercentageOfRandomization=Slider(1, range=0..1))
yo = GenePool(Decimals=2, Maximum=0.9, Minimum=0.1, Value=[0.1, 0.74, 0.81, 0.56, 0.37, 0.9, 0.49, 0.1, 0.53, 0.1])
xo = GenePool(Decimals=2, Maximum=0.9, Minimum=0.1, Value=[0.6, 0.1, 0.51, 0.34, 0.7, 0.1, 0.52, 0.9, 0.84, 0.1])
genemodifier_10 = GenePoolModifier(GeneList="YO", Count=lng_15, Domain=dom_13, Randomize=Button(), PercentageOfRandomization=Slider(1, range=0..1))
pt_5 = ConstructPoint(XCoordinate=xo, YCoordinate=yo, ZCoordinate=0)
evalsrf_4 = EvaluateSurface(Surface=reparameterize(item_3.Item3), Point=pt_5)  # -> Point, Normal, UDirection, VDirection, Frame
srf_cp_4 = SurfaceClosestPoint(Point=evalsrf_4.Point, Surface=item_3.Item3)  # -> Point, UVPoint, Distance
dom_15 = ConstructDomain(DomainStart=Slider(0, range=0..100), DomainEnd=Slider(255, range=0..1000))
number_slider_34 = Slider(241, range=0..255)

# ---- group: SpacePartition / OriginalSilhouette
crv_12 = Curve(join_3)

# ---- group: SpacePartition (continued)
bbox_7 = BoundingBox(Content=crv_12, Plane=PlaneXY(0, 0, 0))  # -> Box, Box_2
ptsrfdomnum_4 = SurfaceDomainNumber(Surface=bbox_7.Box, UNumber=Slider(3, range=0..100), VNumber=Slider(15, range=0..100))
ptborders_4 = GenerateBorders(Grid=ptsrfdomnum_4, PanelShape=0)  # -> simplify(Border)
crv_13 = Curve(flatten(ptborders_4))
item_10 = ListItem(List=crv_13, Index=0, Wrap=True)
area_8 = Area(Geometry=item_10)  # -> Area, Centroid
voronoi_4 = Voronoi(Points=srf_cp_4.Point, Boundary=crv_12, BruteForceOverride=False)
multiplication_10 = Multiplication(A=area_8.Area, B=Slider(0.6, range=0..1))
crv_14 = Curve(voronoi_4)
multiplication_11 = Multiplication(A=multiplication_10, B=Slider(1.5, range=0..10))
spacepartition_4 = SpacePartition(VoronoiIn=crv_14, GridIn=crv_13, AreaIn=multiplication_10, Distance=multiplication_11)
sortxy_7 = SortPointsXY(Grid=flatten(spacepartition_4))
pararunion_7 = ParallelRegionUnion(Curves=spacepartition_4)
missing_4 = MissingGridCells(CulledGrid=flatten(sortxy_7), OriginalGrid=crv_13)
mgtree_4 = MergeTreeMissing(CulledGrid=pararunion_7, MissingGridCells=missing_4)
pararunion_8 = ParallelRegionUnion(Curves=mgtree_4)
parallelregionintersection_4 = ParallelRegionIntersection(CurvesA=item_3.Item3, CurvesB=pararunion_8)
lng_16 = ListLength(List=flatten(parallelregionintersection_4))
random_4 = Random(Range=dom_15, Number=lng_16, Seed=[number_slider_11, number_slider_12, number_slider_13], Integers=True)
bang_7 = ExplodeTree(Data=random_4)  # -> Branch0, Branch1, Branch2
srf_6 = Surface(parallelregionintersection_4)
rgb_9 = ColourRGB(Alpha=Slider(10, range=0..10), Red=bang_7.Branch0, Green=bang_7.Branch1, Blue=bang_7.Branch2)
rgb_10 = ColourRGB(
    Alpha=number_slider_34,
    Red=bang_7.Branch0,
    Green=[55, 209, 59, 216, 1, 112, 142, 1, 76, 111, 92, 58, 62, 60, 197, 158, 67, 19, 183, 163, 50, 202, 112, 182, 111],
    Blue=[9, 120, 163, 36, 100, 115, 248, 253, 79, 124, 119, 250, 189, 19, 44, 159, 229, 29, 128, 139, 34, 211, 22, 234, 166])
rgb_11 = ColourRGB(Alpha=number_slider_34, Red=expr("x*2", bang_7.Branch1), Green=expr("x*0.5", bang_7.Branch1), Blue=0)
preview_6 = CustomPreview(Geometry=srf_6, Material=graft(rgb_11))
preview_7 = CustomPreview(Geometry=graft(crv_14), Material=graft(rgb_9))

# ----
toggle_15 = GroupToggle(ToggleActive=True, ToggleVisible=False)  # disabled
item_11 = ListItem(List=bang.Branch0, Index=0, Wrap=True)  # -> Item, Item1, Item2, Item3, Item4, Item5, Item6, Item7, Item8, Item9
item_12 = ListItem(List=bang_2.Branch0, Index=0, Wrap=True)  # -> Item, Item1, Item2, Item3, Item4, Item5, Item6, Item7, Item8, Item9
merge_6 = Merge(
    Data1=item_11.Item9,
    Data2=item_11.Item7,
    Data3=item_11.Item8,
    Data4=item_11.Item,
    Data5=item_11.Item1,
    Data6=item_11.Item2,
    Data7=item_11.Item4,
    Data8=item_11.Item3,
    Data9=item_11.Item6,
    Data10=item_11.Item5)
merge_7 = Merge(
    Data1=item_12.Item9,
    Data2=item_12.Item7,
    Data3=item_12.Item8,
    Data4=item_12.Item,
    Data5=item_12.Item1,
    Data6=item_12.Item2,
    Data7=item_12.Item4,
    Data8=item_12.Item3,
    Data9=item_12.Item6,
    Data10=item_12.Item5)
sortxy_8 = SortPointsXY(Grid=flatten(parallelregionintersection_4))
area_9 = Area(Geometry=sortxy_8, UseTasks=False)  # -> Area, Centroid
ma_14 = MassAddition(Input=area_9.Area)  # -> Result, PartialResults
ma_15 = MassAddition(Input=merge_7)  # -> Result, PartialResults
division_10 = Division(A=ma_15.Result, B=ma_14.Result)
multiplication_12 = Multiplication(A=area_9.Area, B=division_10)
fitness_4 = CSharpScript(ExpectedAreas=merge_7, ActualAreas=multiplication_12)  # -> Fitness; inputs ExpectedAreas: list, ActualAreas: list; same code as fitness
panel_5 = Panel(fitness_4)
galapagos_4 = Galapagos(fitness=fitness_4, gene=[xo, yo])

toggle_16 = GroupToggle(ToggleActive=True, ToggleVisible=False)  # disabled
division_11 = Division(A=multiplication_12, B=merge_7)
c_script_4 = CSharpScript(x=division_11)  # -> out, A; inputs x: list; same code as c_script
ma_16 = MassAddition(Input=c_script_4.A)  # -> Result, PartialResults
lng_17 = ListLength(List=division_11)
errorpercentage_4 = Panel(c_script_4.A)
division_12 = Division(A=ma_16.Result, B=lng_17)
addindextolabels_5 = CSharpScript(labels=merge_6, areas=multiplication_12)  # -> indexedLabels; inputs labels: list, areas: list; same code as addindextolabels_2
results_6 = Panel(multiplication_12)
errorpercentagemean_4 = Panel(division_12)
expectedresults_4 = Panel(merge_7)
results_7 = Panel(merge_6)
screentext_4 = ScreenOrientedText(
    Text=addindextolabels_5,
    Font="Interstate",
    Justification=8,
    Location=area_9.Centroid,
    SizeFactor=Slider(6.961, range=0..100),
    Color=RGB(255, 255, 255),
    Depth=0,
    Absolute=False)

# ---- group: SpaceSyntaxis
toggle_17 = GroupToggle(ToggleActive=True, ToggleVisible=False)  # disabled
spctopo_4 = SpaceTopology(Curves=flatten(sortxy_8), ParallelComputing=Toggle(False))
linetopo_4 = LineTopology(PointTree=graft(area_9.Centroid), Topology=spctopo_4)
ma_17 = MassAddition(Input=multiplication_12)  # -> Result, PartialResults

# ---- group: WIP
crv_15 = Curve(bang_4.Branch3)
crv_16 = Curve(bang_4.Branch2)
crv_17 = Curve(bang_4.Branch1)
crv_18 = Curve(bang_4.Branch0)
c_script_5 = CSharpScript(BranchOne=spctopo_4, BranchTwo=spctopo_3)  # -> Out, A

# ----
tag_8 = TextTag3D(Location=area_9.Centroid, Text=addindextolabels_5, Size=number_slider_21, Justification=5)
tag_9 = TextTag(Location=area_9.Centroid, Text=addindextolabels_5)

# ---- group: SpacePartition
toggle_18 = GroupToggle(ToggleActive=True, ToggleVisible=False)  # disabled
bbox_8 = BoundingBox(Content=item_3.Item, Plane=PlaneXY(0, 0, 0))  # -> Box, Box_2
debrep_4 = DeconstructBrep(Brep=bbox_8.Box)  # -> Faces, Edges, Vertices
join_4 = JoinCurves(Curves=debrep_4.Edges, Preserve=False)
number_slider_35 = Slider(0.9, range=0..1)
subtraction_6 = Subtraction(A=Slider(1, range=0..1), B=number_slider_35)
lng_18 = ListLength(List=flatten(bang_2.Branch2))
dom_16 = ConstructDomain(DomainStart=subtraction_6, DomainEnd=number_slider_35)
lng_19 = ListLength(List=flatten(bang_2.Branch2))
dom_17 = ConstructDomain(DomainStart=0, DomainEnd=1)
genemodifier_11 = GenePoolModifier(GeneList="XTh", Count=lng_18, Domain=dom_16, Randomize=Button(), PercentageOfRandomization=Slider(1, range=0..1))
yth = GenePool(Decimals=2, Maximum=0.9, Minimum=0.1, Value=[0.58, 0.46, 0.29, 0.74, 0.3, 0.82, 0.25])
xth = GenePool(Decimals=2, Maximum=0.9, Minimum=0.1, Value=[0.63, 0.28, 0.9, 0.19, 0.62, 0.42, 0.11])
genemodifier_12 = GenePoolModifier(GeneList="YTh", Count=lng_19, Domain=dom_16, Randomize=Button(), PercentageOfRandomization=Slider(1, range=0..1))
pt_6 = ConstructPoint(XCoordinate=xth, YCoordinate=yth, ZCoordinate=0)
evalsrf_5 = EvaluateSurface(Surface=reparameterize(item_3.Item), Point=pt_6)  # -> Point, Normal, UDirection, VDirection, Frame
srf_cp_5 = SurfaceClosestPoint(Point=evalsrf_5.Point, Surface=item_3.Item)  # -> Point, UVPoint, Distance
number_slider_36 = Slider(0.001, range=0..0.001)
dom_18 = ConstructDomain(DomainStart=Slider(0, range=0..100), DomainEnd=Slider(255, range=0..1000))
number_slider_37 = Slider(241, range=0..255)

# ---- group: SpacePartition / OriginalSilhouette
crv_19 = Curve(join_4)

# ---- group: SpacePartition (continued)
bbox_9 = BoundingBox(Content=crv_19, Plane=PlaneXY(0, 0, 0))  # -> Box, Box_2
ptsrfdomnum_5 = SurfaceDomainNumber(Surface=bbox_9.Box, UNumber=Slider(3, range=0..100), VNumber=Slider(5, range=0..100))
ptborders_5 = GenerateBorders(Grid=ptsrfdomnum_5, PanelShape=0)  # -> simplify(Border)
crv_20 = Curve(flatten(ptborders_5))
item_13 = ListItem(List=crv_20, Index=0, Wrap=True)
area_10 = Area(Geometry=item_13)  # -> Area, Centroid
voronoi_5 = Voronoi(Points=srf_cp_5.Point, Boundary=crv_19, BruteForceOverride=False)
multiplication_13 = Multiplication(A=area_10.Area, B=Slider(0.6, range=0..1))
crv_21 = Curve(voronoi_5)
multiplication_14 = Multiplication(A=multiplication_13, B=Slider(1.8, range=0..10))
spacepartition_5 = SpacePartition(VoronoiIn=crv_21, GridIn=crv_20, AreaIn=multiplication_13, Distance=multiplication_14)
sortxy_9 = SortPointsXY(Grid=flatten(spacepartition_5))
pararunion_9 = ParallelRegionUnion(Curves=spacepartition_5)
missing_5 = MissingGridCells(CulledGrid=flatten(sortxy_9), OriginalGrid=crv_20)
mgtree_5 = MergeTreeMissing(CulledGrid=pararunion_9, MissingGridCells=missing_5)
pararunion_10 = ParallelRegionUnion(Curves=mgtree_5)
parallelregionintersection_5 = ParallelRegionIntersection(CurvesA=item_3.Item, CurvesB=pararunion_10)
lng_20 = ListLength(List=flatten(parallelregionintersection_5))
random_5 = Random(Range=dom_18, Number=lng_20, Seed=[number_slider_18, number_slider_17, number_slider_19], Integers=True)
bang_8 = ExplodeTree(Data=random_5)  # -> Branch0, Branch1, Branch2
srf_7 = Surface(parallelregionintersection_5)
rgb_12 = ColourRGB(Alpha=Slider(10, range=0..10), Red=bang_8.Branch0, Green=bang_8.Branch1, Blue=bang_8.Branch2)
rgb_13 = ColourRGB(
    Alpha=number_slider_37,
    Red=bang_8.Branch0,
    Green=[55, 209, 59, 216, 1, 112, 142, 1, 76, 111, 92, 58, 62, 60, 197, 158, 67, 19, 183, 163, 50, 202, 112, 182, 111],
    Blue=[9, 120, 163, 36, 100, 115, 248, 253, 79, 124, 119, 250, 189, 19, 44, 159, 229, 29, 128, 139, 34, 211, 22, 234, 166])
rgb_14 = ColourRGB(Alpha=number_slider_37, Red=expr("x*2", bang_8.Branch1), Green=expr("x*0.5", bang_8.Branch1), Blue=0)
preview_8 = CustomPreview(Geometry=srf_7, Material=graft(rgb_14))
preview_9 = CustomPreview(Geometry=graft(crv_21), Material=graft(rgb_12))

# ----
toggle_19 = GroupToggle(ToggleActive=True, ToggleVisible=False)  # disabled
item_14 = ListItem(List=bang.Branch2, Index=0, Wrap=True)  # -> Item, Item1, Item2, Item3, Item4, Item5, Item6
item_15 = ListItem(List=bang_2.Branch2, Index=0, Wrap=True)  # -> Item, Item1, Item2, Item3, Item4, Item5, Item6
merge_8 = Merge(
    Data1=item_14.Item,
    Data2=item_14.Item1,
    Data3=item_14.Item2,
    Data4=item_14.Item4,
    Data5=item_14.Item5,
    Data6=item_14.Item6,
    Data7=item_14.Item3)
merge_9 = Merge(
    Data1=item_15.Item,
    Data2=item_15.Item1,
    Data3=item_15.Item2,
    Data4=item_15.Item4,
    Data5=item_15.Item5,
    Data6=item_15.Item6,
    Data7=item_15.Item3)
sortxy_10 = SortPointsXY(Grid=flatten(parallelregionintersection_5))
area_11 = Area(Geometry=sortxy_10, UseTasks=False)  # -> Area, Centroid
ma_18 = MassAddition(Input=area_11.Area)  # -> Result, PartialResults
ma_19 = MassAddition(Input=merge_9)  # -> Result, PartialResults
division_13 = Division(A=ma_19.Result, B=ma_18.Result)
multiplication_15 = Multiplication(A=area_11.Area, B=division_13)
galapagos_5 = Galapagos(fitness=fitness_5, gene=[xth, yth])
fitness_5 = CSharpScript(ExpectedAreas=merge_9, ActualAreas=multiplication_15)  # -> Fitness; inputs ExpectedAreas: list, ActualAreas: list; same code as fitness
panel_6 = Panel(fitness_5)

# ---- group: SpaceSyntaxis
toggle_20 = GroupToggle(ToggleActive=True, ToggleVisible=False)  # disabled
spctopo_5 = SpaceTopology(Curves=flatten(sortxy_10), ParallelComputing=Toggle(False))
linetopo_5 = LineTopology(PointTree=graft(area_11.Centroid), Topology=spctopo_5)
ma_20 = MassAddition(Input=multiplication_15)  # -> Result, PartialResults

# ----
toggle_21 = GroupToggle(ToggleActive=True, ToggleVisible=False)  # disabled
division_14 = Division(A=multiplication_15, B=merge_9)
c_script_6 = CSharpScript(x=division_14)  # -> out, A; inputs x: list; same code as c_script
ma_21 = MassAddition(Input=c_script_6.A)  # -> Result, PartialResults
lng_21 = ListLength(List=division_14)
errorpercentage_5 = Panel(c_script_6.A)
division_15 = Division(A=ma_21.Result, B=lng_21)
addindextolabels_6 = CSharpScript(labels=merge_8, areas=multiplication_15)  # -> indexedLabels; inputs labels: list, areas: list; same code as addindextolabels_2
results_8 = Panel(multiplication_15)
errorpercentagemean_5 = Panel(division_15)
expectedresults_5 = Panel(merge_9)
results_9 = Panel(merge_8)
screentext_5 = ScreenOrientedText(
    Text=addindextolabels_6,
    Font="Interstate",
    Justification=8,
    Location=area_11.Centroid,
    SizeFactor=Slider(6.961, range=0..100),
    Color=RGB(255, 255, 255),
    Depth=0,
    Absolute=False)

tag_10 = TextTag3D(Location=area_11.Centroid, Text=addindextolabels_6, Size=number_slider_21, Justification=4)
crv_22 = Curve(flatten([parallelregionintersection_5, parallelregionintersection_3, parallelregionintersection_4, parallelregionintersection, parallelregionintersection_2]))
area_12 = Area(Geometry=crv_22, UseTasks=False)  # -> Area, Centroid
merge_10 = Merge(Data1=flatten(merge_8), Data2=flatten(merge_6), Data3=flatten(merge_5), Data4=flatten(merge_2))
merge_11 = Merge(Data1=sortxy_10, Data2=sortxy_8, Data3=sortxy_6, Data4=sortxy_4)
disc = Discontinuity(Curve=merge_11, Level=3)  # -> Points, Parameters
merge_12 = Merge(
    Data1=flatten(multiplication_15),
    Data2=flatten(multiplication_12),
    Data3=flatten(multiplication_9),
    Data4=flatten(multiplication_6))
srfsplit = SurfaceSplit(Surface=srf_2, Curves=flatten(merge_11))
shatter = Shatter(Curve=graft(merge_11), Parameters=disc.Parameters)  # -> flatten(Segments)
area_13 = Area(Geometry=merge_11, UseTasks=False)  # -> Area, Centroid
join_5 = JoinCurves(Curves=shatter, Preserve=False)
disc_2 = Discontinuity(Curve=join_5, Level=1)  # -> Points, Parameters

# ---- group: SpaceSyntaxis
toggle_22 = GroupToggle(ToggleActive=True, ToggleVisible=False)  # disabled
spctopo_6 = SpaceTopology(Curves=flatten(merge_11), ParallelComputing=Toggle(False))
ma_22 = MassAddition(Input=merge_12)  # -> Result, PartialResults
linetopo_6 = LineTopology(PointTree=graft(area_13.Centroid), Topology=spctopo_6)
relay_3 = Relay()

# ----
shatter_2 = Shatter(Curve=graft(join_5), Parameters=disc_2.Parameters)  # -> flatten(Segments)
bycurve = AddWallByCurve(Curve=shatter_2, Height=Slider(3.2, range=0..10))

# ---- group: Spine (continued)
dom² = Domain²(DomainU=x_bounds, DomainV=y_bounds)
c_script_7 = CSharpScript(seg=crv_5, bnd=dom², sbdv=grid_divisions)  # -> out, flatten(e), flatten(eOV), flatten(ePE), flatten(eNE), flatten(eTE), flatten(eIF), flatten(v)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; inputs seg: list of Curve, sbdv: Int32
# ---------- c_script_7: C# ----------
    List<Line> edgeList = new List<Line>();
    DataTree<int> eOVList = new DataTree<int>();
    DataTree<int> ePEList = new DataTree<int>();
    DataTree<int> eNEList = new DataTree<int>();
    List<int> eTEList = new List<int>();
    List<int> eIFList = new List<int>();
    List<Point3d> vtxList = new List<Point3d>();
    List<int> vIEList = new List<int>();
    DataTree<Point3d> fList = new DataTree<Point3d>();
    DataTree<int> fIEList = new DataTree<int>();
    DataTree<int> vIEall = new DataTree<int>();
    List<bool> eF = new List<bool>();
    List<double> eDegList = new List<double>();
    int segCt = 0;
    for( int i = 0; i <= seg.Count - 1; ++i )
    {

      if( seg[i].PointAtStart.DistanceTo(seg[i].PointAtEnd) > 0 )
      {
        edgeList.Add(new Line(seg[i].PointAtStart, seg[i].PointAtEnd));
        edgeList.Add(new Line(seg[i].PointAtEnd, seg[i].PointAtStart));
        eTEList.Add(((segCt * 2)
          + 1));
        eTEList.Add((segCt * 2));
        // DEFAULT SETTING FOR ef IS TRUE (ie EDGE NEEDS TO BE ASSIGNED TO A FACE)
        eF.Add(true);
        eF.Add(true);
        eIFList.Add(-10);
        eIFList.Add(-10);
        EdgeDirection(edgeList[edgeList.Count - 2], eDegList);
        //EdgeDirection(edgeList((edgeList.Count - 2)), eDegList);
        segCt++;

      }

    }

    DataTree<Point3d> vtxTree = new DataTree<Point3d>();
    DataTree<int> vNdxTree = new DataTree<int>();
    for( int i = 0; i <= sbdv - 1; i++ )
    {
      for( int j = 0; j <= sbdv - 1; j++ )
      {

        vtxTree.EnsurePath(new GH_Path(i, j));
        vNdxTree.EnsurePath(new GH_Path(i, j));

      }

    }

    // ********CONSTRUCT VERTEX List FROM List OF HALF-EDGES********
    for( int i = 0; i <= edgeList.Count - 1; i++ )
    {
      // boolCk = (is there a close point?, what is the index)
      int[] boolCk = {0,-10};
      int vCt = vtxTree.DataCount;
      CheckLinePt(edgeList[i], ref vtxTree, ref vNdxTree, ref boolCk, bnd, sbdv, 0);
      // IF A NEW VERTEX WAS AddED, THEN Add EDGE INDEX TO vIE, vIEall, AND eOV
      if ((vtxTree.DataCount > vCt)) {
        vIEList.Add(i);
        vIEall.Add(i, new GH_Path(boolCk[1]));
        eOVList.Add(boolCk[1], new GH_Path(i));
      }
      else if ((boolCk[1] >= 0)) {
        vIEall.Add(i, new GH_Path(boolCk[1]));
        eOVList.Add(boolCk[1], new GH_Path(i));
      }

    }

    // ********FROM EACH HALF-EDGE..
    for (int i = 0; i <= edgeList.Count - 1; i++) {
      int[] boolCk = {0, -10};
      // FIND VERTEX CORRESPONDING TO ENDPOINT (=boolCk(1))
      CheckLinePt(edgeList[i], ref vtxTree, ref vNdxTree, ref boolCk, bnd, sbdv, 1);
      // boolCk(1)=TARGET VERTEX, CHECK ANGLE OF ALL EDGES LEAVING THIS VERTEX
      GH_Path nxtVtxPth = new GH_Path(boolCk[1]);
      double angCk = -100;
      int ndx = -10;
      // Dim xProd As vector3d = vector3d.CrossProduct(edgeList(i).direction, vector3d.ZAxis)
      // ..FIND NEXT EDGE********
      for( int j = 0; j <= vIEall.Branch(nxtVtxPth).Count - 1; j++)
      {

        if( i != eTEList[vIEall.Branch(nxtVtxPth)[j]] )
        {

          double ang = eDegList[eTEList[i]] - eDegList[vIEall.Branch(nxtVtxPth)[j]];
          if( ang < 0 )
          {

            ang += 360;

          }

          if( ang > angCk )
          {

            angCk = ang;
            ndx = j;

          }

        }

      }

      if ((ndx >= 0)) {
        eNEList.Add(vIEall.Branch(nxtVtxPth)[ndx], new GH_Path(i));
        ePEList.Add(i, new GH_Path(vIEall.Branch(nxtVtxPth)[ndx]));
      }
      else {
        // NO NEXT EDGE FOUND, THEN NEXT EDGE IS TWIN
        angCk = Math.PI;
        ndx = eTEList[i];
        eNEList.Add(eTEList[i], new GH_Path(i));
        ePEList.Add(i, new GH_Path(eTEList[i]));
      }

    }

    int faceCt = 0;
    for (int i = 0; i <= edgeList.Count - 1; ++i )
    {

      if( eF[i] )
      {

        fList.Add(edgeList[i].PointAt(0), new GH_Path(faceCt));
        fIEList.Add(i, new GH_Path(faceCt));
        eIFList[i] = faceCt;
        eF[i] = false;
        loopFace(edgeList, ref eF, eNEList, eNEList.Branch(i)[0], i, ref fIEList, ref fList, ref eIFList, ref faceCt);
        faceCt++;

      }

    }

    // ********CONVERT vtxTree (SORTED IN BRANCHES BY LOCATION IN GRID)TO List (IN ORDER OF INDEX VALUE)********
    /*for( int i = 0; i <= vtxTree.DataCount - 1; i++ )
    {

    vtxList.Add(Point3d.Unset);

    }*/
    /*
    for( int i = 0; i <= vtxTree.DataCount - 1; i++ )
    {

    int sortNdx = vNdxTree.AllData();
    vtxList[sortNdx] = vtxTree.AllData();

    }*/

    vtxList.AddRange(fList.Branch(0));

    e = edgeList;
    eOV = eOVList;
    eNE = eNEList;
    ePE = ePEList;
    eTE = eTEList;
    eIF = eIFList;
    v = vtxList;
    //  vtxTree
    vIE = vIEall;
    f = fList;
    fIE = fIEList;
    // ********PRINT HEM STATS********
    Print((vtxList.Count.ToString() + " vertices"));
    Print((faceCt.ToString() + " faces"));
    Print((edgeList.Count.ToString() + " edges"));
# ---------- c_script_7: C# additional code ----------
  public void EdgeDirection(Line eCurr, List<double> degList)
  {
    // FIND DIRECTION OF EDGE
    double deg;
    if (eCurr.Direction.X == 0)
    {
      deg = 90 * (eCurr.Direction.Y / Math.Abs(eCurr.Direction.Y)) + 360;
      deg = (360 + deg) % 360;
    }
    else
    {
      deg = Math.Atan(eCurr.Direction.Y / eCurr.Direction.X) * 180 / Math.PI;
      if (eCurr.Direction.X < 0)
        deg = 180 + deg;
      if (eCurr.Direction.X > 0)
        deg = (360 + deg) % 360;
    }

    degList.Add(deg);
    degList.Add((deg + 180) % 360);

  }

  public void CheckLinePt(Line eCurr, ref DataTree<Point3d> vTree, ref DataTree<int> nTree, ref int[] ck, UVInterval dom, int div, double t)
  {
    // WHEN t=0: CHECKING START POINT; WHEN t=1: CHECKING END POINT
    var ptCk = new Point3d(eCurr.PointAt(t));

    // POINT VALUE (MINUS DOMAIN STARTING POINT) DIVIDED BY STEP, FLOORED
    int pthX = (int) Math.Floor((ptCk.X - dom.U0) / ((dom.U1 - dom.U0) / div));
    int pthY = (int) Math.Floor((ptCk.Y - dom.V0) / ((dom.V1 - dom.V0) / div));
    pthX = Math.Min(Math.Max(pthX, 0), div - 1);
    pthY = Math.Min(Math.Max(pthY, 0), div - 1);
    var pthXY = new GH_Path(pthX, pthY);
    ck[1] = -10;

    // CHECK ALREADY ADDED NODES
    if (vTree.PathExists(pthXY))
    {
      for (int j = 0; j <= vTree.Branch(pthXY).Count - 1; ++j)
      {
        if (ptCk.DistanceTo(vTree[pthXY, j]) < 0.1)
        {
          ck[0] += 1;
          ck[1] = nTree[pthXY, j];
          break;
        }
      }
    }

    // IF NOT ALREADY ADDED, THEN ADD
    if( ck[0] == 0 && ck[1] < 0 )
    {
      ck[1] = vTree.DataCount;
      nTree.Add(vTree.DataCount, pthXY);
      vTree.Add(ptCk, pthXY);
    }
  }

  public void loopFace(List<Line> eList, ref List<bool> ck, DataTree<int> eNE, int n, int init, ref DataTree<int> fList, ref DataTree<Point3d> f, ref List<int> efList, ref int ct)
  {
    if (n != init)
    {
      f.Add(eList[n].PointAt(0), new GH_Path(ct));
      fList.Add(n, new GH_Path(ct));
      efList[n] = ct;
      ck[n] = false;
      loopFace(eList, ref ck, eNE, eNE[new GH_Path(n), 0], init, ref fList, ref f, ref efList, ref ct);
    }
  }

  /*class SurroundingClass
  {
    public void CheckLinePt(Line eCurr, ref DataTree<Point3d> vTree, ref DataTree<int> nTree, ref Array ck, UVInterval dom, int div, double t)
    {
      // WHEN t=0: CHECKING START POINT; WHEN t=1: CHECKING END POINT
      var ptCk = new Point3d(eCurr.PointAt(t));

      // POINT VALUE (MINUS DOMAIN STARTING POINT) DIVIDED BY STEP, FLOORED
      int pthX = Math.Floor((ptCk.X - dom.u0) / ((dom.U1 - dom.U0) / div));
      int pthY = Math.Floor((ptCk.y - dom.v0) / ((dom.v1 - dom.v0) / div));
      pthX = Math.Min(Math.Max(pthX, 0), div - 1);
      pthY = Math.Min(Math.Max(pthY, 0), div - 1);
      var pthXY = new GH_Path(pthX, pthY);
      ck(1) = -10;

      // CHECK ALREADY ADDED NODES
      if (vTree.pathExists(pthXY))
      {
        for (int j = 0, loopTo = vTree.branch(pthXY).count - 1; j <= loopTo; j++)
        {
          if (ptCk.DistanceTo(vTree[pthXY, j]) < 0.1)
          {
            ck(0) += 1;
            ck(1) = nTree[pthXY, j];
            break;
          }
        }
      }

      // IF NOT ALREADY ADDED, THEN ADD
      if (Conversions.ToBoolean(Operators.ConditionalCompareObjectEqual(ck(0), 0, false)) && Conversions.ToBoolean(ck(1) < 0))
      {
        ck(1) = vTree.datacount;
        nTree.Add(vTree.datacount, pthXY);
        vTree.Add(ptCk, pthXY);
      }
    }


    public void EdgeDirection(ref Line eCurr, ref List<double> degList)
    {
      // FIND DIRECTION OF EDGE
      double deg;
      if (eCurr.direction.x == 0)
      {
        deg = 90 * (eCurr.Direction.Y / Math.abs(eCurr.Direction.Y)) + 360;
        deg = (360 + deg) % 360;
      }
      else
      {
        deg = Math.atan(eCurr.Direction.Y / eCurr.Direction.x) * 180 / Math.PI;
        if (eCurr.Direction.X < 0)
          deg = 180 + deg;
        if (eCurr.Direction.X > 0)
          deg = (360 + deg) % 360;
      }

      degList.Add(deg);
      degList.Add((deg + 180) % 360);
    }


    public void loopFace(List<Line> eList, ref List<bool> ck, DataTree<int> eNE, int n, int init, ref DataTree<int> fList, ref DataTree<Point3d> f, ref List<int> efList, ref int ct)
    {
      if (n != init)
      {
        f.Add(eList[n].pointAt(0), new GH_Path(ct));
        fList.Add(n, new GH_Path(ct));
        efList[n] = ct;
        ck[n] = false;
        loopFace(eList, ref ck, eNE, eNE[new GH_Path(n), 0], init, ref fList, ref f, ref efList, ref ct);
      }
    }
  }*/
# ---------- end c_script_7 ----------

# ---- group: Spine / PREVIEW SUBDIV GRID
divide = DivideDomain²(Domain=dom², UCount=grid_divisions, VCount=grid_divisions)
dom_19 = Domain²Components(Domain=divide)  # -> UComponent, VComponent
rectangle_2 = Rectangle(Plane=PlaneXY(0, 0, 0), XSize=dom_19.UComponent, YSize=dom_19.VComponent, Radius=0)  # -> Rectangle, Length
preview_10 = CustomPreview(Geometry=rectangle_2.Rectangle, Shader=ColourSwatch(SwatchColor=RGB(217, 217, 217)))

# ---- group: Spine / FIND THE BOUNDARY FACE AND EXCLUDE IT
boundary_face = Slider(1, range=0..10)
path = DataPath(boundary_face)
branch = TreeBranch(Tree=c_script_7.f, Path=path, MaintainPaths=True)

# ---- group: Spine / CULL TWINNED EDGES
cull = CullPattern(List=c_script_7.e, CullPattern=[True, False])

# ---- group: Spine / DISPLAY HEM EDGES
Z = UnitZ(Factor=1)
extr = Extrude(Base=cull, Direction=Z)

# ---- group: Spine (continued)
c_script_8 = CSharpScript(
    e=c_script_7.e,
    eOV=c_script_7.eOV,
    ePE=c_script_7.ePE,
    eNE=c_script_7.eNE,
    v=c_script_7.v,
    vIE=c_script_7.vIE,
    f=c_script_7.f,
    fIE=c_script_7.fIE,
    thr=threshold_2,
    stp=threshold_3,
    bnd=boundary_face)  # -> out, A, B, C, D; inputs e: list of Line, eOV: list of Int32, ePE: list of Int32, eNE: list of Int32, v: list of Point3d, vIE: tree of Int32, f: tree of Point3d, fIE: tree of Int32, thr: Int32, stp: Int32, bnd: Int32
# ---------- c_script_8: C# ----------
    // Definition originally written For
    // codeQuotidien.wordpress.org
    // Trevor Patt
    // trpatt@gmail.com

    // Creative Commons:  Attribution/NonCommercial/ShareAlike

    var skelAll = new DataTree<Line>();

    var vActive = new List<Point3d>();
    var bisecActive = new List<Vector3d>();
    var eActive = new List<Line>();

    for( int i = 0; i <= fIE.BranchCount - 1; ++i )
    {

      if (i != bnd)
      {

        bisecActive.Clear();
        vActive.Clear();
        eActive.Clear();
        var intxActive = new List<Interval>();

        int e0 = fIE.Branch(i)[0];
        int eCurr = e0;

        int ct = 0;
        do
        {
          var iCtPth = new GH_Path(i, ct);
          // FIND THE INITIAL BISECTING RAYS
          bisecActive.Add(FindBisect(e[ePE[eCurr]], e[eCurr]));
          vActive.Add(v[eOV[eCurr]]);
          eActive.Add(e[ePE[eCurr]]);
          eCurr = eNE[eCurr];
          ct += 1;
        }
        while (eCurr != e0);


        eCurr = e0;

        // CREATE ALL INTERVALS SO THAT THEY CAN BE EDITED ONE VALUE AT A TIME
        for( int j = 0; j <= bisecActive.Count - 1; ++j )

          intxActive.Add(new Interval(thr, thr));

        int bisecCount = bisecActive.Count;

        // FIND INTERSECTION PARAMETERS
        for( int j = 0; j <= bisecCount - 1; ++j )
        {

          var ijPth = new GH_Path(i, j);
          int jPrev = (j + bisecCount - 1) % bisecCount;
          //int jPlus = (j + bisecCount    ) % bisecCount;

          var uu = new Interval(thr, thr);
          LineLineIntx(vActive[j], vActive[j] + bisecActive[j], vActive[jPrev], vActive[jPrev] + bisecActive[jPrev], ref uu);
          /*var vv = new Interval(thr, thr);
          LineLineIntx(vActive[jPlus], vActive[jPlus] + bisecActive[jPlus], vActive[j], vActive[j] + bisecActive[j], ref vv);
          intxActive[jPlus] = new Interval(intxActive[jPlus][0], vv[1]);*/
          intxActive[j] = new Interval(uu[0], intxActive[j][1]);
          intxActive[jPrev] = new Interval(intxActive[jPrev][0], uu[1]);
          //Print( intxActive[jPlus].ToString() + " jPlus" );
          Print(intxActive[j].ToString() + " j");
          Print(intxActive[jPrev].ToString() + " jPrev");

          eCurr = eNE[eCurr];

        }

        eCurr = e0;


        int k = 0;
        int safety = 0;
        bool tri = false;
        int skelCt = 0;
        while( safety < stp && !tri )
        {

          int kPrev = (k + intxActive.Count - 1) % intxActive.Count;
          int kPlus = (k + intxActive.Count ) % intxActive.Count;
          var ikPth = new GH_Path(i, k);
          var iPrevPth = new GH_Path(i, kPrev);

          if( Math.Abs(intxActive[k][0]) <= Math.Abs(intxActive[k][1]) && Math.Abs(intxActive[kPrev][1]) <= Math.Abs(intxActive[kPrev][0]) )
          {

            var skelPth = new GH_Path(skelCt);
            skelAll.Add(new Line(vActive[k], vActive[k] + intxActive[k][0] * bisecActive[k]), fIE.Path(i));
            skelAll.Add(new Line(vActive[kPrev], vActive[k] + intxActive[k][0] * bisecActive[k]), fIE.Path(i));

            // IF THERE IS AN INTERSECTION REMOVE PREVIOUS VERTEX, RAYS, REPLACE WITH NEW
            vActive[kPrev] = vActive[kPrev] + intxActive[kPrev][1] * bisecActive[kPrev];
            vActive.RemoveAt(k);
            bisecActive.RemoveAt(k);
            intxActive.RemoveAt(k);
            eActive.RemoveAt(k);

            if( k >= vActive.Count )
            {

              k = 0;

            }

            if (kPrev >= vActive.Count)
            {

              kPrev = vActive.Count - 1;

            }

            /*if( kPlus >= vActive.Count )

              kPrev = ( kPlus + vActive.Count ) % vActive.Count;*/

            int kPrevX2 = (kPrev + vActive.Count - 1 ) % vActive.Count;

            bisecActive[kPrev] = FindBisect(eActive[kPrev], eActive[k]);

            // AND RECALCULATE INTERSECTIONS
            var uu = new Interval(thr, thr);
            LineLineIntx(vActive[kPrev], vActive[kPrev] + bisecActive[kPrev], vActive[kPrevX2], vActive[kPrevX2] + bisecActive[kPrevX2], ref uu);
            intxActive[kPrev] = new Interval(uu[0], intxActive[kPrev][1]);
            intxActive[kPrevX2] = new Interval(intxActive[kPrevX2][0], uu[1]);

            uu = new Interval(thr, thr);
            LineLineIntx(vActive[k], vActive[k] + bisecActive[k], vActive[kPrev], vActive[kPrev] + bisecActive[kPrev], ref uu);
            intxActive[k] = new Interval(uu[0], intxActive[k][1]);
            intxActive[kPrev] = new Interval(intxActive[kPrev][0], uu[1]);

            /*if( vActive.Count >= kPlus - 1 )
            {

              kPlus = ( kPrev-1 ) % vActive.Count;
              uu = new Interval(thr, thr);
              LineLineIntx(vActive[kPlus], vActive[kPlus] + bisecActive[kPlus], vActive[k], vActive[k] + bisecActive[k], ref uu);
              intxActive[kPlus] = new Interval(uu[0], intxActive[kPlus][1]);
              intxActive[k] = new Interval(intxActive[k][0], uu[1]);

            }*/

            skelCt += 1;
            //Print(skelCt.ToString());

          }

          k = (k + 1) % intxActive.Count;
          safety += 1;

          if( vActive.Count <= 3 )
          {

            tri = true;

          }

        }

        if( tri )
        {

          for( int m = 0; m <= vActive.Count - 1; ++m )
          {

            var skelPth = new GH_Path(skelCt);
            int mPrev = (m + vActive.Count - 1) % vActive.Count;

            skelAll.Add(new Line(vActive[m], vActive[m] + intxActive[m][0] * bisecActive[m]), fIE.Path(i));

            skelCt += 1;

          }

          bisecActive.Clear();
          vActive.Clear();
          eActive.Clear();

        }

      }

    }

    A = skelAll;
    B = vActive;
    C = bisecActive;
    D = eActive;
# ---------- c_script_8: C# additional code ----------
  public Vector3d FindBisect(Line edgeIn, Line edgeOut)
  {

    var vctIn = new Vector3d(-edgeIn.Direction);
    var vctOut = new Vector3d(edgeOut.Direction);
    vctIn.Unitize();
    vctOut.Unitize();

    double degIn = 0.0;
    double degOut = 0.0;
    EdgeDirection(ref vctIn, ref degIn);
    EdgeDirection(ref vctOut, ref degOut);

    if( degOut < degIn )
    {

      degOut += 2 * Math.PI;

    }

    double amp = 1;
    double ang = degOut - degIn;

    if( ang > Math.PI )
    {

      amp *= -1;

    }

    var bsctVct = new Vector3d(vctIn.X + vctOut.X, vctIn.Y + vctOut.Y, 0);

    if( bsctVct.Length > 0 )
    {

      bsctVct *= amp / bsctVct.Length;

    }

    else
    {

      bsctVct = Vector3d.CrossProduct(vctIn, Vector3d.ZAxis);
      bsctVct.Unitize();

    }

    return bsctVct;

  }

  public void EdgeDirection(ref Vector3d eCurr, ref double degList)
  {
    // FIND DIRECTION OF EDGE
    double deg;
    if (eCurr.X == 0)
    {
      deg = 90 * (eCurr.Y / Math.Abs(eCurr.Y)) + 360;
      deg = (360 + deg) % 360;
    }
    else
    {
      deg = Math.Atan(eCurr.Y / eCurr.X) * 180 / Math.PI;

      if( eCurr.X < 0 )
      {

        deg = 180 + deg;

      }

      if( eCurr.X > 0 )
      {

        deg = (360 + deg) % 360;

      }

    }

    degList = Math.PI * deg / 180;

  }

  public void LineLineIntx(Point3d pt1, Point3d pt2, Point3d pt3, Point3d pt4, ref Interval interval) {
    // via Paul Bourke: http://www-cs.ccny.cuny.edu/~wolberg/capstone/intersection/Intersection%20point%20of%20two%20lines.html
    double denom = ( pt4.Y - pt3.Y ) * ( pt2.X - pt1.X ) - ( pt4.X - pt3.X ) * ( pt2.Y - pt1.Y );

    if( denom != 0 )
    {
      double u1 = ( ( pt4.X - pt3.X ) * ( pt1.Y - pt3.Y ) - ( pt4.Y - pt3.Y ) * ( pt1.X - pt3.X ) ) / denom;
      double u2 = ( ( pt2.X - pt1.X ) * ( pt1.Y - pt3.Y ) - ( pt2.Y - pt1.Y ) * ( pt1.X - pt3.X ) ) / denom;

      interval = new Interval(u1, u2);

    }

  }
# ---------- end c_script_8 ----------
cut = CutCorners(CurvesToSplit=c_script_8.A)
reconstruct = ReconstructCurve(CurvesIn=cut)
previewlw = CustomPreviewLineweights(Geometry=reconstruct, Shader=frgb_2, Thickness=Slider(7.738, range=0..100), Absolute=False)
