# Grasshopper definition FloorPlanGHOne.gh (Grasshopper 1.0.7)
# plug-ins: GhPython Script, treesloth01

text = Text(Tree({1}: ["Área de control vehicular - Vigilancia", "1", "1.5", "1.5", "1"], {2}: ["Parqueaderos vehicular (5,00 x 2,50 mts)", "5", "12.5", "62.5", "1"], {3}: ["Parqueaderos discapacitados (5,00 x 3,70 mts)", "1", "18.5", "18.5", "1"], {4}: ["Parqueaderos bicicletas/motos", "5", "1.2", "6", "1"], {5}: ["Zona de Parqueo ambulancias", "1", "11", "11", "1"], {6}: ["*", "*", "*", "*", ""]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))
partitiontreeatchar = CSharpScript(data=text, erase="*")  # -> A; inputs data: tree of String, erase: String
# ---------- partitiontreeatchar: C# ----------
    var treeOut = new DataTree<string>();
    int path = 0;

    for( int i = 0; i < data.BranchCount; ++i )
      for( int j = 0; j < data.Branch(i).Count; ++j )
      {

        if( data.Branch(i)[j] != erase )
        {

          treeOut.Add(data.Branch(i)[j], new GH_Path(path));
          //path++;

        }
        
        else
        {
        
          path++;
        
        }

      }

    A = treeOut;
# ---------- end partitiontreeatchar ----------
columns = Curve([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])
cleantreefromempty = CSharpScript(data=partitiontreeatchar)  # -> A; inputs data: tree of String
# ---------- cleantreefromempty: C# ----------
    var treeOut = new DataTree<string>();

    foreach( var path in data.Paths )
    {
    
      var branch = data.Branch(path);
      
      foreach( var item in branch )
      {
      
        if( !String.IsNullOrEmpty(item) )
        treeOut.Add( item, path );
      
      }
    
    }

    A = treeOut;
# ---------- end cleantreefromempty ----------
gene_pool = GenePool(
    Decimals=2,
    Maximum=1,
    Minimum=0,
    Value=[0.9721691734, 0.3940420111, 0.09806669741, 0.4963137491, 0.6310349347, 0.2720474639, 0.3445372346, 0.4332898257, 0.9109802972, 0.3605328451, 0.04228328683, 0.3170308351, 0.4941467589, 0.7783018154, 0.6591811323, 0.8372587323, 0.4461596475, 0.4614113264, 0.1973582023, 0.807767244, 0.08734677596, 0.6416664811, 0.7506823501])
gene_pool_2 = GenePool(
    Decimals=2,
    Maximum=1,
    Minimum=0,
    Value=[0.1259618253, 0.9086043899, 0.4475464623, 0.06254124318, 0.0382319363, 0.3048866644, 0.46501961, 0.5126458074, 0.8089686771, 0.9566153348, 0.5946551625, 0.3352268419, 0.3276468219, 0.3207489915, 0.09939579344, 0.944163356, 0.7091837012, 0.9599813167, 0.7219291915, 0.6181423513, 0.4372404979, 0.9821487772, 0.8863293561])
curve = Curve(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)
renumber_paths = RenumberPaths(Data=cleantreefromempty)
number_slider = Slider(3.145, range=0..10)
construct_point = ConstructPoint(XCoordinate=gene_pool, YCoordinate=gene_pool_2, ZCoordinate=0)
surface = Surface(reparameterize(curve))
number_slider_2 = Slider(1.533, range=0..10)
evaluate_surface = EvaluateSurface(Surface=surface, Point=construct_point)  # -> Point, Normal, UDirection, VDirection, Frame
cullbranchesfromindex = CSharpScript(branches=renumber_paths, cullFrom=Slider(4, range=0..10))  # -> out, treeOut; inputs branches: tree of String, cullFrom: Int32
# ---------- cullbranchesfromindex: C# ----------
    var newTree = new DataTree<string>();

    for( int i = 0; i < branches.BranchCount; ++i )
    {

      var path = branches.Path(i);

      if( path.Indices[0] >= cullFrom )

        newTree.AddRange(branches.Branch(i), path);

    }

    treeOut = newTree;
# ---------- end cullbranchesfromindex ----------
point = Point(evaluate_surface.Point)
taxicab = ManhattanVoronoi(R=number_slider, P=point)
ghpython_script = GhPythonScript(r=number_slider, P=point)  # -> PL; inputs P: list of Point3d
# ---------- ghpython_script: Python ----------
from ghpythonlib.componentbase import executingcomponent as component
import Grasshopper, GhPython
import System
import Rhino
import rhinoscriptsyntax as rs

class MyComponent(component):
    
    def RunScript(self, r, P):
        """Provides a scripting component.
            Inputs:
                x: The x script variable
                y: The y script variable
            Output:
                a: The a output variable"""
        
        __author__ = "Paula"
        __version__ = "2019.04.23"
        
        import rhinoscriptsyntax as rs
        import Rhino as rc
        import math 
        from Rhino.Geometry import Point3d as P3
        from Rhino.Geometry import Polyline as PLine
        
        def taxicab_midnormal ( Point_1 = P3(0,0,0), Point_2 = P3(0,0,0) , leng = 10000):
            dx = abs(Point_1.X - Point_2.X)
            dy = abs(Point_1.Y - Point_2.Y)
            
            C = P3 ( ( Point_1.X + Point_2.X ) / 2, ( Point_1.Y + Point_2.Y ) / 2, ( Point_1.Z + Point_2.Z ) / 2)
            
            """ MPQN, in which M is on the lengeft(X-) or bottom(Y-) """
            P = P3 (0,0,C.Z)
            Q = P3 (0,0,C.Z)
            M = P3 (0,0,C.Z)
            N = P3 (0,0,C.Z)
            
            if dx > dy:
                P.Y = C.Y + dy / 2
                Q.Y = C.Y - dy / 2
                M.Y = P.Y + leng
                N.Y = Q.Y - leng
                if bool(Point_1.Y > Point_2.Y) ^ bool(Point_1.X > Point_2.X):
                    P.X = C.X + dy / 2
                    Q.X = C.X - dy / 2
                else:
                    P.X = C.X - dy / 2
                    Q.X = C.X + dy / 2
                M.X = P.X
                N.X = Q.X
            else:
                if dx < dy:
                    P.X = C.X + dx / 2
                    Q.X = C.X - dx / 2
                    M.X = P.X + leng
                    N.X = Q.X - leng
                    if bool(Point_1.Y > Point_2.Y) ^ bool(Point_1.X > Point_2.X):
                        P.Y = C.Y + dx / 2
                        Q.Y = C.Y - dx / 2
                    else:
                        P.Y = C.Y - dx / 2
                        Q.Y = C.Y + dx / 2
                    M.Y = P.Y
                    N.Y = Q.Y
                else:
                    if bool(Point_1.Y > Point_2.Y) ^ bool(Point_1.X > Point_2.X):
                        P.Y = C.Y - dx / 2
                        Q.Y = C.Y + dx / 2
                        P.X = C.X - dy / 2
                        Q.X = C.X + dy / 2
                        M.Y = P.Y - leng
                        M.X = P.X - leng
                        N.Y = Q.Y + leng
                        N.X = Q.X + leng
                    else:
                        P.Y = C.Y - dx / 2
                        Q.Y = C.Y + dx / 2
                        P.X = C.X + dy / 2
                        Q.X = C.X - dy / 2
                        M.Y = P.Y - leng
                        M.X = P.X + leng
                        N.Y = Q.Y + leng
                        N.X = Q.X - leng
        
            return rs.AddPolyline( [M , P , Q , N] )
        
        def taxicab_circle ( point = P3(0,0,0), r = 1 ):
            A = P3( point.X + r, point.Y, point.Z )
            B = P3( point.X, point.Y + r, point.Z )
            C = P3( point.X - r, point.Y, point.Z )
            D = P3( point.X, point.Y - r, point.Z )
            return rs.AddPolyline( [A, B, C, D, A] )
            #return rc.Geometry.Polyline( [A, B, C, D, A] )
        
        l = 2 * r
        
        """ PL = taxicab_midnormal ( A, B, r ) """
        
        pts = P
        
        polylines = []
        for i in range( len( P ) ):
            polylines.append(taxicab_circle( P[i], l ))
            rs.RotateObject( polylines[i], P[i], 45 )
        
        for i in range(len(polylines)):
            for j in range(i):
                if i == j:
                    continue
                if rs.CurveBooleanUnion( [ polylines[i], polylines[j] ] ):
                    MN = taxicab_midnormal( pts[i], pts[j], l )
                    
                    ccx = rs.CurveCurveIntersection( polylines[i], MN )
                    if ccx is None:
                        continue
                    if ccx[0][0] == 2:
                        continue
                    para_a = [ ccx[0][5], ccx[1][5] ]
                    para_b = [ ccx[0][7], ccx[1][7] ]
                    
                    if para_b[0] > para_b[1]:
                        para_b = [ para_b[1], para_b[0] ]
                    
                    probable_dash = rs.SplitCurve(polylines[i], para_a)
                    edge = rs.TrimCurve(MN, para_b, False )
                    edgepts = rs.CurvePoints(edge)
                    
                    for crv in probable_dash:
                        crvpts = rs.CurvePoints(crv)
                        if rs.PointCompare( crvpts[0], edgepts[0] ):
                            crvpts.reverse()
                        newpl = rs.AddPolyline( edgepts + crvpts )
                        if rs.PointInPlanarClosedCurve( pts[i], newpl ):
                            polylines[i] = newpl
                            break
                    
                    
                    ccx = rs.CurveCurveIntersection( polylines[j], MN )
                    if ccx is None:
                        continue
                    para_a = [ ccx[0][5], ccx[1][5] ]
                    para_b = [ ccx[0][7], ccx[1][7] ]
                    
                    if para_b[0] > para_b[1]:
                        para_b = [ para_b[1], para_b[0] ]
                    
                    probable_dash = rs.SplitCurve(polylines[j], para_a)
                    edge = rs.TrimCurve(MN, para_b, False )
                    edgepts = rs.CurvePoints(edge)
                    
                    for crv in probable_dash:
                        crvpts = rs.CurvePoints(crv)
                        if rs.PointCompare( crvpts[0], edgepts[0] ):
                            crvpts.reverse()
                        newpl = rs.AddPolyline( edgepts + crvpts )
                        if rs.PointInPlanarClosedCurve( pts[j], newpl ):
                            polylines[j] = newpl
                            break
            
        
        PL = polylines
        
        # return outputs if you have them; here I try it for you:
        return PL
# ---------- end ghpython_script ----------
ghpython_script_2 = GhPythonScript(r=number_slider_2, P=point)  # -> out, PL; inputs P: list of Point3d
# ---------- ghpython_script_2: Python ----------
__author__ = "Paula"
__version__ = "2019.04.23"

import rhinoscriptsyntax as rs
from Rhino.Geometry import Point3d as P3
from Rhino.Geometry import Polyline as PLine

def taxicab_midnormal ( Point_1 = P3(0,0,0), Point_2 = P3(0,0,0) , leng = 10000):
    dx = abs(Point_1.X - Point_2.X)
    dy = abs(Point_1.Y - Point_2.Y)
    
    C = P3 ( ( Point_1.X + Point_2.X ) / 2, ( Point_1.Y + Point_2.Y ) / 2, ( Point_1.Z + Point_2.Z ) / 2)
    
    """ MPQN, in which M is on the lengeft(X-) or bottom(Y-) """
    P = P3 (0,0,C.Z)
    Q = P3 (0,0,C.Z)
    M = P3 (0,0,C.Z)
    N = P3 (0,0,C.Z)
    
    if dx > dy:
        P.Y = C.Y + dy / 2
        Q.Y = C.Y - dy / 2
        M.Y = P.Y + leng
        N.Y = Q.Y - leng
        if bool(Point_1.Y > Point_2.Y) ^ bool(Point_1.X > Point_2.X):
            P.X = C.X + dy / 2
            Q.X = C.X - dy / 2
        else:
            P.X = C.X - dy / 2
            Q.X = C.X + dy / 2
        M.X = P.X
        N.X = Q.X
    else:
        if dx < dy:
            P.X = C.X + dx / 2
            Q.X = C.X - dx / 2
            M.X = P.X + leng
            N.X = Q.X - leng
            if bool(Point_1.Y > Point_2.Y) ^ bool(Point_1.X > Point_2.X):
                P.Y = C.Y + dx / 2
                Q.Y = C.Y - dx / 2
            else:
                P.Y = C.Y - dx / 2
                Q.Y = C.Y + dx / 2
            M.Y = P.Y
            N.Y = Q.Y
        else:
            if bool(Point_1.Y > Point_2.Y) ^ bool(Point_1.X > Point_2.X):
                P.Y = C.Y - dx / 2
                Q.Y = C.Y + dx / 2
                P.X = C.X - dy / 2
                Q.X = C.X + dy / 2
                M.Y = P.Y - leng
                M.X = P.X - leng
                N.Y = Q.Y + leng
                N.X = Q.X + leng
            else:
                P.Y = C.Y - dx / 2
                Q.Y = C.Y + dx / 2
                P.X = C.X + dy / 2
                Q.X = C.X - dy / 2
                M.Y = P.Y - leng
                M.X = P.X + leng
                N.Y = Q.Y + leng
                N.X = Q.X - leng

    return rs.AddPolyline( [M , P , Q , N] )

def taxicab_circle ( point = P3(0,0,0), r = 1 ):
    A = P3( point.X + r, point.Y, point.Z )
    B = P3( point.X, point.Y + r, point.Z )
    C = P3( point.X - r, point.Y, point.Z )
    D = P3( point.X, point.Y - r, point.Z )
    return rs.AddPolyline( [A, B, C, D, A] )

l = 2 * r

""" PL = taxicab_midnormal ( A, B, r ) """

pts = P

polylines = []
for i in range( len( P ) ):
    polylines.append(taxicab_circle( P[i], l ))

for i in range(len(polylines)):
    for j in range(i):
        if i == j:
            continue
        if rs.CurveBooleanUnion( [ polylines[i], polylines[j] ] ):
            MN = taxicab_midnormal( pts[i], pts[j], l )
            
            ccx = rs.CurveCurveIntersection( polylines[i], MN )
            if ccx is None:
                continue
            if ccx[0][0] == 2:
                continue
            para_a = [ ccx[0][5], ccx[1][5] ]
            para_b = [ ccx[0][7], ccx[1][7] ]
            
            if para_b[0] > para_b[1]:
                para_b = [ para_b[1], para_b[0] ]
            
            probable_dash = rs.SplitCurve(polylines[i], para_a)
            edge = rs.TrimCurve(MN, para_b, False )
            edgepts = rs.CurvePoints(edge)
            
            for crv in probable_dash:
                crvpts = rs.CurvePoints(crv)
                if rs.PointCompare( crvpts[0], edgepts[0] ):
                    crvpts.reverse()
                newpl = rs.AddPolyline( edgepts + crvpts )
                if rs.PointInPlanarClosedCurve( pts[i], newpl ):
                    polylines[i] = newpl
                    break
            
            
            ccx = rs.CurveCurveIntersection( polylines[j], MN )
            if ccx is None:
                continue
            para_a = [ ccx[0][5], ccx[1][5] ]
            para_b = [ ccx[0][7], ccx[1][7] ]
            
            if para_b[0] > para_b[1]:
                para_b = [ para_b[1], para_b[0] ]
            
            probable_dash = rs.SplitCurve(polylines[j], para_a)
            edge = rs.TrimCurve(MN, para_b, False )
            edgepts = rs.CurvePoints(edge)
            
            for crv in probable_dash:
                crvpts = rs.CurvePoints(crv)
                if rs.PointCompare( crvpts[0], edgepts[0] ):
                    crvpts.reverse()
                newpl = rs.AddPolyline( edgepts + crvpts )
                if rs.PointInPlanarClosedCurve( pts[j], newpl ):
                    polylines[j] = newpl
                    break
    

PL = polylines
# ---------- end ghpython_script_2 ----------
renumber_paths_2 = RenumberPaths(Data=cullbranchesfromindex.treeOut)
hull = ConvexHull(Points=evaluate_surface.Point, Plane=PlaneXY(0, 0, 0))  # -> Hull, HullZ, Indices
area = Area(Geometry=hull.Hull, UseTasks=False)  # -> Area, Centroid
voronoi = Voronoi(Points=point, BruteForceOverride=False)  # disabled
ghpython_script_3 = GhPythonScript(r=number_slider_2, P=point)  # -> out, PL; inputs P: list of Point3d; same code as ghpython_script_2
python = GhPythonScript(x=ghpython_script_3.PL)  # -> out, a; inputs x: list of Polyline
# ---------- python: Python ----------
__author__ = "feli2"
__version__ = "2019.04.24"

import rhinoscriptsyntax as rs
import Rhino as rc
import math 

poly = rc.Geometry.Polyline( x[0] )
#poly.Transform.Rotation( 45.0 * math.pi / 180, rc.Geometry.Point3d( 0, 0, 0 ) )
poly.Transform.Translation( rc.Geometry.Point3d( 0, 1, 0 ) )
# ---------- end python ----------
partition_list = PartitionList(List=renumber_paths_2, Size=Slider(5, range=0..10))
region_intersection = RegionIntersection(CurvesA=voronoi, CurvesB=curve)  # disabled
rad = Radians(Degrees=Slider(0, range=0..100))
rotate = Rotate(Geometry=ghpython_script_2.PL, Angle=rad, Plane=area.Centroid)  # -> Geometry, Transform
gene_pool_3 = GenePool(Decimals=2, Maximum=10, Minimum=5, Value=[5, 5, 5, 5, 5, 5, 5.011922529, 5, 5, 5, 5, 5, 5, 5, 5, 5, 5, 5, 5, 5, 5, 5, 5])
text_2 = Text(partition_list)
discontinuity = Discontinuity(Curve=region_intersection, Level=1)  # -> Points, Parameters; disabled
list_item = ListItem(List=text_2, Index=Slider(2, range=0..3), Wrap=True)
circle_fit = CircleFit(Points=discontinuity.Points)  # -> Circle, Radius, Deviation; disabled
number_slider_3 = Slider(51, range=0..100)
multiplication = Multiplication(A=gene_pool_3, B=Slider(0.5, range=0..1))
construct_domain = ConstructDomain(DomainStart=expr("-x", multiplication), DomainEnd=multiplication)  # -> flatten(Domain)
multiplication_2 = Multiplication(A=list_item, B=Slider(0.2, range=0..1))
rectangle = Rectangle(Plane=PlaneXY(0, 0, 0), XSize=number_slider_3, YSize=number_slider_3, Radius=0)  # -> Rectangle, Length
rectangle_2 = Rectangle(Plane=point, XSize=construct_domain, YSize=construct_domain, Radius=0)  # -> Rectangle, Length
construct_domain_2 = ConstructDomain(DomainStart=expr("-x", multiplication_2), DomainEnd=multiplication_2)  # -> flatten(Domain)
region_intersection_2 = RegionIntersection(CurvesA=rectangle_2.Rectangle, CurvesB=curve)
curve_2 = Curve(region_intersection_2)
collision_many_many = CollisionManyMany(Colliders=curve_2)  # -> Collision, Indices
list_length = ListLength(List=region_intersection_2)
area_2 = Area(Geometry=region_intersection_2, UseTasks=False)  # -> Area, Centroid
random = Random(Range=Domain(0, 1), Number=list_length, Seed=Slider(1000, range=0..1000))
random_2 = Random(Range=Domain(0, 1), Number=list_length, Seed=Slider(626, range=0..1000))
mass_addition = MassAddition(Input=collision_many_many.Collision)  # -> Result, PartialResults
random_3 = Random(Range=Domain(0, 1), Number=list_length, Seed=Slider(482, range=0..1000))
mass_addition_2 = MassAddition(Input=area_2.Area)  # -> Result, PartialResults
panel = Panel(mass_addition.Result)
colour_rgb_f = ColourRGBF(Alpha=1, Red=random, Green=random_2, Blue=random_3)
surface_2 = Surface(region_intersection_2)
panel_2 = Panel(mass_addition_2.Result)
custom_preview = CustomPreview(Geometry=surface_2, Material=colour_rgb_f)
galapagos = Galapagos(fitness=addition, gene=[gene_pool, gene_pool_2])
expression = Expression(x=mass_addition.Result, z=Slider(1, range=0..100), Expression="If( x < z, 0, 10000 )")
expression_2 = Expression(
    x=mass_addition_2.Result,
    y=Slider(320, range=0..1000),
    z=Slider(300, range=0..1000),
    Expression="If( ( x < y) And ( x > z), 0, 1000 )")
addition = Addition(A=expression_2, B=expression)
panel_3 = Panel(addition)
