# Grasshopper definition ResearchAndDevelopment.gh (Grasshopper 1.0.7)
# plug-ins: PTComponentLibrary

number_slider = Slider(10, range=0..10)
construct_domain = ConstructDomain(DomainStart=expr("-x", number_slider), DomainEnd=number_slider)
construct_domain_2 = ConstructDomain(DomainStart=expr("-x", number_slider), DomainEnd=number_slider)
rectangle = Rectangle(Plane=PlaneXY(0, 0, 0), XSize=construct_domain_2, YSize=construct_domain, Radius=0)  # -> Rectangle, Length
point = Point(Point(1.594672445, 1.996201272, 0))
point_2 = Point(Point(6.154434152, 4.5422691, 0))
number_slider_2 = Slider(50, range=0..100)
divide_surface = DivideSurface(Surface=rectangle.Rectangle, UCount=number_slider, VCount=number_slider)  # -> simplify(Points), Normals, Parameters
random_attraction = RandomAttraction(Grid=divide_surface.Points, Magnitude=Slider(0, range=0..1))  # -> Grid, Weights
c_script = CSharpScript(grid=random_attraction.Grid, point=point)  # -> xOut, yOut; inputs grid: tree of Point3d, point: Point3d
# ---------- c_script: C# ----------
    int branchCount = grid.BranchCount;

    double minDistance = double.MaxValue;

    CustomPair cp;

    GH_Path path = new GH_Path();

    for( int i = 0; i < branchCount; ++i )
    {

      for( int j = 0; j < grid.Branch(i).Count; ++j )
      {

        double localDistance = point.DistanceTo(grid.Branch(i)[j]);
        cp.Key = localDistance;
        cp.Path = new GH_Path(i, j);
        minDistance = Math.Min(minDistance, localDistance);

        if( ( cp.Key - minDistance ) < 0.001 )
        {

          path = cp.Path;

        }

      }

    }

    xOut = path.Indices[0];
    yOut = path.Indices[1];
# ---------- c_script: C# additional code ----------
  struct CustomPair
  {

    public double Key;
    public GH_Path Path;

  }
# ---------- end c_script ----------
c_script_2 = CSharpScript(grid=random_attraction.Grid, point=point_2)  # -> xOut, yOut; inputs grid: tree of Point3d, point: Point3d; same code as c_script
pathfinding = CSharpScript(grid=random_attraction.Grid, idx=c_script.xOut, idj=c_script.yOut, fidx=c_script_2.xOut, fjdx=c_script_2.yOut)  # -> points; inputs grid: tree of Point3d, idx: Int32, idj: Int32, fidx: Int32, fjdx: Int32
# ---------- pathfinding: C# ----------
    int branchCount = grid.BranchCount;
    int maxTreeBranchCount = grid.Branch(branchCount - 1).Count;

    int x = idx % branchCount, y = idj % maxTreeBranchCount;

    Point3d tempPoint = new Point3d();
    Point3d point = grid.Branch(x)[y];
    Point3d finalPoint = grid.Branch(fidx % branchCount)[fjdx % maxTreeBranchCount];
    List<Point3d> tempList = new List<Point3d>();
    double minDistance = double.MaxValue;
    //var keyValuePair = new KeyValuePair<double, Point3d>();

    //tempList.Add(point);

    //    CustomPair customPair;

    GH_Path path = new GH_Path();
    
//    tempList.Add(grid.Branch(x)[y-1]);
//    tempList.Add(grid.Branch(x-1)[y]);
//    tempList.Add(grid.Branch(x)[y+1]);
//    tempList.Add(grid.Branch(x+1)[y]);
    
    for( int xx = x - 1; xx < x + 2; ++xx )
      for( int yy = y - 1; yy < y + 2; ++yy )
      {
      
        //if( yy != 1 )
        if( xx != 0 )
        {
          //yy = 0;
          
          tempList.Add(grid.Branch(xx)[yy]);
        }
      }
    
        //while( tempPoint.CompareTo(finalPoint) != 0 )
        //{

        //    for( int xx = x - 1; xx < x + 2; ++xx )
        //      //System.Threading.Tasks.Parallel.For(x - 1, x + 2, xx =>
        //    {
        //
        //      //if( xx == 0 ){
        //      
        //        for( int yy = y - 1; yy < y + 2; ++yy )
        //          //System.Threading.Tasks.Parallel.For(y - 1, y + 2, yy =>
        //        {
        //
        //          //if( xx != 1 )
        //        
        //          //if( yy == 1 )
        //        
        //          //if( yy <= 0 )
        //          {
        //
        //            tempList.Add(grid.Branch(x-1)[y]);
        //tempList.Add(grid.Branch(x + 1)[y]);
        //
        //            //            double localDistance = finalPoint.DistanceTo(grid.Branch(xx)[yy]);
        //            //
        //            //            customPair.Key = localDistance;
        //            //            customPair.Value = grid.Branch(xx)[yy];
        //            //            customPair.Path = new GH_Path(xx, yy);
        //            //
        //            //            minDistance = Math.Min(minDistance, localDistance);
        //            //
        //            //            if( ( customPair.Key - minDistance ) < 0.01 )
        //            //            {
        //            //
        //            //              tempPoint = customPair.Value;
        //            //              path = customPair.Path;
        //
        //          }
        //
        //        }
        //
        //      //}
        //    }
        //}

        //      x = path.Indices[0];
        //      y = path.Indices[1];

        //tempList.Add(tempPoint);

        //}

        //Print("Path: " + path.ToString());

        points = tempList;
# ---------- pathfinding: C# additional code ----------
  //  struct CustomPair
  //  {
  //
  //    public double Key;
  //    public Point3d Value;
  //    public GH_Path Path;
  //
  //  }
# ---------- end pathfinding ----------
pathfinding_2 = CSharpScript(grid=random_attraction.Grid, idx=c_script.xOut, idj=c_script.yOut, fidx=c_script_2.xOut, fjdx=c_script_2.yOut)  # -> points; inputs grid: tree of Point3d, idx: Int32, idj: Int32, fidx: Int32, fjdx: Int32
# ---------- pathfinding_2: C# ----------
    int branchCount = grid.BranchCount;
    int maxTreeBranchCount = grid.Branch(branchCount - 1).Count;

    int x = idx % branchCount, y = idj % maxTreeBranchCount;

    Point3d tempPoint = new Point3d();
    Point3d point = grid.Branch(x)[y];
    Point3d finalPoint = grid.Branch(fidx % branchCount)[fjdx % maxTreeBranchCount];
    List<Point3d> tempList = new List<Point3d>();
    double minDistance = double.MaxValue;
    //var keyValuePair = new KeyValuePair<double, Point3d>();

    tempList.Add(point);

    CustomPair customPair;

    GH_Path path = new GH_Path();

    while( tempPoint.CompareTo(finalPoint) != 0 )
    {

      for( int xx = x - 1; xx < x + 2; ++xx )
        //System.Threading.Tasks.Parallel.For(x - 1, x + 2, xx =>
      {

        for( int yy = y - 1; yy < y + 2; ++yy )
          //System.Threading.Tasks.Parallel.For(y - 1, y + 2, yy =>
        {

          if( xx >= 0 && xx < branchCount && yy >= 0 && yy < maxTreeBranchCount )
          {

            double localDistance = finalPoint.DistanceTo(grid.Branch(xx)[yy]);

            customPair.Key = localDistance;
            customPair.Value = grid.Branch(xx)[yy];
            customPair.Path = new GH_Path(xx, yy);

            minDistance = Math.Min(minDistance, localDistance);

            if( ( customPair.Key - minDistance ) < 0.01 )
            {

              tempPoint = customPair.Value;
              path = customPair.Path;

            }

          }

        }

      }

      x = path.Indices[0];
      y = path.Indices[1];

      tempList.Add(tempPoint);

    }

    Print("Path: " + path.ToString());

    points = tempList;
# ---------- pathfinding_2: C# additional code ----------
  struct CustomPair
  {

    public double Key;
    public Point3d Value;
    public GH_Path Path;

  }
# ---------- end pathfinding_2 ----------
number_slider_3 = Slider(3, range=0..10)  # disabled
number_slider_4 = Slider(1, range=0..10)  # disabled
number_slider_5 = Slider(7, range=0..10)  # disabled
number_slider_6 = Slider(0, range=0..10)  # disabled
cellulate = Cellulate(Grid=random_attraction.Grid)  # -> Wires, Cells, Meshes
dot_display = DotDisplay(Point=pathfinding, Colour=RGB(0, 0, 0), Size=Slider(0.2, range=0..1))
number_slider_7 = Slider(1, range=0..1)  # disabled
polyline = PolyLine(Vertices=pathfinding_2, Closed=False)
number_slider_8 = Slider(1, range=0..1)  # disabled
pathfinding_3 = CSharpScript(
    grid=random_attraction.Grid,
    idx=Slider(0, range=0..100),
    idj=Slider(8, range=0..100),
    fidx=Slider(97, range=0..100),
    fjdx=Slider(100, range=0..100))  # -> out, A, B, C, D; inputs grid: tree of Point3d, idx: Int32, idj: Int32, fidx: Int32, fjdx: Int32; disabled
# ---------- pathfinding_3: C# ----------
    int branchCount = grid.BranchCount;
    int maxTreeBranchCount = grid.Branch(branchCount - 1).Count;

    int x = idx % branchCount, y = idj % maxTreeBranchCount;

    Point3d tempPoint = new Point3d();
    Point3d point = grid.Branch(x)[y];
    Point3d finalPoint = grid.Branch(fidx % branchCount)[fjdx % maxTreeBranchCount];
    List<Point3d> tempList = new List<Point3d>();
    double minDistance = double.MaxValue;
    //var keyValuePair = new KeyValuePair<double, Point3d>();

    tempList.Add(point);

    CustomPair customPair;

    GH_Path path = new GH_Path();

    while( tempPoint.CompareTo(finalPoint) != 0 )
    {

      for( int xx = x - 1; xx < x + 2; ++xx )
        //System.Threading.Tasks.Parallel.For(x - 1, x + 2, xx =>
      {

        for( int yy = y - 1; yy < y + 2; ++yy )
          //System.Threading.Tasks.Parallel.For(y - 1, y + 2, yy =>
        {

          if( xx >= 0 && xx < branchCount && yy >= 0 && yy < maxTreeBranchCount )
          {

            double localDistance = finalPoint.DistanceTo(grid.Branch(xx)[yy]);

            customPair.Key = localDistance;
            customPair.Value = grid.Branch(xx)[yy];
            customPair.Path = new GH_Path(xx, yy);

            minDistance = Math.Min(minDistance, localDistance);

            if( ( customPair.Key - minDistance ) < 0.01 )
            {

              tempPoint = customPair.Value;
              path = customPair.Path;

            }

          }

        }

      }

      x = path.Indices[0];
      y = path.Indices[1];

      tempList.Add(tempPoint);

    }

    Print("Path: " + path.ToString());

    A = point;
    B = grid.Branch(x)[y];
    C = finalPoint;
    D = tempList;
# ---------- pathfinding_3: C# additional code ----------
  struct CustomPair
  {

    public double Key;
    public Point3d Value;
    public GH_Path Path;

  }
# ---------- end pathfinding_3 ----------
c_script_3 = CSharpScript(grid=divide_surface.Points, idx=number_slider_3, idj=number_slider_4, fidx=number_slider_6, fjdx=number_slider_5)  # -> out, A, B, C, D; inputs grid: tree of Point3d, idx: Int32, idj: Int32, fidx: Int32, fjdx: Int32; disabled
# ---------- c_script_3: C# ----------
    int branchCount = grid.BranchCount;
    int maxTreeBranchCount = grid.Branch(branchCount - 1).Count;

    int x = idx % branchCount, y = idj % maxTreeBranchCount;

    Point3d point = grid.Branch(x)[y];
    Point3d finalPoint = grid.Branch(fidx % branchCount)[fjdx % maxTreeBranchCount];
    List<Point3d> tempList = new List<Point3d>();

    for( int xx = x - 1; xx < x + 2; ++xx )
    {

      for( int yy = y - 1; yy < y + 2; ++yy )
      {

        if( xx >= 0 && xx < branchCount - 1 && yy >= 0 && yy < maxTreeBranchCount - 1 )
        {

          tempList.Add( grid.Branch(xx)[yy] );

        }

      }

    }
    
    point = Rhino.Collections.Point3dList.ClosestPointInList(tempList, finalPoint);
    
    A = point;
    B = grid.Branch(x)[y];
    C = finalPoint;
    D = tempList;
# ---------- c_script_3: C# additional code ----------
  void NearestNeighbor(out List<Point3d> outList, DataTree<Point3d> grid, Point3d finalPoint, int x, int y, int branchCount, int maxTreeBranchCount)
  {

    outList = new List<Point3d>();

    for( int xx = x - 1; xx < x + 1; ++xx )
    {

      for( int yy = y - 1; yy < y + 1; ++yy )
      {

        if( xx >= 0 && xx < branchCount - 1 && yy >= 0 && yy < maxTreeBranchCount - 1 )
        {


          if( grid.Branch(xx)[yy].DistanceTo(finalPoint) < grid.Branch(xx + 1)[yy + 1].DistanceTo(finalPoint) )
          {

            outList.Add(grid.Branch(xx)[yy]);

          }

          else
          {

            outList.Add(grid.Branch(xx + 1)[yy + 1]);

          }

        }

      }

    }

    //outList = tempList;

  }
# ---------- end c_script_3 ----------
polyline_2 = PolyLine(Vertices=pathfinding_3.D, Closed=False)
colour_rgb_f = ColourRGBF(Alpha=1, Red=Slider(1, range=0..1), Green=0, Blue=0)
number_slider_9 = Slider(0.49, range=0..1)  # disabled
number_slider_10 = Slider(0.27, range=0..1)  # disabled
colour_rgb_f_2 = ColourRGBF(Alpha=1, Red=number_slider_7, Green=0, Blue=0)  # disabled
colour_rgb_f_3 = ColourRGBF(Alpha=1, Red=0, Green=Slider(1, range=0..1), Blue=0)
number_slider_11 = Slider(0.43, range=0..1)  # disabled
colour_rgb_f_4 = ColourRGBF(Alpha=1, Red=0, Green=number_slider_8, Blue=0)  # disabled
length = Length(Curve=polyline_2)
dot_display_2 = DotDisplay(Point=pathfinding_3.D, Colour=colour_rgb_f, Size=Slider(0.17, range=0..1))
dot_display_3 = DotDisplay(Point=c_script_3.D, Colour=colour_rgb_f_2, Size=number_slider_10)  # disabled
number_slider_12 = Slider(1, range=0..1)  # disabled
dot_display_4 = DotDisplay(Point=c_script_3.B, Colour=RGB(0, 0, 0), Size=number_slider_9)  # disabled
dot_display_5 = DotDisplay(Point=pathfinding_3.C, Colour=colour_rgb_f_3, Size=Slider(0.34, range=0..1))
panel = Panel(length)
dot_display_6 = DotDisplay(Point=c_script_3.C, Colour=colour_rgb_f_4, Size=number_slider_11)  # disabled
colour_rgb_f_5 = ColourRGBF(Alpha=1, Red=0, Green=0, Blue=Slider(1, range=0..1))
number_slider_13 = Slider(0.32, range=0..1)  # disabled
colour_rgb_f_6 = ColourRGBF(Alpha=1, Red=0, Green=0, Blue=number_slider_12)  # disabled
dot_display_7 = DotDisplay(Point=pathfinding_3.A, Colour=colour_rgb_f_5, Size=Slider(0.32, range=0..1))
dot_display_8 = DotDisplay(Point=c_script_3.A, Colour=colour_rgb_f_6, Size=number_slider_13)  # disabled
