# Grasshopper definition SpacePartition[4].gh (Grasshopper 1.0.7)
# plug-ins: SpacePartition, MeshEdit Components, FloorsAndVolumes, ClipperComponents, Human, PTComponentLibrary, Weaverbird, MetaHopper, Kangaroo2 Components

# ---- group: Progress
spacepartitionnoparallel = CSharpScript()  # -> culledGrid, R, G, B; inputs voronoiIn: list of Polyline, gridIn: list of Polyline, areaIn: Double, seed: Int32; disabled
# ---------- spacepartitionnoparallel: C# usings ----------
using System.Linq;
# ---------- spacepartitionnoparallel: C# ----------
    var intersections = new DataTree<Curve>();
    var bools = new DataTree<bool>();

    for( int i = 0; i < voronoiIn.Count; ++i )
    {

      var voro = voronoiIn[i].ToNurbsCurve();

      for( int j = 0; j < gridIn.Count; ++j )
      {

        intersections.AddRange(Curve.CreateBooleanIntersection(voro, gridIn[j].ToNurbsCurve(), 1e-3).ToList(), new GH_Path(i, j));

      }

    }

    for( int i = 0; i < intersections.BranchCount; ++i )
    {

      var tempList = intersections.Branch(i);
      var path = new GH_Path(intersections.Path(i).Indices[0]);
      bool temp = false;

      if( tempList.Count > 0 )
      {

        var area = AreaMassProperties.Compute(intersections.Branch(i)[0]).Area;

        temp = area < areaIn ? false : true;

        bools.Add(temp, path);

      }

      else
      {

        temp = false;
        bools.Add(temp, path);

      }

    }

    var treeOut = new DataTree<Polyline>();
    var coloursOutR = new DataTree<int>();
    var coloursOutG = new DataTree<int>();
    var coloursOutB = new DataTree<int>();
    //var coloursOut = new DataTree<System.Drawing.Color>();
    var rand = new Random(seed);

    for( int i = 0; i < bools.BranchCount; ++i )
    {

      var path = intersections.Path(i);

      coloursOutR.Add(rand.Next(0, 255), path);
      coloursOutG.Add(rand.Next(0, 255), path);
      coloursOutB.Add(rand.Next(0, 255), path);
      //coloursOut.Add( System.Drawing.Color.FromArgb( 255, rand.Next( 0, 255 ), rand.Next( 0, 255 ), rand.Next( 0, 255 ) ), path );

      for( int j = 0; j < bools.Branch(i).Count; ++j )
      {

        if( bools.Branch(i)[j] == true )
        {

          treeOut.Add(gridIn[j], path);

        }

      }

    }

    culledGrid = treeOut;
    R = coloursOutR;
    G = coloursOutG;
    B = coloursOutB;
    //R = coloursOut;
# ---------- end spacepartitionnoparallel ----------
number_slider = Slider(4051, range=0..10000)  # disabled
pointtoclosestpath = CSharpScript()  # -> xOut, yOut; inputs grid: tree of Point3d, point: Point3d; disabled
# ---------- pointtoclosestpath: C# ----------
    int branchCount = grid.BranchCount;

    double minDistance = double.MaxValue;

    CustomPair cp;

    GH_Path path = new GH_Path();

    for( int i = 0; i < branchCount; ++i )
    {

      for( int j = 0; j < grid.Branch(i).Count; ++j )
      {

        double localDistance = point.DistanceTo(grid.Branch(i)[j]);
        cp.Key = localDistance;
        cp.Path = new GH_Path(i, j);
        minDistance = Math.Min(minDistance, localDistance);

        if( ( cp.Key - minDistance ) < 0.001 )
        {

          path = cp.Path;

        }

      }

    }

    xOut = path.Indices[0];
    yOut = path.Indices[1];
# ---------- pointtoclosestpath: C# additional code ----------
  struct CustomPair
  {

    public double Key;
    public GH_Path Path;

  }
# ---------- end pointtoclosestpath ----------
pointtoclosestpath_2 = CSharpScript()  # -> xOut, yOut; inputs grid: tree of Point3d, point: Point3d; disabled; same code as pointtoclosestpath
missinggridcells = CSharpScript()  # -> missing, places; inputs culledGrid: list of Polyline, originalGrid: list of Polyline; disabled
# ---------- missinggridcells: C# ----------
    List<Polyline> polys = new List<Polyline>();

    var temp = new List<Polyline>();

    int place = 0;
    
    List<int> placesL = new List<int>();

    int oGridC = originalGrid.Count;
    int cGridC = culledGrid.Count;

    int iter = oGridC - cGridC;

    for( int i = 0; i < iter; ++i )
    {

      polys.Add(BailOut(originalGrid, culledGrid, out place));
      culledGrid.Insert(place, originalGrid[place]);
      placesL.Add( place );

    }

    missing = polys;

    places = placesL;
# ---------- missinggridcells: C# additional code ----------
  Polyline BailOut(List<Polyline> originalGrid, List<Polyline> culledGrid, out int place)
  {

    place = 0;

    int oGridC = originalGrid.Count;
    int cGridC = culledGrid.Count;

    int iter = oGridC - cGridC;

    var tempPoly = new Polyline();

    var polysOut = new Polyline[iter];

    var cCenters = new Point3d[oGridC];
    var oCenters = new Point3d[oGridC];

    var distances = new int[oGridC];

    for( int i = place + 1; i < oGridC; ++i )
    {

      oCenters[i] = AreaMassProperties.Compute(originalGrid[i].ToNurbsCurve()).Centroid;

      if( i < cGridC )

        cCenters[i] = AreaMassProperties.Compute(culledGrid[i].ToNurbsCurve()).Centroid;

      else
      {

        cCenters[i] = Point3d.Unset;

      }

      distances[i] = oCenters[i].CompareTo(cCenters[i]);

      if( distances[i] != 0 )
      {

        tempPoly = originalGrid[i];

        place = i;

        break;

      }

    }

    return tempPoly;

  }
# ---------- end missinggridcells ----------
pathfinding = CSharpScript(idx=pointtoclosestpath.xOut, idj=pointtoclosestpath.yOut, fidx=pointtoclosestpath_2.xOut, fjdx=pointtoclosestpath_2.yOut)  # -> points; inputs grid: tree of Point3d, idx: Int32, idj: Int32, fidx: Int32, fjdx: Int32; disabled
# ---------- pathfinding: C# ----------
    int branchCount = grid.BranchCount;
    int maxTreeBranchCount = grid.Branch(branchCount - 1).Count;

    int x = idx % branchCount, y = idj % maxTreeBranchCount;

    Point3d tempPoint = new Point3d();
    Point3d point = grid.Branch(x)[y];
    Point3d finalPoint = grid.Branch(fidx % branchCount)[fjdx % maxTreeBranchCount];
    List<Point3d> tempList = new List<Point3d>();
    double minDistance = double.MaxValue;
    //var keyValuePair = new KeyValuePair<double, Point3d>();

    tempList.Add(point);

    CustomPair customPair;

    GH_Path path = new GH_Path();

    while( tempPoint.CompareTo(finalPoint) != 0 )
    {

      for( int xx = x - 1; xx < x + 2; ++xx )
        //System.Threading.Tasks.Parallel.For(x - 1, x + 2, xx =>
      {

        for( int yy = y - 1; yy < y + 2; ++yy )
          //System.Threading.Tasks.Parallel.For(y - 1, y + 2, yy =>
        {

          if( xx >= 0 && xx < branchCount && yy >= 0 && yy < maxTreeBranchCount )
          {

            double localDistance = finalPoint.DistanceTo(grid.Branch(xx)[yy]);

            customPair.Key = localDistance;
            customPair.Value = grid.Branch(xx)[yy];
            customPair.Path = new GH_Path(xx, yy);

            minDistance = Math.Min(minDistance, localDistance);

            if( ( customPair.Key - minDistance ) < 0.01 )
            {

              tempPoint = customPair.Value;
              path = customPair.Path;

            }

          }

        }

      }

      x = path.Indices[0];
      y = path.Indices[1];

      tempList.Add(tempPoint);

    }

    Print("Path: " + path.ToString());

    points = tempList;
# ---------- pathfinding: C# additional code ----------
  struct CustomPair
  {

    public double Key;
    public Point3d Value;
    public GH_Path Path;

  }
# ---------- end pathfinding ----------
spacepartitionallparallel = CSharpScript()  # -> simplify(culledGrid); inputs voronoiIn: list of Curve, gridIn: list of Curve, areaIn: Double; disabled
# ---------- spacepartitionallparallel: C# ----------
    int voronoiCount = voronoiIn.Count;
    int gridCount = gridIn.Count;

    Curve[][][] tempJagged = new Curve[voronoiCount][][];
    bool[][] boolJagged = new bool[voronoiCount][];
    var treeOut = new DataTree<Curve>();

    bool temp = false;
    double area = 0.0;

    System.Threading.Tasks.Parallel.For( 0, voronoiCount, i =>
    {

      var path = new GH_Path(i);

      var voro = voronoiIn[i];

      tempJagged[i] = new Curve[gridCount][];
      boolJagged[i] = new bool[gridCount];

      System.Threading.Tasks.Parallel.For(0, gridCount, j =>
        {

        tempJagged[i][j] = Curve.CreateBooleanIntersection(voro, gridIn[j].ToNurbsCurve(), 1e-8);

        if( tempJagged[i][j].Length > 0 )
        {

          area = AreaMassProperties.Compute(tempJagged[i][j][0]).Area;

          temp = area < areaIn ? false : true;

          boolJagged[i][j] = temp;

        }

        else
        {

          boolJagged[i][j] = false;

        }

        });

    });
    
    for( int i = 0; i < boolJagged.Length; ++i )
      for( int j = 0; j < boolJagged[i].Length; ++j )
      {

        if( boolJagged[i][j] == true )
        {

          treeOut.Add(gridIn[j]);


        }

      }

    culledGrid = treeOut;
# ---------- end spacepartitionallparallel ----------
spacepartitioninternalparallel = CSharpScript()  # -> simplify(culledGrid); inputs voronoiIn: list of Curve, gridIn: list of Curve, areaIn: Double; disabled
# ---------- spacepartitioninternalparallel: C# ----------
    int voronoiCount = voronoiIn.Count;
    int gridCount = gridIn.Count;

    Curve[][][] tempJagged = new Curve[voronoiCount][][];
    bool[][] boolJagged = new bool[voronoiCount][];
    var treeOut = new DataTree<Curve>();

    bool temp = false;
    double area = 0.0;

    for( int i = 0; i < voronoiCount; ++i )
    {

      var path = new GH_Path(i);

      var voro = voronoiIn[i];

      tempJagged[i] = new Curve[gridCount][];
      boolJagged[i] = new bool[gridCount];

      System.Threading.Tasks.Parallel.For(0, gridCount, j =>
        {

        tempJagged[i][j] = Curve.CreateBooleanIntersection(voro, gridIn[j].ToNurbsCurve(), 1e-8);

        if( tempJagged[i][j].Length > 0 )
        {

          area = AreaMassProperties.Compute(tempJagged[i][j][0]).Area;

          temp = area < areaIn ? false : true;

          boolJagged[i][j] = temp;

        }

        else
        {

          boolJagged[i][j] = false;

        }

        });

      for( int j = 0; j < boolJagged[i].Length; ++j )
      {

        if( boolJagged[i][j] == true )
        {

          treeOut.Add(gridIn[j]);


        }

      }
      
    }

    culledGrid = treeOut;
# ---------- end spacepartitioninternalparallel ----------
parallelregionintersection = CSharpScript()  # -> out, A; inputs CurvesA: list of Curve, CurvesB: list of Curve; disabled
# ---------- parallelregionintersection: C# ----------
    Curve[][][] tempJagged = new Curve[CurvesA.Count][][];
    var treeOut = new List<Curve>();

    for( int i = 0; i < CurvesA.Count; ++i )
    {

      var voro = CurvesA[i];

      tempJagged[i] = new Curve[CurvesB.Count][];

      System.Threading.Tasks.Parallel.For(0, CurvesB.Count, j =>
        {

        tempJagged[i][j] = Curve.CreateBooleanIntersection(voro, CurvesB[j], 1e-3);

        });

      for( int j = 0; j < tempJagged[i].Length; ++j )
      {

        for( int k = 0; k < tempJagged[i][j].Length; ++k )
        {

          var path = new GH_Path(i);

          treeOut.Add(tempJagged[i][j][k]);


        }

      }

    }

    A = treeOut;
# ---------- end parallelregionintersection ----------
pline = PolyLine(Vertices=pathfinding, Closed=False)  # disabled

# ---- group: InputData / Labels
txt = Text(Tree({0;0}: ["Unidades sanitarias mujeres / privadas"], {0;1}: ["Unidades sanitarias hombres / privadas"], {0;2}: ["Cuarto de aseo "], {0;3}: ["Área de aseo de residuos"], {0;4}: ["Almacen General Insumos de Aseo "], {0;5}: ["Área de UPC-Rack"]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))

# ---- group: InputData / Topology
int = Integer(Tree({0}: [7], {1}: [7], {2}: [3], {3}: [2, 11], {4}: [16, 21, 19], {5}: [19]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))

# ---- group: InputData / ID
txt_2 = Text(Tree({0;0}: ["5"], {0;1}: ["5"], {0;2}: ["5"], {0;3}: ["5"], {0;4}: ["5"], {0;5}: ["5"]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))

# ---- group: InputData / Areas
txt_3 = Text(Tree({0;0}: ["3"], {0;1}: ["3"], {0;2}: ["6"], {0;3}: ["1"], {0;4}: ["5"], {0;5}: ["4"]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))

# ---- group: InputData
number_slider_2 = Slider(1, range=0..10)
path_mapper = PathMapper(txt, source="{A;B}", target="{A}")
path_mapper_2 = PathMapper(txt_3, source="{A;B}", target="{A}")
path_mapper_3 = PathMapper(int, source="{A;B}", target="{A}")
path_mapper_4 = PathMapper(txt_2, source="{A;B}", target="{A}")
prunebranches = CSharpScript(branches=path_mapper, howMany=number_slider_2)  # -> prunedTree, branchCounter; inputs branches: tree of String, howMany: Int32
# ---------- prunebranches: C# ----------
    var treeOut = new DataTree<string>();

    for( int i = 0; i < branches.BranchCount - howMany; ++i )
      treeOut.AddRange(branches.Branch(i), new GH_Path(i));

    prunedTree = treeOut;
    branchCounter = treeOut.BranchCount;
# ---------- end prunebranches ----------
prunebranches_2 = CSharpScript(branches=path_mapper_2, howMany=number_slider_2)  # -> prunedTree, branchCounter; inputs branches: tree of String, howMany: Int32; same code as prunebranches
ma = MassAddition(Input=prunebranches_2.prunedTree)  # -> Result, PartialResults
flatten = FlattenTree(Tree=prunebranches_2.prunedTree, Path="{0}")
lng = ListLength(List=flatten)
int_2 = Integer(Slider(4, range=0..10))

# ---- group: Grid / Controllers
number_slider_3 = Slider(20, range=0..21)
number_slider_4 = Slider(4, range=0..5)
number_slider_5 = Slider(6, range=0..10)  # disabled
number_slider_6 = Slider(1, range=0..30)  # disabled
division = Division(A=number_slider_3, B=number_slider_5)  # disabled
division_2 = Division(A=number_slider_4, B=number_slider_6)  # disabled
number_slider_7 = Slider(0, range=0..1)  # disabled

# ----
pt = Point(Point(-30.22731102, -18.72041778, 0))  # disabled
pt_2 = Point(Point(-23.83729354, 16.36997504, 0))  # disabled
number_slider_8 = Slider(1, range=0..1)
number_slider_9 = Slider(0.5, range=0..1)
number_slider_10 = Slider(0, range=0..1)
Z = UnitZ(Factor=1)

# ---- group: Voronoi / Controllers
seedsx = GenePool(
    Decimals=4,
    Maximum=1,
    Minimum=0,
    Value=[1, 0.9619, 0.8486, 0.5935, 0, 0.4555, 0.5736, 0.413, 0.0394, 0.8345, 0.1985, 1, 0, 0.8929, 0.474, 0.156, 0, 0.0778, 0.5616, 0.8085, 0.2722, 0.1816, 1, 0.8818, 0.2285])
seedsy = GenePool(
    Decimals=4,
    Maximum=1,
    Minimum=0,
    Value=[0.7383, 0, 0.5811, 0.1416, 0.4559, 0.3962, 0.6995, 0.8896, 0.9707, 0.9041, 0.2249, 0.2287, 0, 0.3339, 0.3498, 0.1315, 0.4636, 0.0994, 0.6014, 0.8461, 0.9088, 0.3197, 0, 1, 0.7524])

# ----
number_slider_11 = Slider(1000, range=0..1000)  # disabled
number_slider_12 = Slider(0, range=0..1000)  # disabled
number_slider_13 = Slider(0, range=0..1000)  # disabled
number_slider_14 = Slider(9, range=0..10)
number_slider_15 = Slider(2.61, range=0..10)
number_slider_16 = Slider(-5.701, range=-10..10)
crv = Curve(<curve referenced from the Rhino model>)
disc = Discontinuity(Curve=crv, Level=1)  # -> Points, Parameters
del = DelaunayMesh(Points=disc.Points, Plane=PlaneXY(0, 0, 0))
explode = MeshExplode(Mesh=del, Interpolate=False)
number_slider_17 = Slider(8, range=0..10)
series = Series(Start=0, Step=1, Count=Slider(6, range=0..100))  # -> expr("-x", Series)
rgb = ColourRGB(Alpha=255, Red=number_slider_11, Green=number_slider_12, Blue=number_slider_13)  # disabled
series_2 = Series(Start=Slider(1, range=0..1), Step=Slider(3.341, range=0..10), Count=Slider(13, range=0..100))
number_slider_18 = Slider(5, range=0..10)  # disabled
mcx = MeshCurve(Mesh=explode, Curve=crv)  # -> Points, Faces
offset = OffsetCurve(Curve=crv, Distance=series, Plane=PlaneXY(0, 0, 0), Corners=1)
polyoffset = PolylineOffset(
    Polylines=crv,
    Distance=series_2,
    Plane=Plane(origin=(0, 0, 0), x=(0, 0, 0), y=(0, 0, 0)),
    Tolerance=0.01,
    ClosedFillet=1,
    OpenFillet=1,
    Miter=2)  # -> Contour, Holes
crv_2 = Curve(polyoffset.Holes)
flatten_2 = FlattenTree(Tree=crv_2, Path="{0}")
disc_2 = Discontinuity(Curve=crv_2, Level=3)  # -> Points, Parameters
lng_2 = ListLength(List=flatten_2)
division_3 = Division(A=lng_2, B=Slider(10, range=0..10))
cdiv = Derivatives(Curve=crv_2, Parameter=disc_2.Parameters)  # -> Point, FirstDerivative
partition = PartitionList(List=flatten_2, Size=division_3)
xprod = CrossProduct(VectorA=Z, VectorB=cdiv.FirstDerivative, Unitize=False)  # -> Vector, Length
boundary = BoundarySurfaces(Edges=flatten(crv_2))
boundary_2 = BoundarySurfaces(Edges=partition)
vdis = VectorDisplay(Anchor=cdiv.Point, Vector=unitize(xprod.Vector))
area = Area(Geometry=boundary, UseTasks=False)  # -> Area, Centroid
shatter = Shatter(Curve=crv_2, Parameters=disc_2.Parameters)  # -> simplify(Segments)
c_script = CSharpScript(Points=disc_2.Points, y=number_slider_14)  # -> out, A; inputs Points: tree of Point3d, y: Int32
# ---------- c_script: C# usings ----------
using Rhino.Collections;
# ---------- c_script: C# ----------
    DataTree<Point3d> pointsOut = new DataTree<Point3d>();

    int size = Points.BranchCount;

    //Point3d.ClosestPointInList();

    //double minDistance = double.MaxValue, tempDist = 0.0;

    for( int i = 1; i < size; ++i )
    {

      for( int j = 0; j < Points.Branch(i).Count; ++j )
      {

        //pointsOut.Add(Point3dList.ClosestPointInList(Points.Branch(i - 1), Points.Branch(i)[j]), new GH_Path(j));
        pointsOut.Add(Points.Branch(i)[j], new GH_Path(j));


      }

    }

    A = pointsOut;

/*
    //    Polyline[] poly = new Polyline[size];

    DataTree<Point3d> pointsOut = new DataTree<Point3d>();

    for( int i = 0; i < size; ++i )
    {

      for( int j = 0; j < Points.Branch(i).Count; ++j )
      {


        pointsOut.Add(Points.Branch(i)[j], new GH_Path(j));

        //        poly[i] = new Polyline(Points.Branch(i)[j]);

      }

    }

    A = pointsOut;*/
# ---------- end c_script ----------
flatten_3 = FlattenTree(Tree=shatter, Path="{0}")
pline_2 = PolyLine(Vertices=c_script.A, Closed=True)
end = EndPoints(Curve=shatter)  # -> Start, End
item = ListItem(List=disc_2.Points, Index=Slider(0, range=0..100), Wrap=True)  # -> Item, Item1, Item2, Item3
points = PointList(Points=c_script.A, Size=number_slider_15)
null = NullItem(Item=disc_2.Points)  # -> NullFlags, InvalidFlags, Description
bang = ExplodeTree(Data=simplify(disc_2.Points))  # -> Branch0, Branch1, Branch2, Branch3, Branch4, Branch5, Branch6, Branch7, Branch8, Branch9
bang_2 = ExplodeTree(Data=c_script.A)  # -> Branch0, Branch1, Branch2, Branch3, Branch4, Branch5, Branch6, Branch7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
item_2 = ListItem(List=end.Start, Index=Slider(10, range=0..10), Wrap=True)  # -> Item, Item1, Item2, Item3
ccx = CurveCurve(CurveA=polyoffset.Holes, CurveB=crv)  # -> Points, ParamsA, ParamsB
points_2 = PointList(Points=disc_2.Points, Size=number_slider_15)
cull = CullPattern(List=flatten(disc_2.Points), CullPattern=invert(flatten(null.NullFlags)))
pline_3 = PolyLine(Vertices=flatten(item.Item), Closed=False)
pline_4 = PolyLine(Vertices=flatten(item.Item1), Closed=False)
pline_5 = PolyLine(Vertices=flatten(item.Item2), Closed=False)
pline_6 = PolyLine(Vertices=flatten(item.Item3), Closed=False)
pt_3 = Point([bang.Branch7, bang.Branch6, bang.Branch8])
pt_4 = Point(bang_2.Branch10)
item_3 = ListItem(List=disc_2.Points, Index=Slider(19, range=0..100), Wrap=True)  # -> Item, Item1, Item2, Item3
null_2 = NullItem(Item=mcx.Points)  # -> NullFlags, InvalidFlags, Description
wbdual = WeaverbirdsDualGraph(MeshCurves=del, DualMode=0)
medges = MeshEdges(Mesh=explode)  # -> NakedEdges, InteriorEdges, NonManifoldEdges
dispatch = Dispatch(List=graft(explode), DispatchPattern=null_2.NullFlags)  # -> ListA, ListB
c_script_2 = CSharpScript(Points=disc_2.Points, y=number_slider_14)  # -> out, A; inputs Points: tree of Point3d, y: Int32
# ---------- c_script_2: C# ----------
    DataTree<Point3d> pointsOut = new DataTree<Point3d>();

    int size = Points.BranchCount;

    //Point3d.ClosestPointInList();

    double minDistance = double.MaxValue, tempDist = 0.0;
    Point3d point = new Point3d();

    for( int i = 1; i < size; ++i )
    {

      for( int j = 0; j < Points.Branch(i).Count; ++j )
      {

        //pointsOut.Add(Point3dList.ClosestPointInList(Points.Branch(i - 1), Points.Branch(i)[j]), new GH_Path(j));
        point = Points.Branch(i)[j];
        tempDist = point.DistanceTo( Points.Branch(i - 1)[j] );
        minDistance = Math.Min( minDistance, tempDist );
        
        if( minDistance == point.DistanceTo( Points.Branch(i - 1)[j] ) )
        {
        
          Print(minDistance.ToString());
          //pointsOut.Add( point, new GH_Path(j) );

        }
          
      }
      
      minDistance = double.MaxValue;
      tempDist = 0.0;

    }

    A = pointsOut;

/*
    //    Polyline[] poly = new Polyline[size];

    DataTree<Point3d> pointsOut = new DataTree<Point3d>();

    for( int i = 0; i < size; ++i )
    {

      for( int j = 0; j < Points.Branch(i).Count; ++j )
      {


        pointsOut.Add(Points.Branch(i)[j], new GH_Path(j));

        //        poly[i] = new Polyline(Points.Branch(i)[j]);

      }

    }

    A = pointsOut;*/
# ---------- end c_script_2 ----------
c_script_3 = CSharpScript(Points=pt_3, y=number_slider_14)  # -> out, A; inputs Points: tree of Point3d, y: Int32
# ---------- c_script_3: C# ----------
    DataTree<Point3d> pointsOut = new DataTree<Point3d>();
    
    int size = Points.BranchCount;

    //Point3d.ClosestPointInList();
    
    //double minDistance = double.MaxValue, tempDist = 0.0;
    
    for( int i = 0; i < size; ++i )
    {
    
      for( int j = 0; j < Points.Branch(i).Count; ++j )
      {
      
        pointsOut.Add( Point3dList.ClosestPointInList( Points.Branch(i), Points.Branch(i)[j] ), new GH_Path(j) );
      
      }
    
    }
    
    A = pointsOut;

/*
    //    Polyline[] poly = new Polyline[size];

    DataTree<Point3d> pointsOut = new DataTree<Point3d>();

    for( int i = 0; i < size; ++i )
    {

      for( int j = 0; j < Points.Branch(i).Count; ++j )
      {


        pointsOut.Add(Points.Branch(i)[j], new GH_Path(j));

        //        poly[i] = new Polyline(Points.Branch(i)[j]);

      }

    }

    A = pointsOut;*/
# ---------- end c_script_3 ----------
crv_3 = Curve(polyoffset.Holes)
points_3 = PointList(Points=cull)
pline_7 = PolyLine(Vertices=flatten(item_3.Item), Closed=False)
pline_8 = PolyLine(Vertices=flatten(item_3.Item1), Closed=False)
pline_9 = PolyLine(Vertices=flatten(item_3.Item2), Closed=False)
pline_10 = PolyLine(Vertices=flatten(item_3.Item3), Closed=False)
pline_11 = PolyLine(Vertices=flatten(cull), Closed=False)
pline_12 = PolyLine(Vertices=pt_4, Closed=False)
number_slider_19 = Slider(0, range=0..100)
pline_13 = PolyLine(Vertices=pt_3, Closed=True)
points_4 = PointList(Points=pt_4, Size=number_slider_15)
explode_2 = Explode(Curve=crv, Recursive=True)  # -> Segments, Vertices
flatten_4 = FlattenTree(Tree=disc_2.Points, Path="{0}")
points_5 = PointList(Points=c_script_2.A, Size=number_slider_15)
num = Number(ma.Result)
del_2 = DelaunayMesh(Points=flatten_4, Plane=PlaneXY(0, 0, 0))
mesh = Mesh(dispatch.ListA)
number_slider_20 = Slider(7.87, range=0..10)
pline_14 = PolyLine(Vertices=c_script_2.A, Closed=True)
pline_15 = PolyLine(Vertices=c_script_3.A, Closed=True)
prox = Proximity2D(
    Points=flatten_4,
    Plane=PlaneXY(0, 0, 0),
    Group=Slider(10, range=0..10),
    MinRadius=Slider(0, range=0..20),
    MaxRadius=Slider(100, range=0..100))  # -> flatten(Links), Topology
hull = ConvexHull(Points=flatten_4, Plane=PlaneXY(0, 0, 0))  # -> Hull, HullZ, Indices
voronoi = Voronoi(Points=flatten_4, Radius=number_slider_20, BruteForceOverride=False)
cir = Circle(Plane=flatten_4, Radius=number_slider_20)

# ----
# ATTENTION: Be sure there are no duplicate segments!
crv_4 = Curve(flatten(explode_2.Segments))
y_bounds = Domain(Domain(-180, 180))
grid_divisions = Integer(Slider(38, range=0..100))
x_bounds = Domain(Domain(-200, 200))

intercull = IntersectionCulling(CurvesToCull=flatten(prox.Links), BoundaryCurve=crv)  # disabled
area_2 = Area(Geometry=crv)  # -> Area, Centroid
panel = Panel(c_script_2.out)
reconstruct = ReconstructCurve(CurvesIn=flatten(prox.Links))  # disabled
cut = CutCorners(CurvesToSplit=prox.Links)  # disabled
spctopo = SpaceTopology(Curves=voronoi)
dom² = Domain²(DomainU=x_bounds, DomainV=y_bounds)
disc_3 = Discontinuity(Curve=crv, Level=1)  # -> Points, Parameters
ln = Line(StartPoint=area_2.Centroid, EndPoint=disc_3.Points)

# ---- group: PREVIEW SUBDIV GRID
divide = DivideDomain²(Domain=dom², UCount=grid_divisions, VCount=grid_divisions)
dom = Domain²Components(Domain=divide)  # -> UComponent, VComponent
rectangle = Rectangle(Plane=PlaneXY(0, 0, 0), XSize=dom.UComponent, YSize=dom.VComponent, Radius=0)  # -> Rectangle, Length
preview = CustomPreview(Geometry=rectangle.Rectangle, Shader=ColourSwatch(SwatchColor=RGB(217, 217, 217)))

# ----
shatter_2 = Shatter(Curve=crv, Parameters=disc_3.Parameters)
lng_3 = ListLength(List=spctopo)  # -> flatten(Length)
shift = ShiftList(List=ln, Shift=1, Wrap=True)
Z_2 = UnitZ(Factor=1)
cdiv_2 = Derivatives(Curve=crv, Parameter=disc_3.Parameters)  # -> Point, FirstDerivative
linetopo = LineTopology(PointTree=graft(flatten_4), Topology=spctopo)  # -> flatten(LineTopology)
angle = Angle(VectorA=ln, VectorB=shift)  # -> Angle, Reflex
hem_open_xy_networks = VBScript(seg=flatten(crv_4), bnd=dom², sbdv=grid_divisions)  # -> out, flatten(e), flatten(eOV), flatten(ePE), flatten(eNE), flatten(eTE), flatten(eIF), flatten(v)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; inputs seg: list of Curve; disabled
# ---------- hem_open_xy_networks: VB ----------
    'Definition originally written For
    '  codeQuotidien.wordpress.org
    '  Trevor Patt
    '  trpatt@gmail.com

    '  Creative Commons:  Attribution/NonCommercial/ShareAlike

    '  Implementation of Half-Edge Mesh based on
    '    Computational Geometry: Algorithms and Applications
    '    (de Berg, Cheong, van Kreveld, and Overmas, 2008. Chapter 2)
    '    books.google.ch: http://goo.gl/vBq40



    Dim edgeList As New list(Of Line)
    Dim eOVlist As New dataTree(Of int32)
    Dim ePElist As New dataTree(Of int32)
    Dim eNElist As New dataTree(Of int32)
    Dim eTElist As New list(Of int32)
    Dim eIFlist As New list(Of int32)
    Dim vtxList As New list(Of point3d)
    Dim vIElist As New list(Of int32)
    Dim fList As New datatree(Of point3d)
    Dim fIElist As New dataTree(Of int32)

    Dim vIEall As New dataTree(Of int32)
    Dim eF As New list(Of Boolean)

    Dim eDegList As New List(Of Double)

    '********FOR EACH SEGMENT, ADD EDGE AND ITS REVERSE (twin) TO edgeList********
    Dim segCt As int32 = 0
    For i As int32=0 To seg.count - 1
      If seg(i).pointAtStart.distanceto(seg(i).pointAtEnd) > 0 Then
        edgeList.add(New Line(seg(i).pointAtStart, seg(i).pointAtEnd))
        edgeList.add(New Line(seg(i).pointAtEnd, seg(i).pointAtStart))
        eTEList.add((segCt * 2) + 1)
        eTEList.add((segCt * 2))
        'DEFAULT SETTING FOR ef IS TRUE (ie EDGE NEEDS TO BE ASSIGNED TO A FACE)
        ef.add(True)
        ef.add(True)
        eIFlist.add(-10)
        eIFlist.add(-10)

        EdgeDirection(edgeList(edgeList.count - 2), eDegList)
        segCt += 1
      End If
    Next

    Dim vtxTree As New dataTree(Of point3d)
    Dim vNdxTree As New dataTree(Of Int32)
    For i As int32=0 To sbdv - 1
      For j As int32=0 To sbdv - 1
        vtxTree.ensurepath(New gh_path(i, j))
        vNdxTree.ensurepath(New gh_path(i, j))
      Next
    Next


    '********CONSTRUCT VERTEX LIST FROM LIST OF HALF-EDGES********
    For i As int32=0 To edgeList.count - 1
      'boolCk = (is there a close point?, what is the index)
      Dim boolCk() As int32 = {0,-10}

      Dim vCt As int32 = vtxTree.datacount
      CheckLinePt(edgeList(i), vtxTree, vNdxTree, boolCk, bnd, sbdv, 0)

      'IF A NEW VERTEX WAS ADDED, THEN ADD EDGE INDEX TO vIE, vIEall, AND eOV
      If vtxTree.datacount > vCt Then
        vIElist.add(i)
        vIEall.add(i, New GH_Path(boolCk(1)))
        eOVlist.add(boolCk(1), New GH_Path(i))

      Else If boolCK(1) >= 0 Then
        vIEall.add(i, New GH_Path(boolCK(1)))
        eOVlist.add(boolCK(1), New GH_Path(i))
      End If
    Next



    '********FROM EACH HALF-EDGE..
    For i As int32=0 To edgeList.count - 1
      Dim boolCk() As int32 = {0,-10}
      'FIND VERTEX CORRESPONDING TO ENDPOINT (=boolCk(1))
      CheckLinePt(edgeList(i), vtxTree, vNdxTree, boolCk, bnd, sbdv, 1)

      'boolCk(1)=TARGET VERTEX, CHECK ANGLE OF ALL EDGES LEAVING THIS VERTEX
      Dim nxtVtxPth As New gh_path(boolCk(1))
      Dim angCk As Double = -100
      Dim ndx As int32 = -10
      'Dim xProd As vector3d = vector3d.CrossProduct(edgeList(i).direction, vector3d.ZAxis)



      '..FIND NEXT EDGE********
      For j As int32=0 To vIEall.branch(nxtVtxPth).count - 1
        If i <> eTElist(vIEall(nxtVtxPth, j)) Then
          Dim ang As Double = eDegList(eTElist(i)) - eDegList(vIEall(nxtVtxPth, j))
          If ang < 0 Then ang += 360
          If ang > angCk  Then
            angCk = ang
            ndx = j
          End If
        End If
      Next

      If ndx >= 0 Then
        eNElist.add(vIEall(nxtVtxPth, ndx), New GH_Path(i))
        ePElist.add(i, New GH_Path(vIEall(nxtVtxPth, ndx)))
      Else
        'NO NEXT EDGE FOUND, THEN NEXT EDGE IS TWIN
        angCk = math.PI
        ndx = eTElist(i)
        eNElist.add(eTElist(i), New GH_Path(i))
        ePElist.add(i, New GH_Path(eTElist(i)))
      End If
    Next



    '********FIND EDGE-LOOPS / 'FACES'********
    Dim faceCt As int32 = 0
    For i As int32=0 To edgeList.count - 1
      If ef(i) Then
        fList.add(edgeList(i).pointAt(0), New gh_path(faceCt))
        fIEList.add(i, New gh_path(faceCt))
        eIFlist(i) = faceCt
        ef(i) = False
        loopFace(edgeList, ef, eNElist, eNElist(New GH_Path(i), 0), i, fIElist, fList, eIFlist, faceCt)
        faceCt += 1
      End If
    Next


    '********CONVERT vtxTree (SORTED IN BRANCHES BY LOCATION IN GRID)TO LIST (IN ORDER OF INDEX VALUE)********
    For i As int32=0 To vtxTree.datacount - 1
      vtxList.add(Nothing)
    Next
    For i As int32=0 To vtxTree.datacount - 1
      Dim sortNdx As int32 = vNdxTree.alldata(i)
      vtxList(sortNdx) = vtxTree.alldata(i)
    Next

    e = edgeList
    eOV = eOVlist
    eNE = eNElist
    ePE = ePElist
    eTE = eTElist
    eIF = eIFlist
    v = vtxList ' vtxTree
    vIE = vIEall
    f = fList
    fIE = fIElist

    '********PRINT HEM STATS********
    print(vtxList.count & " vertices")
    print(faceCt & " faces")
    print(edgeList.count & " ½ edges")
# ---------- hem_open_xy_networks: VB additional code ----------
  Sub CheckLinePt(ByVal eCurr As Line, ByRef vTree As datatree(Of point3d), ByRef nTree As datatree (Of int32), ByRef ck As Array, ByVal dom As UVInterval, ByVal div As int32, ByVal t As Double)
    'WHEN t=0: CHECKING START POINT; WHEN t=1: CHECKING END POINT
    Dim ptCk As New point3d(eCurr.PointAt(t))

    'POINT VALUE (MINUS DOMAIN STARTING POINT) DIVIDED BY STEP, FLOORED
    Dim pthX As int32 = Math.floor((ptCk.X - dom.u0) / ((dom.U1 - dom.U0) / div))
    Dim pthY As int32 = Math.floor((ptCk.y - dom.v0) / ((dom.v1 - dom.v0) / div))
    pthX = math.min(math.Max(pthX, 0), div - 1)
    pthY = math.min(math.Max(pthY, 0), div - 1)
    Dim pthXY As New gh_path(pthX, pthY)
    ck(1) = -10

    'CHECK ALREADY ADDED NODES
    If vTree.pathExists(pthXY) Then
      For j As int32=0 To vTree.branch(pthXY).count - 1
        If ptCk.DistanceTo(vTree(pthXY, j)) < .1 Then
          ck(0) += 1
          ck(1) = nTree(pthXY, j)
          Exit For
        End If
      Next
    End If

    'IF NOT ALREADY ADDED, THEN ADD
    If  ck(0) = 0 AndAlso ck(1) < 0 Then
      ck(1) = vTree.datacount
      nTree.add(vTree.datacount, pthXY)
      vTree.add(ptCk, pthXY)
    End If

  End Sub


  Sub EdgeDirection(ByRef eCurr As Line, ByRef degList As List(Of Double))
    'FIND DIRECTION OF EDGE
    Dim deg As Double
    If eCurr.direction.x = 0 Then
      deg = (90 * (eCurr.Direction.Y / math.abs(eCurr.Direction.Y))) + 360
      deg = (360 + deg) Mod 360
    Else
      deg = ((math.atan(eCurr.Direction.Y / eCurr.Direction.x)) * 180 / math.PI)
      If eCurr.Direction.X < 0 Then deg = 180 + deg
      If eCurr.Direction.X > 0  Then deg = (360 + deg) Mod 360
    End If

    degList.add(deg)
    degList.add((deg + 180) Mod 360)
  End Sub


  Sub loopFace(ByVal eList As list(Of line), ByRef ck As list(Of Boolean), ByVal eNE As datatree(Of int32), ByVal n As int32, ByVal init As int32, ByRef fList As datatree(Of int32), ByRef f As datatree(Of point3d), ByRef efList As List(Of int32), ByRef ct As int32)
    If n <> init Then
      f.add(eList(n).pointAt(0), New gh_path(ct))
      fList.add(n, New gh_path(ct))
      efList(n) = ct
      ck(n) = False
      loopFace(eList, ck, eNE, eNE(New GH_Path(n), 0), init, fList, f, efList, ct)
    End If
  End Sub
# ---------- end hem_open_xy_networks ----------
points_6 = PointList(Points=disc_3.Points, Size=Slider(10, range=0..10))
xprod_2 = CrossProduct(VectorA=cdiv_2.FirstDerivative, VectorB=Z_2, Unitize=False)  # -> expr("-x", unitize(Vector)), Length
c_script_4 = CSharpScript(Lines=explode_2.Segments)  # -> out, A; inputs Lines: list of Line
# ---------- c_script_4: C# ----------
    double angle = 0.0;
    
    for( int i = 0; i < Lines.Count - 1; ++i )
    {
    
      EdgeDirection( Lines[i], ref angle );
      Print( angle.ToString() );
    
    }
# ---------- c_script_4: C# additional code ----------
  public void EdgeDirection(Line eCurr, ref double angle)
  {
    // FIND DIRECTION OF EDGE
    //double angle;
    if (eCurr.Direction.X == 0)
    {
      angle = 90 * (eCurr.Direction.Y / Math.Abs(eCurr.Direction.Y)) + 360;
      angle = (360 + angle) % 360;
    }
    else
    {
      angle = Math.Atan(eCurr.Direction.Y / eCurr.Direction.X) * 180 / Math.PI;
      if (eCurr.Direction.X < 0)
        angle = 180 + angle;
      if (eCurr.Direction.X > 0)
        angle = (360 + angle) % 360;
    }

  }
# ---------- end c_script_4 ----------
deg = Degrees(Radians=angle.Angle)
join = JoinCurves(Curves=linetopo, Preserve=False)
polyoffset_2 = PolylineOffset(
    Polylines=crv,
    Distance=Slider(10.001, range=-10..10.001),
    Plane=Plane(origin=(0, 0, 0), x=(0, 0, 0), y=(0, 0, 0)),
    Tolerance=0.01,
    ClosedFillet=1,
    OpenFillet=1,
    Miter=2)  # -> Contour, Holes
panel_2 = Panel(c_script_4.out)
move = Move(Geometry=disc_3.Points, Motion=xprod_2.Vector)  # -> Geometry, Transform
expression = Expression(x=lng_3, y=Slider(0, range=0..10), Expression="If( x > y, True, False )")
cut_2 = CutCorners(CurvesToSplit=join)
tag = TextTag(Location=disc_3.Points, Text=deg)
c_script_5 = CSharpScript(seg=crv_4, bnd=dom², sbdv=grid_divisions)  # -> out, flatten(e), flatten(eOV), flatten(ePE), flatten(eNE), flatten(eTE), flatten(eIF), flatten(v)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; inputs seg: list of Curve, sbdv: Int32
# ---------- c_script_5: C# ----------
    List<Line> edgeList = new List<Line>();
    DataTree<int> eOVList = new DataTree<int>();
    DataTree<int> ePEList = new DataTree<int>();
    DataTree<int> eNEList = new DataTree<int>();
    List<int> eTEList = new List<int>();
    List<int> eIFList = new List<int>();
    List<Point3d> vtxList = new List<Point3d>();
    List<int> vIEList = new List<int>();
    DataTree<Point3d> fList = new DataTree<Point3d>();
    DataTree<int> fIEList = new DataTree<int>();
    DataTree<int> vIEall = new DataTree<int>();
    List<bool> eF = new List<bool>();
    List<double> eDegList = new List<double>();
    int segCt = 0;
    for( int i = 0; i <= seg.Count - 1; ++i )
    {

      if( seg[i].PointAtStart.DistanceTo(seg[i].PointAtEnd) > 0 )
      {
        edgeList.Add(new Line(seg[i].PointAtStart, seg[i].PointAtEnd));
        edgeList.Add(new Line(seg[i].PointAtEnd, seg[i].PointAtStart));
        eTEList.Add(((segCt * 2)
          + 1));
        eTEList.Add((segCt * 2));
        // DEFAULT SETTING FOR ef IS TRUE (ie EDGE NEEDS TO BE ASSIGNED TO A FACE)
        eF.Add(true);
        eF.Add(true);
        eIFList.Add(-10);
        eIFList.Add(-10);
        EdgeDirection(edgeList[edgeList.Count - 2], eDegList);
        //EdgeDirection(edgeList((edgeList.Count - 2)), eDegList);
        segCt++;

      }

    }

    DataTree<Point3d> vtxTree = new DataTree<Point3d>();
    DataTree<int> vNdxTree = new DataTree<int>();
    for( int i = 0; i <= sbdv - 1; i++ )
    {
      for( int j = 0; j <= sbdv - 1; j++ )
      {

        vtxTree.EnsurePath(new GH_Path(i, j));
        vNdxTree.EnsurePath(new GH_Path(i, j));

      }

    }

    // ********CONSTRUCT VERTEX List FROM List OF HALF-EDGES********
    for( int i = 0; i <= edgeList.Count - 1; i++ )
    {
      // boolCk = (is there a close point?, what is the index)
      int[] boolCk = {0,-10};
      int vCt = vtxTree.DataCount;
      CheckLinePt(edgeList[i], ref vtxTree, ref vNdxTree, ref boolCk, bnd, sbdv, 0);
      // IF A NEW VERTEX WAS AddED, THEN Add EDGE INDEX TO vIE, vIEall, AND eOV
      if ((vtxTree.DataCount > vCt)) {
        vIEList.Add(i);
        vIEall.Add(i, new GH_Path(boolCk[1]));
        eOVList.Add(boolCk[1], new GH_Path(i));
      }
      else if ((boolCk[1] >= 0)) {
        vIEall.Add(i, new GH_Path(boolCk[1]));
        eOVList.Add(boolCk[1], new GH_Path(i));
      }

    }

    // ********FROM EACH HALF-EDGE..
    for (int i = 0; i <= edgeList.Count - 1; i++) {
      int[] boolCk = {0, -10};
      // FIND VERTEX CORRESPONDING TO ENDPOINT (=boolCk(1))
      CheckLinePt(edgeList[i], ref vtxTree, ref vNdxTree, ref boolCk, bnd, sbdv, 1);
      // boolCk(1)=TARGET VERTEX, CHECK ANGLE OF ALL EDGES LEAVING THIS VERTEX
      GH_Path nxtVtxPth = new GH_Path(boolCk[1]);
      double angCk = -100;
      int ndx = -10;
      // Dim xProd As vector3d = vector3d.CrossProduct(edgeList(i).direction, vector3d.ZAxis)
      // ..FIND NEXT EDGE********
      for( int j = 0; j <= vIEall.Branch(nxtVtxPth).Count - 1; j++)
      {

        if( i != eTEList[vIEall.Branch(nxtVtxPth)[j]] )
        {

          double ang = eDegList[eTEList[i]] - eDegList[vIEall.Branch(nxtVtxPth)[j]];
          if( ang < 0 )
          {

            ang += 360;

          }

          if( ang > angCk )
          {

            angCk = ang;
            ndx = j;

          }

        }

      }

      if ((ndx >= 0)) {
        eNEList.Add(vIEall.Branch(nxtVtxPth)[ndx], new GH_Path(i));
        ePEList.Add(i, new GH_Path(vIEall.Branch(nxtVtxPth)[ndx]));
      }
      else {
        // NO NEXT EDGE FOUND, THEN NEXT EDGE IS TWIN
        angCk = Math.PI;
        ndx = eTEList[i];
        eNEList.Add(eTEList[i], new GH_Path(i));
        ePEList.Add(i, new GH_Path(eTEList[i]));
      }

    }

    int faceCt = 0;
    for (int i = 0; i <= edgeList.Count - 1; ++i )
    {

      if( eF[i] )
      {

        fList.Add(edgeList[i].PointAt(0), new GH_Path(faceCt));
        fIEList.Add(i, new GH_Path(faceCt));
        eIFList[i] = faceCt;
        eF[i] = false;
        loopFace(edgeList, ref eF, eNEList, eNEList.Branch(i)[0], i, ref fIEList, ref fList, ref eIFList, ref faceCt);
        faceCt++;

      }

    }

    // ********CONVERT vtxTree (SORTED IN BRANCHES BY LOCATION IN GRID)TO List (IN ORDER OF INDEX VALUE)********
    /*for( int i = 0; i <= vtxTree.DataCount - 1; i++ )
    {

    vtxList.Add(Point3d.Unset);

    }*/
    /*
    for( int i = 0; i <= vtxTree.DataCount - 1; i++ )
    {

    int sortNdx = vNdxTree.AllData();
    vtxList[sortNdx] = vtxTree.AllData();

    }*/

    vtxList.AddRange(fList.Branch(0));

    e = edgeList;
    eOV = eOVList;
    eNE = eNEList;
    ePE = ePEList;
    eTE = eTEList;
    eIF = eIFList;
    v = vtxList;
    //  vtxTree
    vIE = vIEall;
    f = fList;
    fIE = fIEList;
    // ********PRINT HEM STATS********
    Print((vtxList.Count.ToString() + " vertices"));
    Print((faceCt.ToString() + " faces"));
    Print((edgeList.Count.ToString() + " edges"));
# ---------- c_script_5: C# additional code ----------
  public void EdgeDirection(Line eCurr, List<double> degList)
  {
    // FIND DIRECTION OF EDGE
    double deg;
    if (eCurr.Direction.X == 0)
    {
      deg = 90 * (eCurr.Direction.Y / Math.Abs(eCurr.Direction.Y)) + 360;
      deg = (360 + deg) % 360;
    }
    else
    {
      deg = Math.Atan(eCurr.Direction.Y / eCurr.Direction.X) * 180 / Math.PI;
      if (eCurr.Direction.X < 0)
        deg = 180 + deg;
      if (eCurr.Direction.X > 0)
        deg = (360 + deg) % 360;
    }

    degList.Add(deg);
    degList.Add((deg + 180) % 360);

  }

  public void CheckLinePt(Line eCurr, ref DataTree<Point3d> vTree, ref DataTree<int> nTree, ref int[] ck, UVInterval dom, int div, double t)
  {
    // WHEN t=0: CHECKING START POINT; WHEN t=1: CHECKING END POINT
    var ptCk = new Point3d(eCurr.PointAt(t));

    // POINT VALUE (MINUS DOMAIN STARTING POINT) DIVIDED BY STEP, FLOORED
    int pthX = (int) Math.Floor((ptCk.X - dom.U0) / ((dom.U1 - dom.U0) / div));
    int pthY = (int) Math.Floor((ptCk.Y - dom.V0) / ((dom.V1 - dom.V0) / div));
    pthX = Math.Min(Math.Max(pthX, 0), div - 1);
    pthY = Math.Min(Math.Max(pthY, 0), div - 1);
    var pthXY = new GH_Path(pthX, pthY);
    ck[1] = -10;

    // CHECK ALREADY ADDED NODES
    if (vTree.PathExists(pthXY))
    {
      for (int j = 0; j <= vTree.Branch(pthXY).Count - 1; ++j)
      {
        if (ptCk.DistanceTo(vTree[pthXY, j]) < 0.1)
        {
          ck[0] += 1;
          ck[1] = nTree[pthXY, j];
          break;
        }
      }
    }

    // IF NOT ALREADY ADDED, THEN ADD
    if( ck[0] == 0 && ck[1] < 0 )
    {
      ck[1] = vTree.DataCount;
      nTree.Add(vTree.DataCount, pthXY);
      vTree.Add(ptCk, pthXY);
    }
  }

  public void loopFace(List<Line> eList, ref List<bool> ck, DataTree<int> eNE, int n, int init, ref DataTree<int> fList, ref DataTree<Point3d> f, ref List<int> efList, ref int ct)
  {
    if (n != init)
    {
      f.Add(eList[n].PointAt(0), new GH_Path(ct));
      fList.Add(n, new GH_Path(ct));
      efList[n] = ct;
      ck[n] = false;
      loopFace(eList, ref ck, eNE, eNE[new GH_Path(n), 0], init, ref fList, ref f, ref efList, ref ct);
    }
  }

  /*class SurroundingClass
  {
    public void CheckLinePt(Line eCurr, ref DataTree<Point3d> vTree, ref DataTree<int> nTree, ref Array ck, UVInterval dom, int div, double t)
    {
      // WHEN t=0: CHECKING START POINT; WHEN t=1: CHECKING END POINT
      var ptCk = new Point3d(eCurr.PointAt(t));

      // POINT VALUE (MINUS DOMAIN STARTING POINT) DIVIDED BY STEP, FLOORED
      int pthX = Math.Floor((ptCk.X - dom.u0) / ((dom.U1 - dom.U0) / div));
      int pthY = Math.Floor((ptCk.y - dom.v0) / ((dom.v1 - dom.v0) / div));
      pthX = Math.Min(Math.Max(pthX, 0), div - 1);
      pthY = Math.Min(Math.Max(pthY, 0), div - 1);
      var pthXY = new GH_Path(pthX, pthY);
      ck(1) = -10;

      // CHECK ALREADY ADDED NODES
      if (vTree.pathExists(pthXY))
      {
        for (int j = 0, loopTo = vTree.branch(pthXY).count - 1; j <= loopTo; j++)
        {
          if (ptCk.DistanceTo(vTree[pthXY, j]) < 0.1)
          {
            ck(0) += 1;
            ck(1) = nTree[pthXY, j];
            break;
          }
        }
      }

      // IF NOT ALREADY ADDED, THEN ADD
      if (Conversions.ToBoolean(Operators.ConditionalCompareObjectEqual(ck(0), 0, false)) && Conversions.ToBoolean(ck(1) < 0))
      {
        ck(1) = vTree.datacount;
        nTree.Add(vTree.datacount, pthXY);
        vTree.Add(ptCk, pthXY);
      }
    }


    public void EdgeDirection(ref Line eCurr, ref List<double> degList)
    {
      // FIND DIRECTION OF EDGE
      double deg;
      if (eCurr.direction.x == 0)
      {
        deg = 90 * (eCurr.Direction.Y / Math.abs(eCurr.Direction.Y)) + 360;
        deg = (360 + deg) % 360;
      }
      else
      {
        deg = Math.atan(eCurr.Direction.Y / eCurr.Direction.x) * 180 / Math.PI;
        if (eCurr.Direction.X < 0)
          deg = 180 + deg;
        if (eCurr.Direction.X > 0)
          deg = (360 + deg) % 360;
      }

      degList.Add(deg);
      degList.Add((deg + 180) % 360);
    }


    public void loopFace(List<Line> eList, ref List<bool> ck, DataTree<int> eNE, int n, int init, ref DataTree<int> fList, ref DataTree<Point3d> f, ref List<int> efList, ref int ct)
    {
      if (n != init)
      {
        f.Add(eList[n].pointAt(0), new GH_Path(ct));
        fList.Add(n, new GH_Path(ct));
        efList[n] = ct;
        ck[n] = false;
        loopFace(eList, ref ck, eNE, eNE[new GH_Path(n), 0], init, ref fList, ref f, ref efList, ref ct);
      }
    }
  }*/
# ---------- end c_script_5 ----------
line = Line(Line((2.814707438, -1.355663716, 0), (3.419507101, 7.867531141, 0)))
line_2 = Line(Line((-0.1336909177, 4.38993308, 0), (6.594705331, 4.38993308, 0)))

# ---- group: FIND THE BOUNDARY FACE AND EXCLUDE IT
boundary_face = Slider(1, range=0..10)
path = DataPath(boundary_face)
branch = TreeBranch(Tree=c_script_5.f, Path=path, MaintainPaths=True)

# ---- group: DISPLAY HEM EDGES / CULL TWINNED EDGES
cull_2 = CullPattern(List=c_script_5.e, CullPattern=[True, False])

# ---- group: DISPLAY HEM EDGES
Z_3 = UnitZ(Factor=1)
extr = Extrude(Base=cull_2, Direction=Z_3)

# ----
pline_16 = PolyLine(Vertices=move.Geometry, Closed=False)
threshold = Slider(23, range=0..200)
reconstruct_2 = ReconstructCurve(CurvesIn=cut_2)
cull_3 = CullPattern(List=linetopo, CullPattern=expression)
c_script_6 = CSharpScript(x=line, y=line_2)  # -> out, A; inputs x: Curve, y: Curve
# ---------- c_script_6: C# ----------
    Interval interval = new Interval();
    
    var ccx = Curve.PlanarCurveCollision(x, y, Plane.WorldXY, 1e-7);
    
    A = ccx;
# ---------- c_script_6: C# additional code ----------
  public void LineLineIntx(Point3d pt1, Point3d pt2, Point3d pt3, Point3d pt4, ref Interval interval) {
    // via Paul Bourke: http://www-cs.ccny.cuny.edu/~wolberg/capstone/intersection/Intersection%20point%20of%20two%20lines.html
    double denom = ( pt4.Y - pt3.Y ) * ( pt2.X - pt1.X ) - ( pt4.X - pt3.X ) * ( pt2.Y - pt1.Y );

    if( denom != 0 )
    {
      double u1 = ( ( pt4.X - pt3.X ) * ( pt1.Y - pt3.Y ) - ( pt4.Y - pt3.Y ) * ( pt1.X - pt3.X ) ) / denom;
      double u2 = ( ( pt2.X - pt1.X ) * ( pt1.Y - pt3.Y ) - ( pt2.Y - pt1.Y ) * ( pt1.X - pt3.X ) ) / denom;

      interval = new Interval(u1, u2);

    }

  }
# ---------- end c_script_6 ----------

# ---- group: PREVENTS INFINITE LOOPS (ALSO ALLOWS STEPPING THROUGH PROCESS)
threshold_2 = Slider(14, range=0..40)

# ---- group: ARBITRARY VERY HIGH NUMBER
threshold_3 = Integer(1000)

# ----
c_script_7 = CSharpScript(
    e=c_script_5.e,
    eOV=c_script_5.eOV,
    ePE=c_script_5.ePE,
    eNE=c_script_5.eNE,
    v=c_script_5.v,
    vIE=c_script_5.vIE,
    f=c_script_5.f,
    fIE=c_script_5.fIE,
    thr=threshold_3,
    stp=threshold,
    bnd=boundary_face)  # -> out, A, B, C, D; inputs e: list of Line, eOV: list of Int32, ePE: list of Int32, eNE: list of Int32, v: list of Point3d, vIE: tree of Int32, f: tree of Point3d, fIE: tree of Int32, thr: Int32, stp: Int32, bnd: Int32
# ---------- c_script_7: C# ----------
    // Definition originally written For
    // codeQuotidien.wordpress.org
    // Trevor Patt
    // trpatt@gmail.com

    // Creative Commons:  Attribution/NonCommercial/ShareAlike

    var skelAll = new DataTree<Line>();

    var vActive = new List<Point3d>();
    var bisecActive = new List<Vector3d>();
    var eActive = new List<Line>();

    for( int i = 0; i <= fIE.BranchCount - 1; ++i )
    {

      if (i != bnd)
      {

        bisecActive.Clear();
        vActive.Clear();
        eActive.Clear();
        var intxActive = new List<Interval>();

        int e0 = fIE.Branch(i)[0];
        int eCurr = e0;

        int ct = 0;
        do
        {
          var iCtPth = new GH_Path(i, ct);
          // FIND THE INITIAL BISECTING RAYS
          bisecActive.Add(FindBisect(e[ePE[eCurr]], e[eCurr]));
          vActive.Add(v[eOV[eCurr]]);
          eActive.Add(e[ePE[eCurr]]);
          eCurr = eNE[eCurr];
          ct += 1;
        }
        while (eCurr != e0);


        eCurr = e0;

        // CREATE ALL INTERVALS SO THAT THEY CAN BE EDITED ONE VALUE AT A TIME
        for( int j = 0; j <= bisecActive.Count - 1; ++j )

          intxActive.Add(new Interval(thr, thr));

        int bisecCount = bisecActive.Count;

        // FIND INTERSECTION PARAMETERS
        for( int j = 0; j <= bisecCount - 1; ++j )
        {

          var ijPth = new GH_Path(i, j);
          int jPrev = (j + bisecCount - 1) % bisecCount;
          //int jPlus = (j + bisecCount    ) % bisecCount;

          var uu = new Interval(thr, thr);
          LineLineIntx(vActive[j], vActive[j] + bisecActive[j], vActive[jPrev], vActive[jPrev] + bisecActive[jPrev], ref uu);
          /*var vv = new Interval(thr, thr);
          LineLineIntx(vActive[jPlus], vActive[jPlus] + bisecActive[jPlus], vActive[j], vActive[j] + bisecActive[j], ref vv);
          intxActive[jPlus] = new Interval(intxActive[jPlus][0], vv[1]);*/
          intxActive[j] = new Interval(uu[0], intxActive[j][1]);
          intxActive[jPrev] = new Interval(intxActive[jPrev][0], uu[1]);
          //Print( intxActive[jPlus].ToString() + " jPlus" );
          Print(intxActive[j].ToString() + " j");
          Print(intxActive[jPrev].ToString() + " jPrev");

          eCurr = eNE[eCurr];

        }

        eCurr = e0;


        int k = 0;
        int safety = 0;
        bool tri = false;
        int skelCt = 0;
        while( safety < stp && !tri )
        {

          int kPrev = (k + intxActive.Count - 1) % intxActive.Count;
          int kPlus = (k + intxActive.Count ) % intxActive.Count;
          var ikPth = new GH_Path(i, k);
          var iPrevPth = new GH_Path(i, kPrev);

          if( Math.Abs(intxActive[k][0]) <= Math.Abs(intxActive[k][1]) && Math.Abs(intxActive[kPrev][1]) <= Math.Abs(intxActive[kPrev][0]) )
          {

            var skelPth = new GH_Path(skelCt);
            skelAll.Add(new Line(vActive[k], vActive[k] + intxActive[k][0] * bisecActive[k]), fIE.Path(i));
            skelAll.Add(new Line(vActive[kPrev], vActive[k] + intxActive[k][0] * bisecActive[k]), fIE.Path(i));

            // IF THERE IS AN INTERSECTION REMOVE PREVIOUS VERTEX, RAYS, REPLACE WITH NEW
            vActive[kPrev] = vActive[kPrev] + intxActive[kPrev][1] * bisecActive[kPrev];
            vActive.RemoveAt(k);
            bisecActive.RemoveAt(k);
            intxActive.RemoveAt(k);
            eActive.RemoveAt(k);

            if( k >= vActive.Count )
            {

              k = 0;

            }

            if (kPrev >= vActive.Count)
            {

              kPrev = vActive.Count - 1;

            }

            if( kPlus >= vActive.Count )

              kPrev = ( k + vActive.Count ) % vActive.Count;
            
            int kPrevX2 = (kPrev + vActive.Count - 1 ) % vActive.Count;
            
            bisecActive[kPrev] = FindBisect(eActive[kPrev], eActive[k]);

            // AND RECALCULATE INTERSECTIONS
            var uu = new Interval(thr, thr);
            LineLineIntx(vActive[kPrev], vActive[kPrev] + bisecActive[kPrev], vActive[kPrevX2], vActive[kPrevX2] + bisecActive[kPrevX2], ref uu);
            intxActive[kPrev] = new Interval(uu[0], intxActive[kPrev][1]);
            intxActive[kPrevX2] = new Interval(intxActive[kPrevX2][0], uu[1]);

            uu = new Interval(thr, thr);
            LineLineIntx(vActive[k], vActive[k] + bisecActive[k], vActive[kPrev], vActive[kPrev] + bisecActive[kPrev], ref uu);
            intxActive[k] = new Interval(uu[0], intxActive[k][1]);
            intxActive[kPrev] = new Interval(intxActive[kPrev][0], uu[1]);

            /*if( kPlus >= vActive.Count )
            {

              kPlus = ( kPrev + 1 ) % vActive.Count;
              uu = new Interval(thr, thr);
              LineLineIntx(vActive[kPlus], vActive[kPlus] + bisecActive[kPlus], vActive[k], vActive[k] + bisecActive[k], ref uu);
              intxActive[kPlus] = new Interval(uu[0], intxActive[kPlus][1]);
              intxActive[k] = new Interval(intxActive[k][0], uu[1]);

            }*/

            skelCt += 1;
            //Print(skelCt.ToString());

          }

          k = (k + 1) % intxActive.Count;
          safety += 1;

          if( vActive.Count <= 3 )
          {

            tri = true;

          }

        }

        if( tri )
        {

          for( int m = 0; m <= vActive.Count - 1; ++m )
          {

            var skelPth = new GH_Path(skelCt);
            int mPrev = (m + vActive.Count - 1) % vActive.Count;

            skelAll.Add(new Line(vActive[m], vActive[m] + intxActive[m][0] * bisecActive[m]), fIE.Path(i));

            skelCt += 1;

          }

          bisecActive.Clear();
          vActive.Clear();
          eActive.Clear();

        }

      }

    }

    A = skelAll;
    B = vActive;
    C = bisecActive;
    D = eActive;
# ---------- c_script_7: C# additional code ----------
  public Vector3d FindBisect(Line edgeIn, Line edgeOut)
  {

    var vctIn = new Vector3d(-edgeIn.Direction);
    var vctOut = new Vector3d(edgeOut.Direction);
    vctIn.Unitize();
    vctOut.Unitize();

    double degIn = 0.0;
    double degOut = 0.0;
    EdgeDirection(ref vctIn, ref degIn);
    EdgeDirection(ref vctOut, ref degOut);

    if( degOut < degIn )
    {

      degOut += 2 * Math.PI;

    }

    double amp = 1;
    double ang = degOut - degIn;

    if( ang > Math.PI )
    {

      amp *= -1;

    }

    var bsctVct = new Vector3d(vctIn.X + vctOut.X, vctIn.Y + vctOut.Y, 0);

    if( bsctVct.Length > 0 )
    {

      bsctVct *= amp / bsctVct.Length;

    }

    else
    {

      bsctVct = Vector3d.CrossProduct(vctIn, Vector3d.ZAxis);
      bsctVct.Unitize();

    }

    return bsctVct;

  }

  public void EdgeDirection(ref Vector3d eCurr, ref double degList)
  {
    // FIND DIRECTION OF EDGE
    double deg;
    if (eCurr.X == 0)
    {
      deg = 90 * (eCurr.Y / Math.Abs(eCurr.Y)) + 360;
      deg = (360 + deg) % 360;
    }
    else
    {
      deg = Math.Atan(eCurr.Y / eCurr.X) * 180 / Math.PI;

      if( eCurr.X < 0 )
      {

        deg = 180 + deg;

      }

      if( eCurr.X > 0 )
      {

        deg = (360 + deg) % 360;

      }

    }

    degList = Math.PI * deg / 180;

  }

  public void LineLineIntx(Point3d pt1, Point3d pt2, Point3d pt3, Point3d pt4, ref Interval interval) {
    // via Paul Bourke: http://www-cs.ccny.cuny.edu/~wolberg/capstone/intersection/Intersection%20point%20of%20two%20lines.html
    double denom = ( pt4.Y - pt3.Y ) * ( pt2.X - pt1.X ) - ( pt4.X - pt3.X ) * ( pt2.Y - pt1.Y );

    if( denom != 0 )
    {
      double u1 = ( ( pt4.X - pt3.X ) * ( pt1.Y - pt3.Y ) - ( pt4.Y - pt3.Y ) * ( pt1.X - pt3.X ) ) / denom;
      double u2 = ( ( pt2.X - pt1.X ) * ( pt1.Y - pt3.Y ) - ( pt2.Y - pt1.Y ) * ( pt1.X - pt3.X ) ) / denom;

      interval = new Interval(u1, u2);

    }

  }
# ---------- end c_script_7 ----------

hem_to_straight_skeleton = VBScript(
    e=c_script_5.e,
    eOV=c_script_5.eOV,
    ePE=c_script_5.ePE,
    eNE=c_script_5.eNE,
    v=c_script_5.v,
    vIE=c_script_5.vIE,
    f=c_script_5.f,
    fIE=c_script_5.fIE,
    thr=threshold_3,
    stp=threshold,
    bnd=boundary_face)  # -> out, A, B, C, D; inputs e: list of Line, eOV: list, ePE: list, eNE: list, v: list of Point3d, vIE: tree, f: tree, fIE: tree
# ---------- hem_to_straight_skeleton: VB ----------
    'Definition originally written For
    '  codeQuotidien.wordpress.org
    '  Trevor Patt
    '  trpatt@gmail.com

    '  Creative Commons:  Attribution/NonCommercial/ShareAlike

    Dim skelAll As New datatree(Of line)
    'Dim bisecAll As New datatree(Of vector3d)
    'Dim vtxAll As New datatree(Of point3d)
    'Dim intAll As New datatree (Of point3d)
    
    Dim vActive As New list (Of point3d)
    Dim bisecActive As New list(Of vector3d)
    Dim eActive As New list (Of line)

    For i As int32=0 To fIE.BranchCount - 1
      If i <> bnd Then
        'Dim bisecActive As New list(Of vector3d)
        'Dim vActive As New list (Of point3d)
        bisecActive.clear
        vActive.clear
        eActive.clear
        Dim intxActive As New list (Of interval)



        Dim e0 As int32 = fIE.Branch(i)(0)
        Dim eCurr As int32 = e0


        Dim ct As int32 = 0
        Do
          Dim iCtPth As New gh_path(i, ct)
          'bisecAll.ensurepath(iCtPth)
          'FIND THE INITIAL BISECTING RAYS
          biSecActive.add(FindBisect(e(ePE(eCurr)), e(eCurr)))
          'biSecAll.add(biSecActive(ct), iCtPth)
          vActive.add(v(eOV(eCurr)))
          eActive.add(e(ePE(eCurr)))

          eCurr = eNE(eCurr)
          ct += 1
        Loop While eCurr <> e0


        eCurr = e0

        'CREATE ALL INTERVALS SO THAT THEY CAN BE EDITED ONE VALUE AT A TIME
        For j As int32=0 To biSecActive.count - 1
          intxActive.add(New interval(thr, thr))
        Next

        'FIND INTERSECTION PARAMETERS
        For j As int32=0 To biSecActive.count - 1
          Dim ijPth As New gh_path(i, j)
          Dim jPrev As int32 = (j + biSecActive.count - 1) Mod biSecActive.count

          Dim uu As New interval(thr, thr)
          LineLineIntx(vActive(j), vActive(j) + biSecActive(j), vActive(jPrev), vActive(jPrev) + biSecActive(jPrev), uu)

          intxActive(j) = New interval(uu(0), intxActive(j)(1))
          intxActive(jPrev) = New interval(intxActive(jPrev)(0), uu(1))

          eCurr = eNE(eCurr)
        Next

        eCurr = e0


        Dim k As int32 = 0
        Dim safety As Int32 = 0
        Dim tri As Boolean = False
        Dim skelCt As int32 = 0
        Do While safety < stp AndAlso Not tri'AndAlso k < intxActive.count - 1

          Dim kPrev As int32 = (k + intxActive.count - 1) Mod intxActive.count
          Dim ikPth As New gh_path(i, k)
          Dim iPrevPth As New gh_path(i, kPrev)



          If math.Abs(intxActive(k)(0)) <= math.Abs(intxActive(k)(1)) AndAlso math.Abs(intxActive(kPrev)(1)) <= math.Abs(intxActive(kPrev)(0)) Then
            Dim skelPth As New gh_path(skelCt)
            'intAll.add(vActive(k) + (intxActive(k)(0) * biSecActive(k)), skelPth)
            'vtxAll.add(vActive(k), skelPth)
            'vtxAll.add(vActive(kPrev), skelPth)
            skelAll.add(New line(vActive(k), vActive(k) + (intxActive(k)(0) * biSecActive(k))), fIE.Path(i))
            skelAll.add(New line(vActive(kPrev), vActive(k) + (intxActive(k)(0) * biSecActive(k))), fIE.Path(i))

            'IF THERE IS AN INTERSECTION REMOVE PREVIOUS VERTEX, RAYS, REPLACE WITH NEW
            vActive(kPrev) = vActive(kPrev) + (intxActive(kPrev)(1) * biSecActive(kPRev))
            vActive.removeat(k)
            biSecActive.removeat(k)
            intxActive.removeat(k)
            eActive.removeat(k)

            If k >= vActive.count Then k = 0
            If kPrev >= vActive.count Then kPrev = vActive.count - 1
            Dim kPrevX2 As int32 = (kPrev + vActive.count - 1) Mod vActive.count

            biSecActive(kPrev) = FindBisect(eActive(kPrev), eActive(k))

            'AND RECALCULATE INTERSECTIONS
            Dim uu As New interval(thr, thr)
            LineLineIntx(vActive(kPrev), vActive(kPrev) + biSecActive(kPrev), vActive(kPrevX2), vActive(kPrevX2) + biSecActive(kPrevX2), uu)
            intxActive(kPrev) = New interval (uu(0), intxActive(kPrev)(1))
            intxActive(kPrevX2) = New interval (intxActive(kPrevX2)(0), uu(1))

            uu = New interval(thr, thr)
            LineLineIntx(vActive(k), vActive(k) + biSecActive(k), vActive(kPrev), vActive(kPrev) + biSecActive(kPrev), uu)
            intxActive(k) = New interval (uu(0), intxActive(k)(1))
            intxActive(kPrev) = New interval (intxActive(kPrev)(0), uu(1))

            skelCt += 1
          End If



          k = (k + 1) Mod intxActive.count
          safety += 1

          If vActive.count <= 3 Then tri = True
        Loop

        If tri Then
          For m As int32=0 To vActive.count - 1
            Dim skelPth As New gh_path(skelCt)
            Dim mPrev As int32 = (m + vActive.count - 1) Mod vActive.count

            'intAll.add(vActive(m) + (intxActive(m)(0) * biSecActive(m)), skelPth)
            'vtxAll.add(vActive(m), skelPth)
            skelAll.add(New line(vActive(m), vActive(m) + (intxActive(m)(0) * biSecActive(m))), fIE.Path(i))

            skelCt += 1
          Next
          bisecActive.clear
          vActive.clear
          eActive.clear
        End If

      End If
    Next





    A = skelAll
    B = vActive
    C = bisecActive
    D = eActive
# ---------- hem_to_straight_skeleton: VB additional code ----------
  Function FindBisect(ByRef edgeIn As line, ByRef edgeOut As line) As vector3d

    Dim vctIn As New vector3d(-edgeIn.Direction)
    Dim vctOut As New vector3d(edgeOut.Direction)
    vctIn.Unitize
    vctOut.Unitize

    Dim degIn As Double
    Dim degOut As Double
    EdgeDirection(vctIn, degIn)
    EdgeDirection(vctOut, degOut)

    If degOut < degIn Then degOut += (2 * math.PI)

    Dim amp As Double = 1'distOff / math.Sin(ang / 2)
    Dim ang As Double = degOut - degIn
    If ang > math.PI Then amp *= -1 'print("!!!") '

    Dim bsctVct As New vector3d(vctIn.X + vctOut.X, vctIn.Y + vctOut.Y, 0)
    If bsctVct.length > 0 Then
      bsctVct *= amp / bsctVct.length
    Else
      bsctVct = vector3d.CrossProduct(vctIn, vector3d.ZAxis)
      bsctVct.unitize
    End If


    Return bsctVct 'bsctPt

  End Function

  Sub EdgeDirection(ByRef eCurr As vector3d, ByRef degList As Double)
    'FIND DIRECTION OF EDGE
    Dim deg As Double
    If eCurr.x = 0 Then
      deg = (90 * (eCurr.Y / math.abs(eCurr.Y))) + 360
      deg = (360 + deg) Mod 360
    Else
      deg = ((math.atan(eCurr.Y / eCurr.x)) * 180 / math.PI)
      If eCurr.X < 0 Then deg = 180 + deg
      If eCurr.X > 0  Then deg = (360 + deg) Mod 360
    End If
    'print(deg)
    degList = (math.PI * deg / 180)
  End Sub

  Sub LineLineIntx(ByRef pt1 As point3d, ByRef pt2 As point3d, ByRef pt3 As point3d, pt4 As point3d, ByRef int As interval)
    'via Paul Bourke: http://www-cs.ccny.cuny.edu/~wolberg/capstone/intersection/Intersection%20point%20of%20two%20lines.html

    Dim denom As Double = ((pt4.y - pt3.Y) * (pt2.X - pt1.X)) - ((pt4.X - pt3.X) * (pt2.Y - pt1.Y))
    If denom <> 0 Then
      Dim u1 As Double = (((pt4.X - pt3.X) * (pt1.Y - pt3.Y)) - ((pt4.Y - pt3.Y) * (pt1.X - pt3.X))) / denom
      Dim u2 As Double = (((pt2.X - pt1.X) * (pt1.Y - pt3.Y)) - ((pt2.Y - pt1.Y) * (pt1.X - pt3.X))) / denom

      'If u1 < 0 Then u1 = int(0)
      'If u2 < 0 Then u2 = int(1)

      int = New interval(u1, u2)
    End If
  End Sub
# ---------- end hem_to_straight_skeleton ----------

panel_3 = Panel(c_script_7.out)
points_7 = PointList(Points=c_script_7.B, Tags=True, Lines=True, Size=2)

# ---- group: IN PROGRESS DISPLAYS ONLY LAST FACE
curvepoint = PointOnCurve(hem_to_straight_skeleton.D, parameter=0.5)  # disabled
amp = Amplitude(Vector=hem_to_straight_skeleton.C, Amplitude=3)  # disabled
points_8 = PointList(Points=hem_to_straight_skeleton.B, Tags=True, Lines=True, Size=2)  # disabled
vdis_2 = VectorDisplay(Anchor=hem_to_straight_skeleton.B, Vector=amp)  # disabled
points_9 = PointList(Points=curvepoint, Tags=True, Lines=False, Size=1)  # disabled

# ----
crv_5 = Curve(hem_to_straight_skeleton.A)  # disabled
shift_2 = ShiftList(List=c_script_7.B, Shift=1, Wrap=False)
data = Data(c_script_7.A)
ln_2 = Line(StartPoint=c_script_7.B, EndPoint=shift_2)
merge = Merge(Data1=data, Data2=ln_2)  # -> flatten(Result)

# ---- group: SpacePartition / OriginalSilhouette
crv_6 = Curve(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)

# ----
crv_7 = Curve(crv_6)

# ---- group: Spine
toggle = GroupToggle(ToggleActive=True, ToggleVisible=False)  # disabled
crv_8 = Curve(crv_7)
skeleton = MedialAxisSkeleton(CurveIn=crv_8, NumberOfSamples=Slider(320, range=0..1000), ParallelComputing=True)
dupln = RemoveDuplicateLines(Lines=skeleton, Tolerance=0.01)
inside = InsideOriginal(CurvesToCull=dupln, BoundaryCurve=crv_7, ParallelComputing=True)
crv_9 = Curve(inside)
cut_3 = CutCorners(CurvesToSplit=crv_9, Parallel=True)
offset_2 = OffsetCurve(Curve=crv_8, Distance=Slider(0.913, range=-10..10), Plane=PlaneXY(0, 0, 0), Corners=1)
intercull_2 = IntersectionCulling(CurvesToCull=cut_3, BoundaryCurve=offset_2, ParallelComputing=True)
reconstruct_3 = ReconstructCurve(CurvesIn=intercull_2)

# ---- group: SpacePartition / RandomColourSeed
number_slider_21 = Slider(40, range=0..100)
number_slider_22 = Slider(402, range=0..1000)
number_slider_23 = Slider(326, range=0..1000)

# ----
inside_2 = InsideOriginal(CurvesToCull=merge, BoundaryCurve=crv, ParallelComputing=True)
flatten_5 = FlattenTree(Tree=prunebranches_2.prunedTree, Path="{0}")
number_slider_24 = Slider(1, range=0..1)  # disabled
number_slider_25 = Slider(4, range=0..10)  # disabled
toggle_2 = BooleanToggle(True)  # disabled

# ---- group: AddAreaForCirculation
multiplication = Multiplication(A=flatten_5, B=0.3)
addition = Addition(A=flatten_5, B=multiplication)  # -> simplify(Result)

# ----
crv_10 = Curve(inside_2)
number_slider_26 = Slider(5, range=0..10)  # disabled
cut_4 = CutCorners(CurvesToSplit=crv_10, Parallel=True)
number_slider_27 = Slider(70, range=0..100)  # disabled
multiplication_2 = Multiplication(A=number_slider_26, B=number_slider_27)  # disabled
offset_3 = OffsetCurve(Curve=crv, Distance=Slider(-0.584, range=-10..10), Plane=PlaneXY(0, 0, 0), Corners=1)
panel_4 = Panel("""0: Privado
1: Privado
2: Público
3: SemiPrivado""")
intercull_3 = IntersectionCulling(CurvesToCull=merge, BoundaryCurve=offset_3, ParallelComputing=True)
txt_4 = Text(prunebranches.prunedTree)
graft = GraftTree(Tree=panel_4, IncludeEmptyLists=True, IncludeNullItems=True)  # -> simplify(Tree)
offset_4 = OffsetCurve(Curve=crv, Distance=Slider(-0.799, range=-10..10), Plane=PlaneXY(0, 0, 0), Corners=1)
reconstruct_4 = ReconstructCurve(CurvesIn=intercull_3)
graft_2 = GraftTree(Tree=txt_4, IncludeEmptyLists=True, IncludeNullItems=True)
intercull_4 = IntersectionCulling(CurvesToCull=cut_4, BoundaryCurve=offset_4, ParallelComputing=True)
addindextolabels = CSharpScript(labels=graft_2)  # -> indexedLabels; inputs labels: tree of String
# ---------- addindextolabels: C# ----------
    var newLabels = new DataTree<string>();
    
    for( int i = 0; i < labels.BranchCount; ++i )
      for( int j = 0; j < labels.Branch(i).Count; ++j )
      {
      
        newLabels.Add( i.ToString() + " " + labels.Branch(i)[j], new GH_Path(i) );
      
      }
    
    indexedLabels = newLabels;
# ---------- end addindextolabels ----------
reconstruct_5 = ReconstructCurve(CurvesIn=intercull_4)
galapagos = Galapagos(fitness=ma_2, gene=[seedsx, seedsy])

# ---- group: Perlin
number_slider_28 = Slider(22, range=0..100)  # disabled
number_slider_29 = Slider(4, range=0..10)  # disabled
number_slider_30 = Slider(0, range=0..100)  # disabled
number_slider_31 = Slider(4, range=0..10)  # disabled
dom_2 = ConstructDomain(DomainStart=number_slider_30, DomainEnd=number_slider_29)  # disabled
genemodifier = GenePoolModifier(GeneList="Weights", Count=expr("x+1", number_slider_28), Domain=dom_2)  # disabled
number_slider_32 = Slider(4, range=0..10)  # disabled
number_slider_33 = Slider(69, range=0..1000)  # disabled
number_slider_34 = Slider(3.2, range=0..10)  # disabled
number_slider_35 = Slider(0.430667, range=0..1)  # disabled
number_slider_36 = Slider(13.910642, range=0..100)  # disabled
number_slider_37 = Slider(32.088268, range=0..100)  # disabled
knots = KnotVector(Count=expr("x+1", number_slider_28), Degree=number_slider_31, Periodic=False)  # disabled
weights = GenePool(Decimals=2, Maximum=4, Minimum=0, Value=[2, 2, 2, 2, 2, 2, 2, 2, 2, 2, 2, 2, 2, 2, 2, 2, 2, 2, 2, 2, 2, 2, 2])  # disabled
number_slider_38 = Slider(1000, range=0..1000)  # disabled
number_slider_39 = Slider(0, range=0..1000)  # disabled
number_slider_40 = Slider(0, range=0..1000)  # disabled
rgb_2 = ColourRGB(Alpha=255, Red=number_slider_38, Green=number_slider_39, Blue=number_slider_40)  # disabled
number_slider_41 = Slider(3.01, range=0..10)  # disabled

# ---- group: Voronoi
number_slider_42 = Slider(0, range=0..0.1)
subtraction = Subtraction(A=Slider(1, range=0..1), B=number_slider_42)
dom_3 = ConstructDomain(DomainStart=number_slider_42, DomainEnd=subtraction)
pt_5 = ConstructPoint(XCoordinate=seedsx, YCoordinate=seedsy, ZCoordinate=0)

# ----
genemodifier_2 = GenePoolModifier(GeneList="SeedsX", Count=lng, Domain=dom_3, Randomize=Button(), PercentageOfRandomization=Slider(1, range=0..1))
genemodifier_3 = GenePoolModifier(GeneList="SeedsY", Count=lng, Domain=dom_3, Randomize=Button(), PercentageOfRandomization=Slider(1, range=0..1))

# ---- group: Grid
dom_4 = ConstructDomain(DomainStart=expr("-x", number_slider_3), DomainEnd=number_slider_3)
dom_5 = ConstructDomain(DomainStart=expr("-x", number_slider_4), DomainEnd=number_slider_4)
pt_6 = Point(Point(-27.55069635, 0.2364199029, 0))
dedomain = DeconstructDomain(Domain=dom_4)  # -> Start, End
rectangle_2 = Rectangle(Plane=pt_6, XSize=dom_5, YSize=dom_4, Radius=0)  # -> Rectangle, Length
crv_11 = Curve(rectangle_2.Rectangle)
ptsrfdomlen = SurfaceDomainLength(Surface=crv_11, ULength=division_2, VLength=division)  # disabled

# ---- group: Perlin (continued)
range = Range(Domain=dom_4, Steps=number_slider_28)  # disabled
perlinnoise = CSharpScript(x=range, fre=number_slider_34, amp=number_slider_35, iter=number_slider_32, t=number_slider_37, seed=number_slider_33)  # -> out, A; inputs x: Double, fre: Double, amp: Double, iter: Int32, t: Double, seed: Int32; disabled
# ---------- perlinnoise: C# ----------
    //time+=1e-7;
    
    A = fbm(new vec3(x, 0, 0) + t, fre, amp, iter, seed);
# ---------- perlinnoise: C# additional code ----------
  //double time = 0;
  
  double hash(double a, int seed)
  {

    //return fract(Math.Sin(a) * 4513.15);
    var rand = new Random( seed );
    return rand.NextDouble() * ( 1.0 + 1.0 ) - 1.0;

  }

  double noise(vec3 x, int seed)
  {

    vec3 p = x.floor();
    vec3 k = x.fract();

    k *= k * k * ( 3.0 - 2.0 * k );

    double n = p.X() + p.Y() * 57.0 + p.Z() * 113.0;

    double a = hash(n, seed);
    double b = hash(n + 1.0, seed);
    double c = hash(n + 57.0, seed);
    double d = hash(n + 58.0, seed);

    double e = hash(n + 113.0, seed);
    double f = hash(n + 114.0, seed);
    double g = hash(n + 170.0, seed);
    double h = hash(n + 171.0, seed);

    double res = vec3.mix(vec3.mix(vec3.mix(a, b, k.X()), vec3.mix(c, d, k.X()), k.Y()),
      vec3.mix(vec3.mix(e, f, k.X()), vec3.mix(g, h, k.X()), k.Y()),
      k.Z()
      );

    return res;

  }

  double fbm(vec3 f, double freq, double ampl, int iter, int seed)
  {

    double amp = 1.0, fre = 1.7, res = 0.0;

    for( int i = 0; i < iter; ++i )
    {

      amp *= ampl;
      fre *= freq;

      amp += amp;

      res += amp * noise(fre * f, seed);

    }

    return res;

  }

  class vec3
  {

    double x, y, z;

    public vec3(double x, double y, double z)
    {

      this.x = x;
      this.y = y;
      this.z = z;

    }

    public vec3(Point3d point)
    {

      this.x = point.X;
      this.y = point.Y;
      this.z = point.Z;

    }

    public double X()
    {

      return x;

    }

    public double Y()
    {

      return y;

    }

    public double Z()
    {

      return z;

    }

    // Addition operator overload.
    public static vec3 operator+( vec3 x, vec3 y )
    {

      return new vec3(x.X() + y.X(), x.Y() + y.Y(), x.Z() + y.Z());

    }

    public static vec3 operator+( vec3 x, double y )
    {

      return new vec3(x.X() + y, x.Y() + y, x.Z() + y);

    }

    public static vec3 operator+( double y, vec3 x )
    {

      return new vec3(y + x.X(), y + x.Y(), y + x.Z());

    }

    // Subtraction operator overload.
    public static vec3 operator-( vec3 x, vec3 y )
    {

      return new vec3(x.X() - y.X(), x.Y() - y.Y(), x.Z() - y.Z());

    }

    public static vec3 operator-( vec3 x, double y )
    {

      return new vec3(x.X() - y, x.Y() - y, x.Z() - y);

    }

    public static vec3 operator-( double y, vec3 x )
    {

      return new vec3(y - x.X(), y - x.Y(), y - x.Z());

    }

    // Multiplication operator overload.
    public static vec3 operator*( vec3 x, vec3 y )
    {

      return new vec3(x.X() * y.X(), x.Y() * y.Y(), x.Z() * y.Z());

    }

    public static vec3 operator*( vec3 x, double y )
    {

      return new vec3(x.X() * y, x.Y() * y, x.Z() * y);

    }

    public static vec3 operator*( double y, vec3 x )
    {

      return new vec3(y * x.X(), y * x.Y(), y * x.Z());

    }

    // Fractional part of a vec3.
    public vec3 fract()
    {

      return new vec3(fract(x), fract(y), fract(y));

    }

    // Floor.
    public vec3 floor()
    {

      return new vec3(Math.Floor(x), Math.Floor(y), Math.Floor(z));

    }

    // Fractional part of a double.
    public double fract(double x)
    {

      return x - Math.Truncate(x);

    }

    // Linear interpolation of a double.
    public static double mix(double a, double b, double c)
    {

      return a - ( 1 - c ) + b * c;

    }

    // Linear interpolation of a vec3.
    public static vec3 mix(vec3 a, vec3 b, double c)
    {

      double mixX = mix(a.X(), b.X(), c);
      double mixY = mix(a.Y(), b.Y(), c);
      double mixZ = mix(a.Z(), b.Y(), c);

      return new vec3(mixX, mixY, mixZ);

    }

    public Point3d toPoint()
    {

      return new Point3d(this.X(), this.Y(), this.Z());

    }

  }

  public double fract(double x)
  {

    return x - Math.Truncate(x);

  }
# ---------- end perlinnoise ----------
pt_7 = ConstructPoint(XCoordinate=perlinnoise.A, YCoordinate=range, ZCoordinate=0)  # disabled
item_4 = ListItem(List=pt_7, Index=0, Wrap=True)  # disabled
Y = UnitY(Factor=dedomain.Start)  # disabled
move_2 = Move(Geometry=pt_6, Motion=Y)  # -> Geometry, Transform; disabled
vec2pt = Vector2Pt(PointA=item_4, PointB=move_2.Geometry, Unitize=False)  # -> Vector, Length; disabled
move_3 = Move(Geometry=pt_7, Motion=vec2pt.Vector)  # -> Geometry, Transform; disabled
nurbcrv = NurbsCurvePWK(Points=move_3.Geometry, Weights=weights, Knots=knots)  # -> Curve, Length, Domain; disabled
previewlw = CustomPreviewLineweights(Geometry=nurbcrv.Curve, Shader=rgb_2, Thickness=number_slider_41, Absolute=False)  # disabled

# ----
ptsrfdomnum = SurfaceDomainNumber(Surface=crv_11, UNumber=Slider(3, range=0..100), VNumber=Slider(15, range=0..100))
closestptgrid = ClosestPointInGrid(Grid=ptsrfdomnum, Point=pt)  # -> ClosestPointInGrid, BranchOfGrid, LeafOfGrid; disabled
closestptgrid_2 = ClosestPointInGrid(Grid=ptsrfdomnum, Point=pt_2)  # -> ClosestPointInGrid, BranchOfGrid, LeafOfGrid; disabled
shortorto = ShortestPathOrthogonal(
    Grid=ptsrfdomnum,
    StartPointBranch=closestptgrid.BranchOfGrid,
    StartPointLeaf=closestptgrid.LeafOfGrid,
    EndPointBranch=closestptgrid_2.BranchOfGrid,
    EndPointLeaf=closestptgrid_2.LeafOfGrid)  # disabled

# ---- group: Voronoi (continued)
evalsrf = EvaluateSurface(Surface=reparameterize(crv_11), Point=pt_5)  # -> Point, Normal, UDirection, VDirection, Frame
pt_8 = Point(evalsrf.Point)
voronoi_2 = Voronoi(Points=pt_8, Boundary=rectangle_2.Rectangle, BruteForceOverride=False)

# ----
panel_5 = Panel(pt_8)  # disabled

# ---- group: Grid (continued)
ptcrvatts = CurveAttraction(Grid=ptsrfdomnum, CrvAtts=nurbcrv.Curve, Magnitude=number_slider_7)  # -> Grid, Weights; disabled
ptborders = GenerateBorders(Grid=ptsrfdomnum, PanelShape=0)  # -> simplify(Border)
crv_12 = Curve(flatten(ptborders))
area_3 = Area(Geometry=ptborders, UseTasks=False)  # -> Area, Centroid

# ---- group: Circulation
colom = CollisionOneMany(Collider=nurbcrv.Curve, Obstacles=graft(crv_12))  # -> Collision, Index; disabled
cull_4 = CullPattern(List=crv_12, CullPattern=flatten(colom.Collision))  # disabled
pararunion = ParallelRegionUnion(Curves=cull_4)  # disabled
parallelregionintersection_2 = ParallelRegionIntersection(CurvesA=crv_6, CurvesB=pararunion)  # disabled
srf = Surface(parallelregionintersection_2)  # disabled
frgb = ColourRGBF(Alpha=1, Red=0, Green=0, Blue=0)  # disabled
preview_2 = CustomPreview(Geometry=srf, Material=frgb)  # disabled

# ----
qt = QuadTree(Points=pt_8, Plane=PlaneXY(0, 0, 0), Square=False, Group=5)  # -> Quads, Points; disabled
qt_2 = QuadTree(Points=flatten(ptsrfdomnum), Plane=PlaneXY(0, 0, 0), Square=False, Group=5)  # -> Quads, Points; disabled
panel_6 = Panel(qt.Points)  # disabled
previewlw_2 = CustomPreviewLineweights(Geometry=shortorto, Shader=rgb, Thickness=number_slider_18, Absolute=False)  # disabled

# ---- group: ManhattanVoronoi
number_slider_43 = Slider(10, range=0..10)  # disabled
python = GhPythonScript(r=number_slider_43, P=evalsrf.Point)  # -> out, PL; inputs P: list of Point3d; disabled
# ---------- python: Python ----------
__author__ = "Paula"
__version__ = "2019.04.23"

import rhinoscriptsyntax as rs
from Rhino.Geometry import Point3d as P3
from Rhino.Geometry import Polyline as PLine

def taxicab_midnormal ( Point_1 = P3(0,0,0), Point_2 = P3(0,0,0) , leng = 10000):
    dx = abs(Point_1.X - Point_2.X)
    dy = abs(Point_1.Y - Point_2.Y)
    
    C = P3 ( ( Point_1.X + Point_2.X ) / 2, ( Point_1.Y + Point_2.Y ) / 2, ( Point_1.Z + Point_2.Z ) / 2)
    
    """ MPQN, in which M is on the lengeft(X-) or bottom(Y-) """
    P = P3 (0,0,C.Z)
    Q = P3 (0,0,C.Z)
    M = P3 (0,0,C.Z)
    N = P3 (0,0,C.Z)
    
    if dx > dy:
        P.Y = C.Y + dy / 2
        Q.Y = C.Y - dy / 2
        M.Y = P.Y + leng
        N.Y = Q.Y - leng
        if bool(Point_1.Y > Point_2.Y) ^ bool(Point_1.X > Point_2.X):
            P.X = C.X + dy / 2
            Q.X = C.X - dy / 2
        else:
            P.X = C.X - dy / 2
            Q.X = C.X + dy / 2
        M.X = P.X
        N.X = Q.X
    else:
        if dx < dy:
            P.X = C.X + dx / 2
            Q.X = C.X - dx / 2
            M.X = P.X + leng
            N.X = Q.X - leng
            if bool(Point_1.Y > Point_2.Y) ^ bool(Point_1.X > Point_2.X):
                P.Y = C.Y + dx / 2
                Q.Y = C.Y - dx / 2
            else:
                P.Y = C.Y - dx / 2
                Q.Y = C.Y + dx / 2
            M.Y = P.Y
            N.Y = Q.Y
        else:
            if bool(Point_1.Y > Point_2.Y) ^ bool(Point_1.X > Point_2.X):
                P.Y = C.Y - dx / 2
                Q.Y = C.Y + dx / 2
                P.X = C.X - dy / 2
                Q.X = C.X + dy / 2
                M.Y = P.Y - leng
                M.X = P.X - leng
                N.Y = Q.Y + leng
                N.X = Q.X + leng
            else:
                P.Y = C.Y - dx / 2
                Q.Y = C.Y + dx / 2
                P.X = C.X + dy / 2
                Q.X = C.X - dy / 2
                M.Y = P.Y - leng
                M.X = P.X + leng
                N.Y = Q.Y + leng
                N.X = Q.X - leng

    return rs.AddPolyline( [M , P , Q , N] )

def taxicab_circle ( point = P3(0,0,0), r = 1 ):
    A = P3( point.X + r, point.Y, point.Z )
    B = P3( point.X, point.Y + r, point.Z )
    C = P3( point.X - r, point.Y, point.Z )
    D = P3( point.X, point.Y - r, point.Z )
    return rs.AddPolyline( [A, B, C, D, A] )

l = 2 * r

""" PL = taxicab_midnormal ( A, B, r ) """

pts = P

polylines = []
for i in range( len( P ) ):
    polylines.append(taxicab_circle( P[i], l ))

for i in range(len(polylines)):
    for j in range(i):
        if i == j:
            continue
        if rs.CurveBooleanUnion( [ polylines[i], polylines[j] ] ):
            MN = taxicab_midnormal( pts[i], pts[j], l )
            
            ccx = rs.CurveCurveIntersection( polylines[i], MN )
            if ccx is None:
                continue
            if ccx[0][0] == 2:
                continue
            para_a = [ ccx[0][5], ccx[1][5] ]
            para_b = [ ccx[0][7], ccx[1][7] ]
            
            if para_b[0] > para_b[1]:
                para_b = [ para_b[1], para_b[0] ]
            
            probable_dash = rs.SplitCurve(polylines[i], para_a)
            edge = rs.TrimCurve(MN, para_b, False )
            edgepts = rs.CurvePoints(edge)
            
            for crv in probable_dash:
                crvpts = rs.CurvePoints(crv)
                if rs.PointCompare( crvpts[0], edgepts[0] ):
                    crvpts.reverse()
                newpl = rs.AddPolyline( edgepts + crvpts )
                if rs.PointInPlanarClosedCurve( pts[i], newpl ):
                    polylines[i] = newpl
                    break
            
            
            ccx = rs.CurveCurveIntersection( polylines[j], MN )
            if ccx is None:
                continue
            para_a = [ ccx[0][5], ccx[1][5] ]
            para_b = [ ccx[0][7], ccx[1][7] ]
            
            if para_b[0] > para_b[1]:
                para_b = [ para_b[1], para_b[0] ]
            
            probable_dash = rs.SplitCurve(polylines[j], para_a)
            edge = rs.TrimCurve(MN, para_b, False )
            edgepts = rs.CurvePoints(edge)
            
            for crv in probable_dash:
                crvpts = rs.CurvePoints(crv)
                if rs.PointCompare( crvpts[0], edgepts[0] ):
                    crvpts.reverse()
                newpl = rs.AddPolyline( edgepts + crvpts )
                if rs.PointInPlanarClosedCurve( pts[j], newpl ):
                    polylines[j] = newpl
                    break
    

PL = polylines
# ---------- end python ----------
rint = RegionIntersection(CurvesA=python.PL)  # disabled
crv_13 = Curve(rint)  # disabled
srf_2 = Surface(crv_13)  # disabled

# ----
crv_14 = Curve(voronoi_2)
bang_3 = ExplodeTree(Data=qt.Points)  # -> Branch0, Branch1, Branch2, Branch3, Branch4, Branch5, Branch6, Branch7, Branch8, Branch9; disabled
srf_3 = Surface(crv_14)
pt_9 = Point(bang_3.Branch3)  # disabled
area_4 = Area(Geometry=crv_12, UseTasks=False)  # -> Area, Centroid
sort = SortList(Keys=area_4.Area, ValuesA=area_4.Area)  # -> Keys, ValuesA; disabled
lng_4 = ListLength(List=sort.ValuesA)  # disabled
subtraction_2 = Subtraction(A=lng_4, B=1)  # disabled
item_5 = ListItem(List=area_4.Area, Index=Slider(0, range=0..50), Wrap=True)
multiplication_3 = Multiplication(A=item_5, B=Slider(0.6, range=0..1))
pt_10 = Point(flatten(area_3.Centroid))  # disabled
pt_11 = Point(pt_8)  # disabled
pt_12 = Point(area_3.Centroid)  # disabled
relay = Relay([pt_11, pt_12])  # disabled
crv_15 = Curve([voronoi_2, crv_12])  # disabled
pt_13 = Point(flatten(relay))  # disabled
spctopo_2 = SpaceTopology(Curves=flatten(crv_15), ParallelComputing=toggle_2)  # disabled
c_script_8 = CSharpScript(VoroPoints=flatten(area_3.Centroid))  # -> out, A, B; inputs VoroPoints: list of Point3d, x: Double, y: Double, z: Double, u: Double; disabled
# ---------- c_script_8: C# ----------
    DataTree<GH_Curve> curveTree = new DataTree<GH_Curve>();
    DataTree<int> topoTree = new DataTree<int>();

    Grasshopper.Kernel.Geometry.Node2List node2List = new Grasshopper.Kernel.Geometry.Node2List(VoroPoints);
    Grasshopper.Kernel.Geometry.Node2Tree node2Tree = node2List.CreateTree(0.0, false, 5);

    var leafAction_Outline = new LeafAction_Outline(curveTree, Plane.WorldXY);
    node2Tree.PerformAction(leafAction_Outline, false);

    DataTree<GH_Point> pointTree = new DataTree<GH_Point>();
    var leafAction_Points = new LeafAction_Points(node2List, pointTree, Plane.WorldXY);
    node2Tree.PerformAction(leafAction_Points, false);

    A = pointTree;
    B = curveTree;
# ---------- c_script_8: C# additional code ----------
  public class LeafAction_Outline : Grasshopper.Kernel.Geometry.Node2Leaf.ILeafAction
  {
    private DataTree<GH_Curve> boxes;

    private Transform x_form;

    public LeafAction_Outline(DataTree<GH_Curve> box_list, Plane plane)
    {
      this.boxes = box_list;
      this.x_form = Transform.ChangeBasis(plane, Plane.WorldXY);
    }

    public Grasshopper.Kernel.Geometry.Node2Leaf.VorLeafRecursionResult LeafAction(Grasshopper.Kernel.Geometry.Node2Leaf Leaf)
    {
      Polyline polyline = new Polyline();
      polyline.Add(Leaf.x_min, Leaf.y_min, 0.0);
      polyline.Add(Leaf.x_max, Leaf.y_min, 0.0);
      polyline.Add(Leaf.x_max, Leaf.y_max, 0.0);
      polyline.Add(Leaf.x_min, Leaf.y_max, 0.0);
      polyline.Add(Leaf.x_min, Leaf.y_min, 0.0);
      PolylineCurve polylineCurve = new PolylineCurve(polyline);
      polylineCurve.Transform(this.x_form);
      GH_Curve gH_Curve = new GH_Curve(polylineCurve);
      this.boxes.Add(gH_Curve);
      return 0;
    }
  }

  public class LeafAction_Points : Grasshopper.Kernel.Geometry.Node2Leaf.ILeafAction
  {
    private DataTree<GH_Point> points;

    private Grasshopper.Kernel.Geometry.Node2List nodes;

    private GH_Path m_path;

    private Transform x_form;

    public LeafAction_Points(Grasshopper.Kernel.Geometry.Node2List nodelist, DataTree<GH_Point> point_list, Plane plane)
    {
      this.m_path = new GH_Path(-1);
      this.nodes = nodelist;
      this.points = point_list;
      this.x_form = Transform.ChangeBasis(plane, Plane.WorldXY);
    }

    public Grasshopper.Kernel.Geometry.Node2Leaf.VorLeafRecursionResult LeafAction(Grasshopper.Kernel.Geometry.Node2Leaf Leaf)
    {
      //      var path = new GH_Path();
      //      path.
      if (Leaf != null)
      {
        this.m_path = new GH_Path(checked(this.m_path.Indices[0] + 1));
        //try
        {
          List<int>.Enumerator enumerator = Leaf.Nodes.GetEnumerator();
          while (enumerator.MoveNext())
          {
            int current = enumerator.Current;
            Grasshopper.Kernel.Geometry.Node2 node = this.nodes[current];
            Point3d point3d = new Point3d(node.x, node.y, 0.0);
            point3d.Transform(this.x_form);
            this.points.Add(new GH_Point(point3d), this.m_path);
          }
        }
        //finally
        {
          //List<int>.Enumerator enumerator;
          //((IDisposable) enumerator).Dispose();
        }
      }
      return 0;
    }
  }
# ---------- end c_script_8 ----------
c_script_9 = CSharpScript(VoroPoints=flatten(pt_13))  # -> out, A; inputs VoroPoints: list of Point3d, x: Double, y: Double, z: Double, u: Double; disabled
# ---------- c_script_9: C# usings ----------
using Grasshopper.Kernel.Geometry;
# ---------- c_script_9: C# ----------
    DataTree<Point3d> pointTree = new DataTree<Point3d>();
    DataTree<int> topoTree = new DataTree<int>();

    Node2List node2List = new Node2List(VoroPoints);
    Node2Tree node2Tree = node2List.CreateTree(0.0, false, 10);

    GH_Path path = new GH_Path();

    for( int i = 0; i < node2List.Count; ++i )
    {

      path = new GH_Path(i);

      //Print(node2List[i].ToString());

      Node2Proximity node2Proximity = new Node2Proximity(node2List[i], i, 10, x, y);
      node2Tree.SolveProximity(node2Proximity);
      Print(node2Proximity.CurrentCount.ToString());

      //Print(node2Proximity.MaximumCount.ToString());

      if( node2Proximity.CurrentCount != 0 )
      {

        Print("YES");

        //List<int> enu = node2Proximity.get_IndexList().GetEnumerator();

        List<int> enu = node2Proximity.IndexList;//.GetEnumerator();

        for( int j = 0; j < enu.Count; ++j )
        {

          topoTree.Add(enu[j], path);

        }

      }

    }

    A = topoTree;
# ---------- end c_script_9 ----------
c_script_10 = CSharpScript(VoroPoints=[pt_8, pt_10], z=number_slider_25)  # -> out, A, B; inputs VoroPoints: list of Point3d, x: Double, y: Double, z: Int32, u: Double; disabled
# ---------- c_script_10: C# ----------
    DataTree<GH_Curve> curveTree = new DataTree<GH_Curve>();
    DataTree<int> topoTree = new DataTree<int>();

    Grasshopper.Kernel.Geometry.Node2List node2List = new Grasshopper.Kernel.Geometry.Node2List(VoroPoints);
    Grasshopper.Kernel.Geometry.Node2Tree node2Tree = node2List.CreateTree(0.0, false, z);

    var leafAction_Outline = new LeafAction_Outline(curveTree, Plane.WorldXY);
    node2Tree.PerformAction(leafAction_Outline, false);

    DataTree<GH_Point> pointTree = new DataTree<GH_Point>();
    var leafAction_Points = new LeafAction_Points(node2List, pointTree, Plane.WorldXY);
    node2Tree.PerformAction(leafAction_Points, false);

    A = pointTree;
    B = curveTree;
# ---------- c_script_10: C# additional code ----------
  public class LeafAction_Outline : Grasshopper.Kernel.Geometry.Node2Leaf.ILeafAction
  {
    private DataTree<GH_Curve> boxes;

    private Transform x_form;

    public LeafAction_Outline(DataTree<GH_Curve> box_list, Plane plane)
    {
      this.boxes = box_list;
      this.x_form = Transform.ChangeBasis(plane, Plane.WorldXY);
    }

    public Grasshopper.Kernel.Geometry.Node2Leaf.VorLeafRecursionResult LeafAction(Grasshopper.Kernel.Geometry.Node2Leaf Leaf)
    {
      Polyline polyline = new Polyline();
      polyline.Add(Leaf.x_min, Leaf.y_min, 0.0);
      polyline.Add(Leaf.x_max, Leaf.y_min, 0.0);
      polyline.Add(Leaf.x_max, Leaf.y_max, 0.0);
      polyline.Add(Leaf.x_min, Leaf.y_max, 0.0);
      polyline.Add(Leaf.x_min, Leaf.y_min, 0.0);
      PolylineCurve polylineCurve = new PolylineCurve(polyline);
      polylineCurve.Transform(this.x_form);
      GH_Curve gH_Curve = new GH_Curve(polylineCurve);
      this.boxes.Add(gH_Curve);
      return 0;
    }
  }

  public class LeafAction_Points : Grasshopper.Kernel.Geometry.Node2Leaf.ILeafAction
  {
    private DataTree<GH_Point> points;

    private Grasshopper.Kernel.Geometry.Node2List nodes;

    private GH_Path m_path;

    private Transform x_form;

    public LeafAction_Points(Grasshopper.Kernel.Geometry.Node2List nodelist, DataTree<GH_Point> point_list, Plane plane)
    {
      this.m_path = new GH_Path(-1);
      this.nodes = nodelist;
      this.points = point_list;
      this.x_form = Transform.ChangeBasis(plane, Plane.WorldXY);
    }

    public Grasshopper.Kernel.Geometry.Node2Leaf.VorLeafRecursionResult LeafAction(Grasshopper.Kernel.Geometry.Node2Leaf Leaf)
    {
      //      var path = new GH_Path();
      //      path.
      if (Leaf != null)
      {
        this.m_path = new GH_Path(checked(this.m_path.Indices[0] + 1));
        //try
        {
          List<int>.Enumerator enumerator = Leaf.Nodes.GetEnumerator();
          while (enumerator.MoveNext())
          {
            int current = enumerator.Current;
            Grasshopper.Kernel.Geometry.Node2 node = this.nodes[current];
            Point3d point3d = new Point3d(node.x, node.y, 0.0);
            point3d.Transform(this.x_form);
            this.points.Add(new GH_Point(point3d), this.m_path);
          }
        }
        //finally
        {
          //List<int>.Enumerator enumerator;
          //((IDisposable) enumerator).Dispose();
        }
      }
      return 0;
    }
  }
# ---------- end c_script_10 ----------
lng_5 = ListLength(List=c_script_10.A)  # disabled
linetopo_2 = LineTopology(PointTree=graft(pt_13), Topology=spctopo_2)  # disabled
panel_7 = Panel(spctopo_2)  # disabled
linetopo_3 = LineTopology(PointTree=graft(pt_13), Topology=c_script_9.A)  # disabled
panel_8 = Panel(lng_5)  # disabled

# ---- group: SpacePartition
number_slider_44 = Slider(0.001, range=0..0.001)
multiplication_4 = Multiplication(A=multiplication_3, B=Slider(0.7, range=0..1))
dom_6 = ConstructDomain(DomainStart=Slider(0, range=0..100), DomainEnd=Slider(255, range=0..1000))
number_slider_45 = Slider(241, range=0..255)

# ----
spacepartition = SpacePartition(VoronoiIn=crv_14, GridIn=crv_12, AreaIn=multiplication_3, Distance=multiplication_4, Tolerance=number_slider_44)

# ---- group: SpacePartition (continued)
sortxy = SortPointsXY(Grid=flatten(spacepartition))
pararunion_2 = ParallelRegionUnion(Curves=spacepartition)
missing = MissingGridCells(CulledGrid=flatten(sortxy), OriginalGrid=crv_12)
mgtree = MergeTreeMissing(CulledGrid=pararunion_2, MissingGridCells=missing)
pararunion_3 = ParallelRegionUnion(Curves=mgtree)
parallelregionintersection_3 = ParallelRegionIntersection(CurvesA=crv_6, CurvesB=pararunion_3)
lng_6 = ListLength(List=flatten(parallelregionintersection_3))
random = Random(Range=dom_6, Number=lng_6, Seed=[number_slider_21, number_slider_22, number_slider_23], Integers=True)
bang_4 = ExplodeTree(Data=random)  # -> Branch0, Branch1, Branch2
rgb_3 = ColourRGB(Alpha=Slider(10, range=0..10), Red=bang_4.Branch0, Green=bang_4.Branch1, Blue=bang_4.Branch2)  # disabled
rgb_4 = ColourRGB(
    Alpha=number_slider_45,
    Red=bang_4.Branch0,
    Green=[55, 209, 59, 216, 1, 112, 142, 1, 76, 111, 92, 58, 62, 60, 197, 158, 67, 19, 183, 163, 50, 202, 112, 182, 111],
    Blue=[9, 120, 163, 36, 100, 115, 248, 253, 79, 124, 119, 250, 189, 19, 44, 159, 229, 29, 128, 139, 34, 211, 22, 234, 166])  # disabled
srf_4 = Surface(parallelregionintersection_3)
preview_3 = CustomPreview(Geometry=graft(srf_3), Material=graft(rgb_3))  # disabled

# ----
rgb_5 = ColourRGB(Alpha=number_slider_45, Red=expr("x*2", bang_4.Branch1), Green=expr("x*0.5", bang_4.Branch1), Blue=0)

# ---- group: SpacePartition (continued)
preview_4 = CustomPreview(Geometry=srf_4, Material=graft(rgb_5))

# ---- group: CalculateThresholdOfArea
area_5 = Area(Geometry=parallelregionintersection_3, UseTasks=False)  # -> simplify(flatten(Area)), simplify(Centroid)
null_3 = NullItem(Item=area_5.Area)  # -> NullFlags, InvalidFlags, Description
expression_2 = Expression(x=null_3.InvalidFlags, y=area_5.Area, Expression="If( True, y, 1000 )")
expression_3 = Expression(x=addition, y=expression_2, Expression="Abs( x - y ) * 0.1")

# ----
c_script_11 = CSharpScript(AreaTree=area_5.Area)  # disabled
flatten_6 = FlattenTree(Tree=area_5.Area, Path="{0}")
lng_7 = ListLength(List=flatten_6)
expression_4 = Expression(x=lng_7, y=lng, Expression="If( x ≠ y, 1000, 0 )")
tag_2 = TextTag(Location=area_5.Centroid, Text=addindextolabels)

# ---- group: CalculateThresholdOfArea (continued)
ma_2 = MassAddition(Input=flatten([expression_4, expression_3]))  # -> Result, PartialResults

# ----
screentext = ScreenOrientedText(
    Text=addindextolabels,
    Font="Interstate",
    Justification=8,
    Location=area_5.Centroid,
    SizeFactor=Slider(6.961, range=0..100),
    Color=RGB(255, 255, 255),
    Depth=0,
    Absolute=False)
panel_9 = Panel(ma_2.Result)

# ---- group: TakeScreenShotIterations
toggle_3 = GroupToggle(ToggleActive=True, ToggleVisible=False)  # disabled
toggle_4 = BooleanToggle(True)  # disabled
button = Button()  # disabled
number_slider_46 = Slider(0, range=0..1)  # disabled
number_slider_47 = Slider(20, range=0..20)  # disabled
panel_10 = Panel("C:\Users\Paula\Desktop\Felipe\GenerativeFloorPlan\Images\VideoTres\")  # disabled
panel_11 = Panel("VideoTres")  # disabled
data_2 = Data(flatten([seedsx, seedsy]))  # disabled
takescreenshot = CSharpScript(
    Run=toggle_4,
    Reset=button,
    Fitness=ma_2.Result,
    Min=number_slider_46,
    Max=number_slider_47,
    GalapagosSliders=flatten(data_2),
    Path=panel_10,
    ImageName=panel_11)  # -> out; inputs Run: Boolean, Reset: Boolean, Fitness: Double, Min: Double, Max: Double, GalapagosSliders: list of Double, Path: String, ImageName: String; disabled
# ---------- takescreenshot: C# ----------
    string pather = Path + ImageName + counter.ToString();

    GH_Document ghDocument = Component.OnPingDocument();

    if(ghDocument.IsModified && Run == true )
    {

      if( Fitness >= Min && Fitness <= Max  )
      {

        Rhino.RhinoApp.RunScript("_-ScreenCaptureToFile " + pather, true);

        counter++;

      }

    }

    if(Reset == true) counter = 0;

    Print(pather);
# ---------- takescreenshot: C# additional code ----------
  int counter = 0;
# ---------- end takescreenshot ----------
panel_12 = Panel(takescreenshot)  # disabled
